# Grasshopper definition canopy.ghx (Grasshopper 0.8.11)

panel = Panel("150")
path = FilePath("C:\Users\demonchaux\Dropbox\localcode\site_ids.txt")
file = ReadFile(Path=path, Lines=True)
item = ListItem(List=file, Index=Slider(48, range=0..48), Wrap=False)
concat = Concatenate(Start="C:\amigos\dump\", End=item)
panel_2 = Panel("""-terrain
-borders
-billboardpoints
-billboards""")
concat_2 = Concatenate(Start=concat, End=panel_2)
panel_3 = Panel("""foundbillboards-projected
geocodedbillboards-projected
billboards""")
panel_4 = Panel("""groundsurface
site-projected
parcel-projected""")
concat_3 = Concatenate(Start=concat_2, End=".3dm")
merge = Merge(StreamA=panel_4, StreamB=panel_3)
python = PythonScript(FilePaths=concat_3, LayerNames=merge, DoImport=Toggle(True), GhMemory=0)  # -> out, layerTree, availableLayers; inputs FilePaths: list, LayerNames: list
# ---------- python: Python ----------
import Rhino


# for accesssing GH classes
import clr
clr.AddReference("Grasshopper")
from Grasshopper.Kernel.Data import GH_Path
from Grasshopper import DataTree


# read geometry out of 3dm files and filter by layernames
if DoImport and FilePaths and LayerNames:
    
    layerTree = DataTree[Rhino.Geometry.GeometryBase]() # make a DataTree
    availableLayers = []
    for filepath in FilePaths:
        model = Rhino.FileIO.File3dm.Read(filepath)
        for lay in model.Layers:
            availableLayers.append(lay.Name)
        if not model: continue
        for i, layer in enumerate(LayerNames):
            path = GH_Path(i)
            geometry = []
            objs = model.Objects.FindByLayer(layer)
            for obj in objs:
                geom = obj.Geometry
                geom.EnsurePrivateCopy()
                geometry.append(geom)
            layerTree.AddRange(geometry, path)
        
        # models can take up a considerable amount of
        # memory that we don't need, so get rid of it
        # after copying the geometry we want out of it
        model.Dispose()
# ---------- end python ----------
panel_5 = Panel(merge)
bang = ExplodeTree(Tree=python.layerTree)  # -> Branch0, Branch1, Branch2, Branch3, Branch4, Branch5, Branch6, Branch7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
merge_2 = Merge(StreamA=bang.Branch3, StreamB=bang.Branch4)
xy = XYPlane(Origin=Point(0, 0, 0))
flatten = FlattenTree(Data=merge_2, Path="{0}")
site_outline = Curve(bang.Branch1)
xy_2 = XYPlane(Origin=Point(0, 0, 0))
project = Project(Geometry=bang.Branch1, Plane=xy)  # -> Geometry, Transform
project_2 = Project(Geometry=bang.Branch1, Plane=xy_2)  # -> Geometry, Transform
fit = FitCrv(Curve=project.Geometry, Degree="1", Tolerance=Slider(0.462, range=0..1))
azimuth = Slider(145, range=0..359)
crv = Curve(fit)
srfsplit = SurfaceSplit(Surface=bang.Branch0, Curves=site_outline)
dispatch = Dispatch(List=srfsplit, DispatchPattern=[True, False])  # -> ListA, ListB
altitude = Slider(45, range=0..90)
crv_2 = Curve(bang.Branch1)
slider = Slider(0.5, range=0..1)
f_x = F1(Function="x*pi/180", X=azimuth)
preview = CustomPreview(Geometry=crv_2, Shader=ColourSwatch(SwatchColor=RGB(85, 0, 255)))
f_x_2 = F1(Function="x*pi/180", X=altitude)
panel_6 = Panel(f_x)
multiplication = Multiplication(A=f_x_2, B=-1)
cp = ControlPoints(Curve=crv_2)  # -> Points, Weights, Knots
panel_7 = Panel("""6
3
2""")
pi = Pi(Factor=1)
pline = PolyLine(Vertices=cp.Points, Closed=False)
Y = UnitY(Factor=1)
division = Division(A=pi, B=panel_7)
xy_3 = XYPlane(Origin=Point(0, 0, 0))
Z = UnitZ(Factor=1)
rev = Reverse(Vector=Y)
pcen = PolygonCenter(Polyline=pline)
vrot = Rotate(Vector=rev, Axis=Z, Angle=f_x)
rotate = Rotate(Geometry=xy_3, Angle=division, Plane=xy_3)  # -> Geometry, Transform
bbox = BoundingBox(Content=site_outline, Union=True, Plane=rotate.Geometry)  # -> Box, Box_2
pcomp = PlaneComponents(Plane=rotate.Geometry)  # -> Origin, XAxis, YAxis, ZAxis
distance_between_grid_points = Slider(9, range=0..10)
box = BoxComponents(Box=bbox.Box)  # -> Plane, X, Y, Z
Z_2 = UnitZ(Factor=1)
domcomp = DomainComponents(Domain=box.X)  # -> Start, End
domcomp_2 = DomainComponents(Domain=box.Y)  # -> Start, End
amp = Amplitude(Vector=pcomp.XAxis, Amplitude=domcomp.Start)
amp_2 = Amplitude(Vector=pcomp.YAxis, Amplitude=domcomp_2.Start)
pl = Plane(Origin=pcen, XAxis=vrot, YAxis=Z_2)
addition = Addition(A=amp, B=amp_2)
rotate_2 = Rotate(Geometry=pl, Angle=multiplication, Plane=pl)  # -> Geometry, Transform
division_2 = Division(A=domcomp.End, B=distance_between_grid_points)
division_3 = Division(A=domcomp_2.End, B=distance_between_grid_points)
move = Move(Geometry=rotate.Geometry, Translation=addition)  # -> Geometry, Transform
pcomp_2 = PlaneComponents(Plane=rotate_2.Geometry)  # -> Origin, XAxis, YAxis, ZAxis
f_x_3 = F1(Function="ceiling(x)", X=division_2)
f_x_4 = F1(Function="ceiling(x)", X=division_3)
f_x_5 = F1(Function="(x*2)+1", X=f_x_4)
bang_2 = ExplodeTree(Tree=graft(move.Geometry))  # -> Branch0, Branch1, Branch2
amp_3 = Amplitude(Vector=pcomp_2.XAxis, Amplitude=Slider(61, range=0..100))
f_x_6 = F1(Function="(x*2)+1", X=f_x_3)
python_2 = PythonScript(geometry=crv_2, scaleFactor=Slider(0, range=-50..100), GhMemory=10)  # -> out, a; inputs geometry: GeometryBase, scaleFactor: Double
# ---------- python_2: Python ----------
import scriptcontext

vp = scriptcontext.doc.Views.ActiveView.ActiveViewport
bbox = geometry.GetBoundingBox(True)
bbox.Inflate(-scaleFactor)
vp.ZoomBoundingBox(bbox)
# ---------- end python_2 ----------
bang_3 = ExplodeTree(Tree=graft(f_x_6))  # -> Branch0, Branch1, Branch2
bang_4 = ExplodeTree(Tree=graft(f_x_5))  # -> Branch0, Branch1, Branch2
python_3 = PythonScript(geometry=crv_2, view_vector=pcomp_2.XAxis, center_point=pcomp_2.Origin, GhMemory=0)  # -> out, a; inputs view_vector: Vector3d, center_point: Point3d
# ---------- python_3: Python ----------
import Rhino
import scriptcontext

viewport = scriptcontext.doc.Views.ActiveView.ActiveViewport

viewport.SetCameraDirection(view_vector, True)
viewport.SetCameraTarget(center_point, True)
plane = viewport.GetCameraFrame()[1]

#plane = Rhino.Geometry.Plane(center_point, view_vector)

bbox = geometry.GetBoundingBox(plane)
a = [bbox, plane]
# ---------- end python_3 ----------
vdis = VectorDisplay(Anchor=pcen, Vector=amp_3)
f_x_7 = F1(Function="ceiling(x*3^0.5) * 1.1", X=f_x_6)
f_x_8 = F1(Function="x*1.2", X=f_x_5)
dispatch_2 = Dispatch(List=python_3.a, DispatchPattern=[True, False])  # -> ListA, ListB
python_4 = PythonScript(GhMemory=0)  # -> out, a; inputs siteID: String; disabled
# ---------- python_4: Python ----------
from scriptcontext import doc

import shelve
db = shelve.open('/amigos/viewdb')


data = {}
vp = doc.Views.ActiveView.ActiveViewport
data['camera'] = vp.CameraLocation #point3d
data['target'] = vp.CameraTarget #point3d
data['lenslength'] = vp.Camera35mmLensLength #double
data['bounds'] = vp.ScreenPortBounds #Rectangle

print '\n'.join(['%s: %s' % (k, data[k]) for k in data])
db[str(siteID)] = data

db.close()
# ---------- end python_4 ----------
xy_4 = XYPlane(Origin=Point(0, 0, 0))
pln = Plane(dispatch_2.ListB)
box_2 = Box(dispatch_2.ListA)
panel_8 = Panel(python_4.out)
sqgrid = Square(Plane=bang_2.Branch0, Size=distance_between_grid_points, ExtentX=bang_3.Branch0, ExtentY=bang_4.Branch0)  # -> Cells, Points
sqgrid_2 = Square(Plane=bang_2.Branch1, Size=distance_between_grid_points, ExtentX=bang_3.Branch1, ExtentY=bang_4.Branch1)  # -> Cells, Points
trigrid = Triangular(Plane=bang_2.Branch2, Size=distance_between_grid_points, ExtentX=f_x_7, ExtentY=f_x_8)  # -> Cells, Points
orient = Orient(Geometry=box_2, Initial=xy_4, Final=pln)  # -> Geometry, Transform
panel_9 = Panel("""0
1
2""")
panel_10 = Panel(python_3.a)
explode = Explode(Curve=trigrid.Cells, Recursive=True)  # -> Segments, Vertices
cset = CreateSet(List=flatten(sqgrid.Points))
cset_2 = CreateSet(List=flatten(sqgrid_2.Points))
explode_2 = BrepComponents(Brep=orient.Geometry)  # -> Faces, Edges, Vertices
cset_3 = CreateSet(List=flatten(explode.Vertices))
bang_5 = ExplodeTree(Tree=graft(panel_9))  # -> Branch1, Branch2, Branch3
join = BrepJoin(Breps=explode_2.Faces)  # -> Breps, Closed
flat_site_outline = Curve(project_2.Geometry)
flatten_2 = FlattenTree(Data=cset, Path=bang_5.Branch3)
flatten_3 = FlattenTree(Data=cset_2, Path=bang_5.Branch2)
flatten_4 = FlattenTree(Data=cset_3, Path=bang_5.Branch1)
m3 = Merge03(StreamA=flatten_4, StreamB=flatten_3, StreamC=flatten_2)
con = Containment(Point=m3, Curve=flat_site_outline)  # -> Relationship, Point
f_x_9 = F1(Function="x<2", X=con.Relationship)
dispatch_3 = Dispatch(List=m3, DispatchPattern=f_x_9)  # -> ListA, ListB
mesh = MeshBrep(
    Brep=dispatch.ListB,
    Settings={Refine=True, JaggedSeams=False, SimplePlanes=True, GridMinCount=16, GridMaxCount=0, Tolerance=0, RefineAngle=0, MinTolerance=0, RelativeTolerance=0.65, MinEdgeLength=0.0001, MaxEdgeLength=0})
Z_3 = UnitZ(Factor=1)
xy_5 = XYPlane(Origin=Point(0, 0, 0))
project_3 = Project(Geometry=flatten, Plane=xy_5)  # -> Geometry, Transform
con_2 = Containment(Point=project_3.Geometry, Curve=project.Geometry)  # -> Relationship, Point
site_outline_2 = Curve(crv)
meshray = MeshRay(Mesh=flatten(mesh), Point=dispatch_3.ListA, Direction=Z_3)  # -> Point, Hit
crv_cp = CurveCP(Point=project_3.Geometry, Curve=site_outline_2)  # -> Point, Parameter, Distance
billboard_points = Point(flatten)
f_x_10 = F1(Function="x<2", X=con_2.Relationship)
f_x_y = F2(Function="x<y", X=crv_cp.Distance, Y=Slider(0.5, range=0..1))
or = GateOr(A=f_x_10, B=f_x_y)
grids_at_elevation = Point(meshray.Point)
dispatch_4 = Dispatch(List=billboard_points, DispatchPattern=or)  # -> ListA, ListB
billboard_radius = Slider(1.5, range=0.5..10)
clean = CleanTree(Data=grids_at_elevation, CleanInvalid=True, CleanEmpty=False)
area = BrepArea(Brep=crv)  # -> Area, Centroid
points_for_canopies = Point(dispatch_4.ListA)
rough_site_area = Number(area.Area)
max_canopy_radius = Slider(36, range=0..100)
cir = Circle(Plane=points_for_canopies, Radius=billboard_radius)
bang_6 = ExplodeTree(Tree=clean)  # -> Branch1, Branch2, Branch3
hardscape_grid = Point(bang_6.Branch1)
sqrt = SquareRoot(Input=rough_site_area)
multiplication_2 = Multiplication(A=sqrt, B=Slider(0.338, range=0..1))
min = Minimum(A=multiplication_2, B=max_canopy_radius)
vec2pt = Vector2Pt(PointA=cir, PointB=hardscape_grid, Unitize=False)  # -> Vector, Length
sort = SortList(Keys=vec2pt.Length, ValuesA=hardscape_grid)  # -> List, ValuesA
f_x_y_2 = F2(Function="x<y", X=vec2pt.Length, Y=min)
panel_11 = Panel("x<y")
dispatch_5 = Dispatch(List=hardscape_grid, DispatchPattern=f_x_y_2)  # -> ListA, ListB
split = SplitList(List=sort.ValuesA, Index=3)  # -> ListA, ListB
num = Number("3.0")
lng = ListLength(List=dispatch_5.ListA)
num_2 = Number(lng)
f_x_y_3 = F2(Function="x<y", X=num_2, Y=num)
f_x_y_4 = F2(Function="0<x", X=num_2)
and = GateAnd(A=f_x_y_3, B=f_x_y_4)
weave = Weave(Pattern=and, Stream0=dispatch_5.ListA, Stream1=split.ListA, NullGaps=False)
crv_cp_2 = CurveCP(Point=weave, Curve=cir)  # -> Point, Parameter, Distance
python_5 = PythonScript(points=crv_cp_2.Point, tolerance=Slider(1, range=0..1), GhMemory=0)  # -> out, a; inputs points: list of Point3d, tolerance: Double
# ---------- python_5: Python ----------
import Rhino

a = Rhino.Geometry.Point3d.CullDuplicates( points, tolerance )
# ---------- end python_5 ----------
crv_cp_3 = CurveCP(Point=python_5.a, Curve=cir)  # -> Point, Parameter, Distance
canopy_max = Slider(5, range=0..10)  # disabled
canopy_min = Slider(2.3, range=0..10)  # disabled
lng_2 = ListLength(List=weave)  # disabled
random_seed = Slider(256, range=0..1000)  # disabled
sort_2 = SortList(Keys=crv_cp_3.Parameter, ValuesA=crv_cp_3.Point)  # -> List, ValuesA; disabled
dom = Domain(DomainStart=canopy_min, DomainEnd=canopy_max)  # disabled
f_x_11 = F1(Function="ceiling(x)", X=lng_2)  # disabled
dup = DuplicateData(Data=[canopy_min, canopy_max], Number=f_x_11, Order=True)  # disabled
lng_3 = ListLength(List=sort_2.ValuesA)  # disabled
split_2 = SplitList(List=dup, Index=lng_3)  # -> ListA, ListB; disabled
pt = Point(weave)
Z_4 = UnitZ(Factor=split_2.ListA)  # disabled
random = Random(Range=dom, Number=lng_2, Seed=random_seed, Integers=False)  # disabled
move_2 = Move(Geometry=sort_2.ValuesA, Translation=Z_4)  # -> Geometry, Transform; disabled
Z_5 = UnitZ(Factor=random)  # disabled
slider_2 = Slider(0.05, range=0..0.1)  # disabled
slider_3 = Slider(0.5, range=-1..1)  # disabled
move_3 = Move(Geometry=weave, Translation=Z_5)  # -> Geometry, Transform; disabled
addition_2 = Addition(A=random, B=slider_3)  # disabled
weave_2 = Weave(Pattern=[0, 1], Stream0=flatten(move_3.Geometry), Stream1=flatten(move_2.Geometry), NullGaps=False)  # disabled
xy_6 = XYPlane(Origin=Point(0, 0, 0))  # disabled
division_4 = Division(A=addition_2, B=2)  # disabled
geo = Geometry(bang.Branch5)
str = String(geo)
cset_4 = CreateSet(List=weave_2)  # disabled
box_3 = CenterBox(Base=pt, X=slider_2, Y=slider_2, Z=division_4)  # disabled
slider_4 = Slider(0.184, range=0..1)  # disabled
slider_5 = Slider(0.1, range=0..0.1)  # disabled
Z_6 = UnitZ(Factor=slider_3)  # disabled
Z_7 = UnitZ(Factor=division_4)  # disabled
f_x_y_5 = F2(Function="x=y", X=str, Y="Closed Brep")
box_4 = CenterBox(Base=pt, X=slider_5, Y=slider_5, Z=slider_4)  # disabled
move_4 = Move(Geometry=box_3, Translation=Z_7)  # -> Geometry, Transform; disabled
move_5 = Move(Geometry=move_3.Geometry, Translation=Z_6)  # -> Geometry, Transform; disabled
del = DelaunayMesh(Points=cset_4, Plane=xy_6)  # disabled
dispatch_6 = Dispatch(List=geo, DispatchPattern=f_x_y_5)  # -> ListA, ListB
con_3 = DelaunayEdges(Points=move_3.Geometry, Plane=xy_6)  # -> Connectivity, Edges; disabled
mcomp = Decompose(Mesh=del)  # -> Vertices, Faces, Colours, Normals; disabled
item_2 = ListItem(List=move_3.Geometry, Index=con_3.Connectivity, Wrap=False)  # disabled
str_2 = String(mcomp.Faces)  # disabled
python_6 = PythonScript(x=str_2, GhMemory=0)  # -> out, a; disabled
# ---------- python_6: Python ----------
a = x[2:(len(str(x))-1)]
# ---------- end python_6 ----------
mesh_2 = MeshBrep(
    Brep=flatten([move_4.Geometry, box_4]),
    Settings={Refine=True, JaggedSeams=False, SimplePlanes=True, GridMinCount=16, GridMaxCount=0, Tolerance=0, RefineAngle=0, MinTolerance=0, RelativeTolerance=0.65, MinEdgeLength=0.0001, MaxEdgeLength=0})  # disabled
panel_12 = Panel(dispatch_6.ListB)
panel_13 = Panel(python_6.a)  # disabled
panel_14 = Panel(";")  # disabled
split_3 = StringSplit(String=panel_13, Separators=panel_14)  # disabled
wbedges = MeshEdges(Mesh=del)  # disabled
ln = Line(PointA=graft(move_5.Geometry), PointB=item_2)  # disabled
weave_3 = Weave(Pattern=[0, 1], Stream0=mesh_2, Stream1=flatten(del), NullGaps=False)  # disabled
ln_2 = Line(PointA=pt, PointB=move_5.Geometry)  # disabled
item_3 = ListItem(List=mcomp.Vertices, Index=split_3, Wrap=False)  # disabled
flip = FlipMatrix(Data=item_3)  # disabled
bang_7 = ExplodeTree(Tree=flip)  # -> Branch1, Branch2, Branch3; disabled
srf4pt = _4PointSurface(CornerA=bang_7.Branch1, CornerB=bang_7.Branch2, CornerC=bang_7.Branch3)  # disabled
join_2 = BrepJoin(Breps=srf4pt)  # -> Breps, Closed; disabled
str_3 = String(item)
panel_15 = Panel("""canopymeshes
canopylines
canopybreps
billboards
canopygrid""")
curves = Curve(flatten([ln, ln_2, wbedges]))
billboards = Brep(dispatch_6.ListA)  # disabled
breps = Brep(flatten([move_4.Geometry, box_4, join_2.Breps]))
meshes = Mesh(weave_3)
concat_4 = Concatenate(Start="/amigos/db/", End=str_3)
canopy_points = Point(pt)
concat_5 = Concatenate(Start=concat_4, End=panel_15)
bang_8 = ExplodeTree(Tree=graft(concat_5))  # -> Branch1, Branch2, Branch3, Branch4, Branch5
toggle = BooleanToggle(False)
python_7 = PythonScript(data=canopy_points, path=bang_8.Branch5, write=Toggle(False), GhMemory=0)  # -> out, a; inputs data: list
# ---------- python_7: Python ----------
import cPickle as pickle

if path and data and write:
    f = open(path, 'wb')
    pickle.dump(data, f)
    f.close()
# ---------- end python_7 ----------
python_8 = PythonScript(data=meshes, path=bang_8.Branch1, write=toggle, GhMemory=0)  # -> out, a; inputs data: list; disabled; same code as python_7
python_9 = PythonScript(data=breps, path=bang_8.Branch3, write=toggle, GhMemory=0)  # -> out, a; inputs data: list; disabled; same code as python_7
python_10 = PythonScript(data=curves, path=bang_8.Branch2, write=toggle, GhMemory=0)  # -> out, a; inputs data: list; disabled; same code as python_7
python_11 = PythonScript(data=billboards, path=bang_8.Branch4, write=toggle, GhMemory=0)  # -> out, a; inputs data: list; disabled; same code as python_7
