# Grasshopper definition classification_zones.ghx (Grasshopper 0.8.10)

path = FilePath("C:\Users\demonchaux\Dropbox\localcode\site_ids.txt")
file = ReadFile(Path=path, Lines=True)
item = ListItem(List=file, Index=Slider(11, range=0..49), Wrap=False)
panel = Panel("""-grid
-terrain
-borders
-transportation
-billboards""")
concat = Concatenate(Start="C:\amigos\dump\", End=item)
panel_2 = Panel("""green
wild
hard""")
panel_3 = Panel("""-z
-base
-axes""")
concat_2 = Concatenate(Start=concat, End=panel)
panel_4 = Panel(file)
panel_5 = Panel("""groundsurface
site-projected
parcel-projected""")
concat_3 = Concatenate(Start=concat_2, End=".3dm")
concat_4 = Concatenate(Start=panel_2, End=panel_3, DataComparison="cross_reference")
panel_6 = Panel(concat_4)
panel_7 = Panel(concat_3)
merge = Merge(StreamA=panel_5, StreamB=panel_6)
merge_2 = Merge(StreamA=merge, StreamB="billboards")
python = PythonScript(FilePaths=concat_3, LayerNames=merge_2, DoImport=Toggle(True), GhMemory=0)  # -> out, layerTree, availableLayers; inputs FilePaths: list, LayerNames: list
# ---------- python: Python ----------
import Rhino


# for accesssing GH classes
import clr
clr.AddReference("Grasshopper")
from Grasshopper.Kernel.Data import GH_Path
from Grasshopper import DataTree


# read geometry out of 3dm files and filter by layernames
if DoImport and FilePaths and LayerNames:
    
    layerTree = DataTree[Rhino.Geometry.GeometryBase]() # make a DataTree
    availableLayers = []
    for filepath in FilePaths:
        model = Rhino.FileIO.File3dm.Read(filepath)
        for lay in model.Layers:
            availableLayers.append(lay.Name)
        if not model: continue
        for i, layer in enumerate(LayerNames):
            path = GH_Path(i)
            geometry = []
            objs = model.Objects.FindByLayer(layer)
            for obj in objs:
                geom = obj.Geometry
                geom.EnsurePrivateCopy()
                geometry.append(geom)
            layerTree.AddRange(geometry, path)
        
        # models can take up a considerable amount of
        # memory that we don't need, so get rid of it
        # after copying the geometry we want out of it
        model.Dispose()
# ---------- end python ----------
panel_8 = Panel(merge_2)
bang = ExplodeTree(Tree=python.layerTree)  # -> Branch0, Branch1, Branch2, Branch3, Branch4, Branch5, Branch6, Branch7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
viewer = ParamViewer(python.layerTree)
parcels = Curve(bang.Branch2)
panel_9 = Panel(python.out)
slider = Slider(3, range=0..10)
panel_10 = Panel(python.layerTree)
site_outline = Curve(bang.Branch1)
srfsplit = SurfaceSplit(Surface=bang.Branch0, Curves=site_outline)
dispatch = Dispatch(List=srfsplit, DispatchPattern=[True, False])  # -> ListA, ListB

# ---- group: Access Edges
explode = Explode(Curve=bang.Branch2, Recursive=True)  # -> Segments, Vertices
explode_2 = Explode(Curve=bang.Branch1, Recursive=True)  # -> Segments, Vertices
cset = CreateSet(List=flatten(explode_2.Vertices))
cset_2 = CreateSet(List=explode.Vertices)
mindex = MemberIndex(Set=cset_2, Member=cset)  # -> Index, Count
path_mapper = PathMapper(mindex.Index, source="{a;b;c;d}", target="{a;b}")
clean = CleanTree(Data=path_mapper, CleanInvalid=True, CleanEmpty=True)
lng = ListLength(List=clean)
viewer_2 = ParamViewer(clean)
sort = SortList(Keys=flatten(lng), ValuesA=viewer_2)  # -> List, ValuesA
rev = ReverseList(List=sort.ValuesA)
str = String(viewer_2)
item_2 = ListItem(List=rev, Index=0, Wrap=False)
cset_3 = CreateSet(List=str)
str_2 = String(item_2)
cset_4 = CreateSet(List=str_2)
difference = SetDifference(SetA=cset_3, SetB=cset_4)
branch = TreeBranch(Tree=explode.Segments, Path=difference)
cp = ControlPoints(Curve=branch)  # -> Points, Weights, Knots
cp_2 = ControlPoints(Curve=explode_2.Segments)  # -> Points, Weights, Knots
python_2 = PythonScript(x=cp_2.Points, y=cp.Points, tol=Slider(0.025, range=0..0.5), GhMemory=0)  # -> out, a; inputs x: tree, y: tree
# ---------- python_2: Python ----------
import Rhino
segmentSet = range(x.BranchCount)
out = []
for i in range(y.BranchCount):
    commonSegs = []
    thisSeg = list(y.Branch(i))
    for j in range(x.BranchCount):
        # now we have both segments
        trues = 0
        otherSeg = list(x.Branch(j))
        for otherPoint in otherSeg:
            for thisPoint in thisSeg:
                if otherPoint.DistanceTo(thisPoint) < tol:
                    trues += 1
        if trues == len(thisSeg) and j in segmentSet:
            segmentSet.remove(j)
        
a = segmentSet
# ---------- end python_2 ----------
item_3 = ListItem(List=explode_2.Segments, Index=python_2.a, Wrap=False)

# ----
billboards = Geometry(bang.Branch12)
sitesurface = Surface(dispatch.ListB)

# ---- group: Pill Benches
pt = Point(bang.Branch7)
lng_2 = ListLength(List=pt)
subtraction = Subtraction(A=lng_2, B=1)
random = Random(Range=subtraction, Number=Slider(10, range=0..10), Seed=Slider(489, range=0..1000), Integers=False)
pi = Pi(Factor=1)
item_4 = ListItem(List=bang.Branch4, Index=random, Wrap=False)
item_5 = ListItem(List=pt, Index=random, Wrap=False)
panel_11 = Panel("1")
pcomp = Decompose(Point=item_4)  # -> XComponent, YComponent, ZComponent
division = Division(A=Slider(3, range=0..10), B=pi)
X = UnitX(Factor=Slider(9, range=0..10))
Z = UnitZ(Factor=pcomp.ZComponent)
xy = XYPlane(Origin=item_5)
Z_2 = UnitZ(Factor=1)
vrot = Rotate(Vector=X, Axis=Z_2, Angle=division)
align = AlignPlane(Plane=xy, Direction=vrot)  # -> Plane, Angle
lng_3 = ListLength(List=align.Plane)
panel_12 = Panel("""1
4""")
random_2 = Random(Range=Domain(0, 1), Number=lng_3, Seed=Slider(479, range=0..1000), Integers=True)
slider_2 = Slider(1, range=0..10)
not = GateNot(A=random_2)
weave = Weave(Pattern=[0, 1], Stream0=graft(random_2), Stream1=graft(not), NullGaps=False)
multiplication = Multiplication(A=panel_12, B=slider_2)
item_6 = ListItem(List=multiplication, Index=weave, Wrap=False)
dispatch_2 = Dispatch(List=item_6, DispatchPattern=[True, False])  # -> ListA, ListB
rectangle = Rectangle(Plane=graft(align.Plane), XSize=dispatch_2.ListA, YSize=dispatch_2.ListB, Radius=slider_2)  # -> Rec, Length
move = Move(Geometry=rectangle.Rec, Translation=graft(Z))  # -> Geometry, Transform
Z_3 = UnitZ(Factor=Slider(0.5, range=0..1))
extr = Extrude(Base=move.Geometry, Direction=Z_3)
cap = CapHoles(Brep=extr)

# ----
concat_5 = Concatenate(Start=concat, End="-grid")
concat_6 = Concatenate(Start=concat_5, End=".3dm")
panel_13 = Panel(concat_6)

# ---- group: Should it have a throoughfare? / If there is more than one?
join = JoinCurves(Curves=item_3, Preserve=False)
lng_4 = ListLength(List=join)
larger = LargerThan(FirstNumber=lng_4, SecondNumber="1")  # -> LargerThan, OrEqualTo

# ---- group: Should it have a throoughfare? / Does it wrap a corner?
panel_14 = Panel("""0
1""")
item_7 = ListItem(List=join, Index=0, Wrap=False)
eval = EvaluateCurve(Curve=reparameterize(item_7), Parameter=panel_14)  # -> Point, Tangent, Length
dispatch_3 = Dispatch(List=eval.Tangent, DispatchPattern=[True, False])  # -> ListA, ListB
angle = Angle(VectorA=dispatch_3.ListA, VectorB=dispatch_3.ListB)  # -> Angle, Reflex
pi_2 = Pi(Factor=Slider(0.3, range=0..1))
min = Minimum(A=angle.Angle, B=angle.Reflex)
f_x_y = F2(Function="abs(x)>y", X=min, Y=pi_2)

# ---- group: Dot Matrix Layer 1 / Site Area
area = BrepArea(Brep=dispatch.ListB)  # -> Area, Centroid

# ---- group: Should it have a throoughfare?
or = GateOr(A=larger.LargerThan, B=f_x_y)

# ---- group: Large Radius Benches
step_height = Slider(0.5, range=0..1)
steps = Slider(3, range=0..10)
step_depth = Slider(1, range=0..1)
addition = Addition(A=steps, B=1)
series = Series(Start=0, Step=1, Count=addition)
multiplication_2 = Multiplication(A=step_height, B=steps)
multiplication_3 = Multiplication(A=step_depth, B=steps)
weave_2 = Weave(Pattern=[0, 1], Stream0=series, Stream1=series, NullGaps=False)
range = Range(Domain=multiplication_3, Steps=steps)
range_2 = Range(Domain=multiplication_2, Steps=steps)
panel_15 = Panel("""0
0
0
2
1
2
1
0""")
shift = ShiftList(List=weave_2, Shift=1, Wrap=True)
weave_3 = Weave(Pattern=[0, 1], Stream0="0.0", Stream1=[steps, step_height], NullGaps=False)
item_8 = ListItem(List=range, Index=weave_2, Wrap=False)
item_9 = ListItem(List=range_2, Index=shift, Wrap=False)
rev_2 = ReverseList(List=item_9)
item_10 = ListItem(List=weave_3, Index=panel_15, Wrap=False)
weave_4 = Weave(Pattern=[0, 1], Stream0=graft(item_8), Stream1=graft(rev_2), NullGaps=False)
dispatch_4 = Dispatch(List=item_10, DispatchPattern=[True, False])  # -> ListA, ListB
dispatch_5 = Dispatch(List=weave_4, DispatchPattern=[True, False])  # -> ListA, ListB
pt_2 = PointXYZ(XComponent=dispatch_4.ListA, YComponent=dispatch_4.ListB, ZComponent=0)
pt_3 = PointXYZ(XComponent=dispatch_5.ListA, YComponent=dispatch_5.ListB, ZComponent=0)
pline = PolyLine(Vertices=flatten(pt_2), Closed=True)
pline_2 = PolyLine(Vertices=flatten(pt_3), Closed=True)
weave_5 = Weave(Pattern=[0, 1], Stream0=pline_2, Stream1=pline, NullGaps=False)

slider_3 = Slider(317, range=0..400)
pt_4 = Point(bang.Branch4)
pcomp_2 = Decompose(Point=pt_4)  # -> XComponent, YComponent, ZComponent
lng_5 = ListLength(List=pt_4)
division_2 = Division(A=lng_5, B=slider_3)
pt_5 = PointXYZ(XComponent=pcomp_2.XComponent, YComponent=pcomp_2.YComponent, ZComponent=0)
toggle = BooleanToggle(True)
dom = Domain(DomainStart="1", DomainEnd=division_2)
random_3 = Random(Range=dom, Number=1, Seed=slider_3, Integers=toggle)
multiplication_4 = Multiplication(A=lng_5, B=slider_3)
subtraction_2 = Subtraction(A=lng_5, B=1)
random_4 = Random(Range=subtraction_2, Number=division_2, Seed=multiplication_4, Integers=toggle)
item_11 = ListItem(List=pt_5, Index=random_4, Wrap=False)
lng_6 = ListLength(List=item_11)
subtraction_3 = Subtraction(A=lng_6, B=1)
max = Maximum(A=subtraction_3, B="1")
range_3 = Range(Domain=Domain(0, 1), Steps=max)
graph = GraphMapper(
    range_3,
    x0=0,
    x1=1,
    y0=0,
    y1=1,
    container_name="Bezier",
    cpx=[0, 0.5971025229, 0.7987467647, 1],
    cpy=[0.01402924024, 0.269564867, 0.3227132261, 1])
dom_2 = Domain(DomainStart=Slider(0.5, range=0..1), DomainEnd=Slider(20, range=0..100))
remap = RemapNumbers(Values=graph, Source=Domain(0, 1), Target=dom_2)
cir = Circle(Plane=item_11, Radius=remap)
xy_2 = XYPlane(Origin=Point(0, 0, 0))
runion = RegionUnion(Curves=cir, Plane=xy_2)
len = Length(Curve=runion)
multiplication_5 = Multiplication(A=len, B=Slider(0.2, range=0..1))
Z_4 = UnitZ(Factor=1)
fillet = FilletDistance(Curve=runion, Distance=multiplication_5)
project = Project(Curve=fillet, Brep=dispatch.ListB, Direction=Z_4)
slider_4 = Slider(0.873, range=0..1)
lng_7 = ListLength(List=flatten(project))
dom_3 = Domain(DomainStart=Slider(0.316, range=0..1), DomainEnd=slider_4)
f_x = F1(Function="1-x", X=slider_4)
len_2 = Length(Curve=flatten(project))
random_5 = Random(Range=f_x, Number=lng_7, Seed=2, Integers=False)
random_6 = Random(Range=dom_3, Number=lng_7, Seed=slider_3, Integers=False)
multiplication_6 = Multiplication(A=Slider(-0.11, range=-0.5..0), B=len_2)
panel_16 = Panel("""1
4""")
addition_2 = Addition(A=random_5, B=random_6)
ext = Extend(Curve=flatten(project), Type="1", Start=multiplication_6, End=multiplication_6)
dom_4 = Domain(DomainStart=random_5, DomainEnd=addition_2)
dispatch_6 = Dispatch(List=panel_16, DispatchPattern=[True, False])  # -> ListA, ListB
subcrv = SubCurve(BaseCurve=reparameterize(flatten(ext)), Domain=dom_4)
dom_5 = Domain(DomainStart=dispatch_6.ListA, DomainEnd=dispatch_6.ListB)
random_7 = Random(Range=dom_5, Number=lng_7, Seed=dispatch_6.ListB, Integers=Toggle(True))
panel_17 = Panel("""0
1""")
pframe = PerpFrame(Curve=reparameterize(graft(subcrv)), Parameter=panel_17)
Z_5 = UnitZ(Factor=1)
align_2 = AlignPlane(Plane=pframe, Direction=Z_5)  # -> Plane, Angle
random_8 = Random(Range=Domain(0, 1), Number=lng_7, Seed=2, Integers=Toggle(True))
pcomp_3 = PlaneComponents(Plane=align_2.Plane)  # -> Origin, XAxis, YAxis, ZAxis
panel_18 = Panel("""0
1""")
pl = Plane(Origin=pcomp_3.Origin, XAxis=pcomp_3.YAxis, YAxis=pcomp_3.XAxis)
jitter = Jitter(List=panel_18, Jitter=random_8, Seed=2)  # -> Range, Indices
dispatch_7 = Dispatch(List=pl, DispatchPattern=[True, False])  # -> ListA, ListB
item_12 = ListItem(List=weave_5, Index=jitter.Range, Wrap=False)
xy_3 = XYPlane(Origin=Point(0, 0, 0))
dispatch_8 = Dispatch(List=item_12, DispatchPattern=[True, False])  # -> ListA, ListB
orient = Orient(Geometry=dispatch_8.ListB, Initial=xy_3, Final=dispatch_7.ListB)  # -> Geometry, Transform
orient_2 = Orient(Geometry=dispatch_8.ListA, Initial=xy_3, Final=dispatch_7.ListA)  # -> Geometry, Transform
weave_6 = Weave(Pattern=[0, 1], Stream0=orient_2.Geometry, Stream1=orient.Geometry, NullGaps=False)
swp1 = Sweep1(Rail=graft(subcrv), Sections=weave_6, Trim=True)
cap_2 = CapHoles(Brep=swp1)

# ----
dispatch_9 = Dispatch(DispatchPattern=[True, False])  # -> ListA, ListB
Z_6 = UnitZ(Factor=1)
line = LineSDL(Start=dispatch_9.ListA, Direction=Z_6, Length=1)
scx = SurfaceLine(Line=line, Limit=True)  # -> Curves, Points, UVPoints, Normal
wild = Slider(0.146, range=0..1)
hard = Slider(0.542, range=0..1)
z = Slider(0.325, range=0..1)
base = Slider(0.325, range=0..1)
axes = Slider(0.863, range=0..1)
green = Slider(0.25, range=0..1)
ln = Line(PointA=dispatch_9.ListA, PointB=scx.Points)
num = Number([green, wild, hard])
num_2 = Number([z, base, axes])
path_mapper_2 = PathMapper(dispatch_9.ListA, source="{a;b}", target="{1;a;b}")
path_mapper_3 = PathMapper(scx.Points, source="{a;b}", target="{0;a;b}")
path_mapper_4 = PathMapper(ln, source="{a;b}", target="{2;a;b}")
hsl = ColourHSL(Alpha=1, Hue=num, Saturation=1, Luminance=num_2, DataComparison="cross_reference")
m3 = Merge03(StreamA=path_mapper_3, StreamB=path_mapper_2, StreamC=path_mapper_4)
preview = CustomPreview(Geometry=m3, Shader=graft(hsl))
viewer_3 = ParamViewer(m3)
python_3 = PythonScript(FilePath=panel_13, LayerNames=concat_4, LayerColors=hsl, GeometryTree=m3, DoExport=Toggle(False), GhMemory=10)  # -> out, a; inputs FilePath: String, LayerNames: list of String, LayerColors: list of Color, GeometryTree: tree of GeometryBase, DoExport: Boolean
# ---------- python_3: Python ----------
import System
import System.Collections.Generic as SCG
import Rhino
import scriptcontext

import rhinoscriptsyntax as rs
from Rhino.FileIO import FileWriteOptions, FileReadOptions

def addRhinoLayer(layerName, layerColor=System.Drawing.Color.Black):
    """Creates a Layer in Rhino using a name and optional color. Returns the
    index of the layer requested. If the layer
    already exists, the color is updated and no new layer is created."""
    docLyrs = scriptcontext.doc.Layers
    layerIndex = docLyrs.Find(layerName, True)
    if layerIndex == -1:
        layerIndex = docLyrs.Add(layerName,layerColor)
    else: # it exists
        layer = docLyrs[layerIndex] # so get it
        if layer.Color != layerColor: # if it has a different color
            layer.Color = layerColor # reset the color
    return layerIndex

def layerAttributes(layerName, layerColor=System.Drawing.Color.Black):
    """Returns a Rhino ObjectAttributes object for a rhino layer with an optional color."""
    att = Rhino.DocObjects.ObjectAttributes()
    att.LayerIndex = addRhinoLayer(layerName, layerColor)
    return att

def deleteLayer(layerName, quiet=True):
    """Deletes a layer by Name. returns nothing."""
    layer_index = scriptcontext.doc.Layers.Find(layerName, True)
    settings = Rhino.DocObjects.ObjectEnumeratorSettings()
    settings.LayerIndexFilter = layer_index
    objs = scriptcontext.doc.Objects.FindByFilter(settings)
    ids = [obj.Id for obj in objs]
    scriptcontext.doc.Objects.Delete(ids, quiet)
    scriptcontext.doc.Layers.Delete(layer_index, quiet)

def bakeMany(listOfThings, objectAttributes=None):
    if not objectAttributes:
        objectAttributes = Rhino.DocObjects.ObjectAttributes()
    for thing in listOfThings:
        # move from specific to broad
        if isinstance(thing, Rhino.Geometry.Point3d):
            scriptcontext.doc.Objects.AddPoint(thing, objectAttributes)
        elif isinstance(thing, Rhino.Geometry.Point):
            scriptcontext.doc.Objects.AddPoint(thing.Location, objectAttributes)
        elif isinstance(thing, Rhino.Geometry.Curve):
            scriptcontext.doc.Objects.AddCurve(thing, objectAttributes)
        elif isinstance(thing, Rhino.Geometry.Surface):
            scriptcontext.doc.Objects.AddSurface(thing, objectAttributes)
        elif isinstance(thing, Rhino.Geometry.Brep):
            scriptcontext.doc.Objects.AddBrep(thing, objectAttributes)
        elif isinstance(thing, Rhino.Geometry.Mesh):
            scriptcontext.doc.Objects.AddSurface(thing, objectAttributes)
        elif isinstance(thing, Rhino.Geometry.Hatch):
            scriptcontext.doc.Objects.AddHatch(thing, objectAttributes)
        elif isinstance(thing, Rhino.Display.Text3d):
            scriptcontext.doc.Objects.AddText(thing, objectAttributes)
        else:
            print '''Unrecognized object type: %s''' % type(thing)

def deleteAll():
    """Deletes everything in the current Rhino scriptcontext.doc. Returns nothing."""
    guidList = []
    objType = Rhino.DocObjects.ObjectType.AnyObject
    objTable = scriptcontext.doc.Objects
    objs = objTable.GetObjectList(objType)
    for obj in objs:
        guidList.append(obj.Id)
    for guid in guidList:
        objTable.Delete(guid, True)

def exportFile(filePath,
        version=4,
        geomOnly=False,
        selectedOnly=False,
        ):
    '''Export a file.'''
    opt = FileWriteOptions()
    opt.FileVersion = version
    opt.WriteGeometryOnly = geomOnly
    opt.WriteSelectedObjectsOnly = selectedOnly
    return scriptcontext.doc.WriteFile(filePath, opt)

def exportLayers(layerNames, filePath, version=4):
    '''Export only the items on designated layers to a file.'''
    # save selection
    oldSelection = rs.SelectedObjects()
    # clear selection
    rs.UnselectAllObjects()
    # add everything on the layers to selection
    for name in layerNames:
        objs = scriptcontext.doc.Objects.FindByLayer(name)
        guids = [obj.Id for obj in objs]
        scriptcontext.doc.Objects.Select.Overloads[SCG.IEnumerable[System.Guid]](guids)
    # export selected items
    exportFile(filePath, version, selectedOnly=True)
    #clear selection
    rs.UnselectAllObjects()
    # restore selection
    if oldSelection:
        scriptcontext.doc.Objects.Select.Overloads[SCG.IEnumerable[System.Guid]](oldSelection)
    print 'exported %s' % filePath

# main script

if FilePath and DoExport and GeometryTree and LayerNames:
    numBranches = GeometryTree.BranchCount
    if numBranches == len(LayerNames):
        for i in range(GeometryTree.BranchCount):
            layer = LayerNames[i]
            if LayerColors and i < len(LayerColors):
                color = LayerColors[i]
            else:
                color = System.Drawing.Color.Black
            att = layerAttributes(layer, color)
            branchData = GeometryTree.Branch(i)
            bakeMany( branchData, att )
        exportLayers( LayerNames, FilePath )
        for lay in LayerNames:
            deleteLayer(lay)
    else:
        print '''Please ensure that there is one data tree branch
per layer name.'''
else:
    if DoExport:
        print '''Something is missing. Please make sure you input
a valid file path, a data tree of geometry (one branch per
layer), a list of layer names (one per branch), and that
you have entered 'True' into the 'DoExport' input.'''
# ---------- end python_3 ----------
panel_19 = Panel(python_3.out)

# ---- group: Dot Matrix Layer 1
pt_6 = Point(bang.Branch3)
pcomp_4 = Decompose(Point=pt_6)  # -> XComponent, YComponent, ZComponent
bnd = Bounds(Numbers=pcomp_4.ZComponent)
remap_2 = RemapNumbers(Values=pcomp_4.ZComponent, Source=bnd, Target=Domain(0, 1))
domcomp = DomainComponents(Domain=bnd)  # -> Start, End
graph_2 = GraphMapper(
    remap_2,
    x0=0,
    x1=1,
    y0=0,
    y1=1,
    container_name="Bezier",
    cpx=[0, 0.1837020814, 0.734375, 1],
    cpy=[1, 0.1664048284, 0.2373188436, 0])
slider_5 = Slider(2, range=0..10)
sqrt = SquareRoot(Input=area.Area)
panel_20 = Panel("x/200")
pt_7 = PointXYZ(XComponent=pcomp_4.XComponent, YComponent=pcomp_4.YComponent, ZComponent=0)
xy_4 = XYPlane(Origin=Point(0, 0, 0))

# ---- group: Dot Matrix Layer 1 / Height Delta of Site
subtraction_4 = Subtraction(A=domcomp.End, B=domcomp.Start)

# ---- group: Dot Matrix Layer 1 (continued)
f_x_2 = F1(Function="x<0.3", X=subtraction_4)
multiplication_7 = Multiplication(A=subtraction_4, B=sqrt)
weave_7 = Weave(Pattern=f_x_2, Stream0=slider_5, Stream1=Slider(4.02, range=0..10), NullGaps=False)
max_2 = Maximum(A=slider_5, B=weave_7)
dom_6 = Domain(DomainStart=Slider(0, range=0..1), DomainEnd=max_2)
remap_3 = RemapNumbers(Values=graph_2, Source=Domain(0, 1), Target=dom_6)
smaller = SmallerThan(FirstNumber=remap_3, SecondNumber=Slider(0.417, range=0..1))  # -> SmallerThan, OrEqualTo
dispatch_10 = Dispatch(List=pt_7, DispatchPattern=smaller.OrEqualTo)  # -> ListA, ListB
dispatch_11 = Dispatch(List=remap_3, DispatchPattern=smaller.OrEqualTo)  # -> ListA, ListB
cir_2 = Circle(Plane=dispatch_10.ListB, Radius=dispatch_11.ListB)
runion_2 = RegionUnion(Curves=cir_2, Plane=xy_4)
len_3 = Length(Curve=runion_2)
division_3 = Division(A=len_3, B=Slider(0.877, range=0..1))
reb = Rebuild(Curve=runion_2, Degree="1", Count=division_3, Tangents=False)
fillet_2 = Fillet(Curve=reb, Radius=Slider(0.6, range=0..1))
planar = PlanarSrf(Edges=fillet_2)
eval_2 = EvaluateCurve(Curve=reparameterize(fillet_2), Parameter=Slider(0.5, range=0..1))  # -> Point, Tangent, Length
explode_3 = BrepComponents(Brep=planar)  # -> Faces, Edges, Vertices
item_13 = ListItem(List=explode_3.Vertices, Index=0, Wrap=False)
cp_3 = ClosestPoint(Point=item_13, Set=pt_7)  # -> ClosestPoint, CPIndex, Distance
item_14 = ListItem(List=pcomp_4.ZComponent, Index=flatten(cp_3.CPIndex), Wrap=False)
Z_7 = UnitZ(Factor=item_14)
move_2 = Move(Geometry=planar, Translation=Z_7)  # -> Geometry, Transform

# ---- group: Dot Matrix Layer 1 / Max Circle Size Factor
f_x_3 = F1(Function=panel_20, X=multiplication_7)

# ---- group: Thoroughfare Curves and Points
shatter = Shatter(Curve=reparameterize(item_7), Parameters="0.5")
int = Integer(larger.LargerThan)
lng_8 = ListLength(List=shatter)
weave_8 = Weave(Pattern=int, Stream0=shatter, Stream1=join, NullGaps=False)
eval_3 = EvaluateCurve(Curve=reparameterize(weave_8), Parameter="0.5")  # -> Point, Tangent, Length
xy_5 = XYPlane(Origin=Point(0, 0, 0))
reb_2 = Rebuild(Curve=site_outline, Degree=1, Count=10, Tangents=False)
pcen = PolygonCenter(Polyline=reb_2)
project_2 = Project(Geometry=pcen, Plane=xy_5)  # -> Geometry, Transform
pt_8 = Point(bang.Branch8)
slider_6 = Slider(1, range=0..10)

# ---- group: Thoroughfare Curves and Points / access points
pt_9 = Point(eval_3.Point)

# ---- group: Thoroughfare Curves and Points (continued)
project_3 = Project(Geometry=pt_9, Plane=xy_5)  # -> Geometry, Transform
dispatch_12 = Dispatch(List=project_3.Geometry, DispatchPattern=[True, False])  # -> ListA, ListB
avr = Average(Input=project_3.Geometry)
vec2pt = Vector2Pt(PointA=avr, PointB=project_2.Geometry, Unitize=False)  # -> Vector, Length
multiplication_8 = Multiplication(A=vec2pt.Length, B=Slider(0, range=0..1))
amp = Amplitude(Vector=vec2pt.Vector, Amplitude=multiplication_8)
move_3 = Move(Geometry=avr, Translation=amp)  # -> Geometry, Transform
ln_2 = Line(PointA=dispatch_12.ListA, PointB=dispatch_12.ListB)
divlength = DivideLength(Curve=ln_2, Length=Slider(2, range=0..10))  # -> Points, Tangents, Parameters
weave_9 = Weave(
    Pattern=[0, 1, 2],
    Stream0=flatten(dispatch_12.ListA),
    Stream1=flatten(move_3.Geometry),
    Stream2=flatten(dispatch_12.ListB),
    NullGaps=False)
intcrv = Interpolate(Vertices=weave_9, Degree=3, Periodic=False)  # -> Curve, Length, Domain
cp_4 = ClosestPoint(Point=graft(divlength.Points), Set=pt_8)  # -> ClosestPoint, CPIndex, Distance
crv_cp = CurveCP(Point=pt_8, Curve=intcrv.Curve)  # -> Point, Parameter, Distance
sort_2 = SortList(Keys=crv_cp.Parameter, ValuesA=crv_cp.Distance)  # -> List, ValuesA
sort_3 = SortList(Keys=crv_cp.Parameter, ValuesA=pt_8)  # -> List, ValuesA
f_x_y_2 = F2(Function="x>y", X=sort_2.ValuesA, Y=Slider(2, range=0..10))
dispatch_13 = Dispatch(List=sort_3.ValuesA, DispatchPattern=f_x_y_2)  # -> ListA, ListB
pt_10 = Point(dispatch_13.ListB)

# ---- group: Pathway Geometry
len_4 = Length(Curve=intcrv.Curve)
lng_9 = ListLength(List=flatten(pt_10))
division_4 = Division(A=len_4, B=Slider(9, range=0..100))
subtraction_5 = Subtraction(A=lng_9, B=1)
div = DivideDomain(Domain=subtraction_5, Count=division_4)
subset = SubList(List=flatten(pt_10), Interval=div, Cycle=False)  # -> List, Index
xy_6 = XYPlane(Origin=Point(0, 0, 0))
hull = ConvexHull(Points=subset.List, Plane=xy_6)  # -> Hull, HullZ, Indices
item_15 = ListItem(List=subset.List, Index=hull.Indices, Wrap=False)
pline_3 = PolyLine(Vertices=item_15, Closed=True)
offset = Offset(Curve=pline_3, Distance=slider_6, Plane=PlaneXY(0, 0, 0), Corners=2)
runion_3 = RegionUnion(Curves=flatten(offset))
divlength_2 = DivideLength(Curve=runion_3, Length="0.5")  # -> Points, Tangents, Parameters
pline_4 = PolyLine(Vertices=divlength_2.Points, Closed=True)
fillet_3 = Fillet(Curve=pline_4, Radius="0.5")
Z_8 = UnitZ(Factor=1)
project_4 = Project(Curve=fillet_3, Brep=bang.Branch0, Direction=Z_8)
crv = Curve(project_4)
srfsplit_2 = SurfaceSplit(Surface=bang.Branch0, Curves=crv)
dispatch_14 = Dispatch(List=srfsplit_2, DispatchPattern=[True, False])  # -> ListA, ListB
srf = Surface(dispatch_14.ListB)
