# Grasshopper definition cluster error.ghx (Grasshopper 0.8.11)

slider = Slider(0.25, range=0..1)
num = Number(slider)
str = String(num)
f_x_y = F2(Function="x=y", X=str, Y="NaN")
null = NullItem(Items=num)  # -> NullFlags, InvalidFlags
cluster = Cluster(
    Input1=slider,
    Pattern=cluster.Element,
    Stream0=cluster.Number,
    Stream1=cluster.Panel,
    List=cluster.Result,
    String=cluster.Number,
    Function=cluster.Panel,
    X=cluster.String,
    Y=cluster.Panel,
    Items=cluster.Number,
    A=cluster.Result,
    B=cluster.NullFlags,
    ClusterOutput=cluster.Weave,
    InternalDocument_plugin_version=(0, 8, 11),
    InternalDocument_DefinitionHeader_HandleRhinoEvents=True,
    InternalDocument_DefinitionHeader_HandleHopperEvents=True,
    InternalDocument_DefinitionHeader_PreviewNormal=RGBA(150, 0, 0, 100),
    InternalDocument_DefinitionHeader_PreviewSelected=RGBA(0, 120, 0, 100),
    InternalDocument_DefinitionProperties_Projection_Zoom=0.640000045,
    InternalDocument_DefinitionObjects_Object1_Container_NullGaps=False)
or = GateOr(A=f_x_y, B=null.NullFlags)
item = ListItem(List=or, Index=0, Wrap=False)
panel = Panel(cluster)
weave = Weave(Pattern=item, Stream0=num, Stream1="0.0", NullGaps=False)
panel_2 = Panel(weave)
