# Grasshopper definition conversion_sample.ghx (Grasshopper 0.8.10)

panel = Panel("""78
112""")
panel_2 = Panel("""-site
-terrain""")
item = ListItem(List=panel, Index=Slider(1, range=0..1), Wrap=False)
concat = Concatenate(Start="C:\amigos\sample\", End=item)
concat_2 = Concatenate(Start=concat, End=panel_2)
concat_3 = Concatenate(Start=concat_2, End=".3dm")
panel_3 = Panel("""gravitymains
lateraldrains""")
panel_4 = Panel(concat_3)
python = PythonScript(FilePaths=concat_3, LayerNames=panel_3, DoImport=Toggle(False), DoDelete=Toggle(True), GhMemory=10)  # -> out, a; inputs FilePaths: list of String, LayerNames: list of String, DoImport: Boolean, DoDelete: Boolean
# ---------- python: Python ----------
import Rhino
import scriptcontext

do_import = False
delete = False
fpaths = []
layernames = []
if FilePaths:
    for f in FilePaths:
        fpaths.append(f)
if LayerNames:
    for lyr in LayerNames:
        layernames.append(lyr)

# transfer values.
if DoImport:
    do_import = DoImport
    if DoDelete:
        delete = DoDelete
if do_import:
    opt = Rhino.FileIO.FileReadOptions()
    opt.ImportMode = True
    # if the delete is on:
    if delete:
        enumSettings = Rhino.DocObjects.ObjectEnumeratorSettings()
        enumSettings.VisibleFilter = True
        guids = [o.Id for o in scriptcontext.doc.Objects.FindByFilter(enumSettings)]
        scriptcontext.doc.Objects.Delete(guids, True)
        delete = False # set it to false
    # for each file:
    for fpath in fpaths:
        # import it
        scriptcontext.doc.ReadFile(fpath, opt)
    fpaths = []
    do_import = False
# get everything on the layers
layerTree = []
for layname in layernames:
    objs = scriptcontext.doc.Objects.FindByLayer(layname)
    guidString = ','.join([str(obj.Id) for obj in objs])
    layerTree.append(guidString)
a = layerTree
# ---------- end python ----------
split = StringSplit(String=python.a, Separators=",")
id = Guid(split)
viewer = ParamViewer(split)
geo = Geometry(id)
bang = ExplodeTree(Tree=geo)  # -> Branch0, Branch1, Branch2, Branch3, Branch4, Branch5, Branch6, Branch7
crv = Curve(bang.Branch0)
pt = Point(bang.Branch4)
crv_2 = Curve(bang.Branch1)
crv_3 = Curve(bang.Branch2)
crv_4 = Curve(bang.Branch3)
