# Grasshopper definition convexHullError.ghx (Grasshopper 0.8.10)

pt = Point([<point referenced from the Rhino model> x517])
lng = ListLength(List=flatten(pt))
division = Division(A="39", B=Slider(13, range=0..100))
subtraction = Subtraction(A=lng, B=1)
div = DivideDomain(Domain=subtraction, Count=division)
subset = SubList(List=flatten(pt), Interval=div, Cycle=False)  # -> List, Index
xy = XYPlane(Origin=Point(0, 0, 0))
del = DelaunayMesh(Points=subset.List, Plane=xy)
hull = ConvexHull(Points=subset.List, Plane=xy)  # -> Hull, HullZ, Indices
