# Grasshopper definition design_sketch_1.ghx (Grasshopper 0.8.11)

path = FilePath("C:\Users\demonchaux\Dropbox\localcode\site_ids.txt")
file = ReadFile(Path=path, Lines=True)
item = ListItem(List=file, Index=Slider(11, range=0..49), Wrap=False)
panel = Panel("""-site
-transportation""")
panel_2 = Panel("""-terrain
-borders
-billboards""")
concat = Concatenate(Start="C:\amigos\dump\", End=item)
concat_2 = Concatenate(Start=concat, End=panel_2)
panel_3 = Panel(file)
panel_4 = Panel("""freeways
metrobusstops-projected""")
concat_3 = Concatenate(Start=concat, End=panel)
panel_5 = Panel("""groundsurface
site-projected
parcel-projected""")
concat_4 = Concatenate(Start=concat_2, End=".3dm")
concat_5 = Concatenate(Start=concat_3, End=".3dm")
panel_6 = Panel(concat_5)
panel_7 = Panel(concat_4)
python = PythonScript(FilePaths=concat_5, LayerNames=panel_4, DoImport=Toggle(True), GhMemory=0)  # -> out, layerTree, availableLayers; inputs FilePaths: list, LayerNames: list
# ---------- python: Python ----------
import Rhino


# for accesssing GH classes
import clr
clr.AddReference("Grasshopper")
from Grasshopper.Kernel.Data import GH_Path
from Grasshopper import DataTree


# read geometry out of 3dm files and filter by layernames
if DoImport and FilePaths and LayerNames:
    
    layerTree = DataTree[Rhino.Geometry.GeometryBase]() # make a DataTree
    availableLayers = []
    for filepath in FilePaths:
        model = Rhino.FileIO.File3dm.Read(filepath)
        for lay in model.Layers:
            availableLayers.append(lay.Name)
        if not model: continue
        for i, layer in enumerate(LayerNames):
            path = GH_Path(i)
            geometry = []
            objs = model.Objects.FindByLayer(layer)
            for obj in objs:
                geom = obj.Geometry
                geom.EnsurePrivateCopy()
                geometry.append(geom)
            layerTree.AddRange(geometry, path)
        
        # models can take up a considerable amount of
        # memory that we don't need, so get rid of it
        # after copying the geometry we want out of it
        model.Dispose()
# ---------- end python ----------
merge = Merge(StreamA=panel_5, StreamB="billboards")
python_2 = PythonScript(FilePaths=concat_4, LayerNames=merge, DoImport=Toggle(True), GhMemory=0)  # -> out, layerTree, availableLayers; inputs FilePaths: list, LayerNames: list; same code as python
bang = ExplodeTree(Tree=python.layerTree)  # -> Branch1, Branch2, Branch3, Branch4, Branch5, Branch6, Branch7, Branch8, Branch9, Branch10
panel_8 = Panel(merge)
pt = Point(bang.Branch2)
bang_2 = ExplodeTree(Tree=python_2.layerTree)  # -> Branch0, Branch1, Branch2, Branch3, Branch4, Branch5, Branch6, Branch7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
panel_9 = Panel(python.availableLayers)
viewer = ParamViewer(python_2.layerTree)
parcels = Curve(bang_2.Branch2)
site_outline = Curve(bang_2.Branch1)
xy = XYPlane(Origin=Point(0, 0, 0))
billboards = Geometry(bang_2.Branch12)
project = Project(Geometry=site_outline, Plane=xy)  # -> Geometry, Transform
slider = Slider(3, range=0..10)
panel_10 = Panel(python_2.layerTree)
srfsplit = SurfaceSplit(Surface=bang_2.Branch0, Curves=site_outline)
dispatch = Dispatch(List=srfsplit, DispatchPattern=[True, False])  # -> ListA, ListB

# ---- group: Access Edges
explode = Explode(Curve=bang_2.Branch2, Recursive=True)  # -> Segments, Vertices
explode_2 = Explode(Curve=bang_2.Branch1, Recursive=True)  # -> Segments, Vertices
cset = CreateSet(List=flatten(explode_2.Vertices))
cset_2 = CreateSet(List=explode.Vertices)
mindex = MemberIndex(Set=cset_2, Member=cset)  # -> Index, Count
path_mapper = PathMapper(mindex.Index, source="{a;b;c;d}", target="{a;b}")
clean = CleanTree(Data=path_mapper, CleanInvalid=True, CleanEmpty=True)
lng = ListLength(List=clean)
viewer_2 = ParamViewer(clean)
sort = SortList(Keys=flatten(lng), ValuesA=viewer_2)  # -> List, ValuesA
rev = ReverseList(List=sort.ValuesA)
str = String(viewer_2)
item_2 = ListItem(List=rev, Index=0, Wrap=False)
cset_3 = CreateSet(List=str)
str_2 = String(item_2)
cset_4 = CreateSet(List=str_2)
difference = SetDifference(SetA=cset_3, SetB=cset_4)
branch = TreeBranch(Tree=explode.Segments, Path=difference)
cp = ControlPoints(Curve=branch)  # -> Points, Weights, Knots
cp_2 = ControlPoints(Curve=explode_2.Segments)  # -> Points, Weights, Knots
python_3 = PythonScript(x=cp_2.Points, y=cp.Points, tol=Slider(0.025, range=0..0.5), GhMemory=0)  # -> out, a; inputs x: tree, y: tree
# ---------- python_3: Python ----------
import Rhino
segmentSet = range(x.BranchCount)
out = []
for i in range(y.BranchCount):
    commonSegs = []
    thisSeg = list(y.Branch(i))
    for j in range(x.BranchCount):
        # now we have both segments
        trues = 0
        otherSeg = list(x.Branch(j))
        for otherPoint in otherSeg:
            for thisPoint in thisSeg:
                if otherPoint.DistanceTo(thisPoint) < tol:
                    trues += 1
        if trues == len(thisSeg) and j in segmentSet:
            segmentSet.remove(j)
        
a = segmentSet
# ---------- end python_3 ----------
item_3 = ListItem(List=explode_2.Segments, Index=python_3.a, Wrap=False)

# ----
panel_11 = Panel("""6
3
2""")
pi = Pi(Factor=1)
division = Division(A=pi, B=panel_11)
xy_2 = XYPlane(Origin=Point(0, 0, 0))
sitesurface = Surface(dispatch.ListB)
rotate = Rotate(Geometry=xy_2, Angle=division, Plane=xy_2)  # -> Geometry, Transform
bbox = BoundingBox(Content=site_outline, Union=True, Plane=rotate.Geometry)  # -> Box, Box_2
pcomp = PlaneComponents(Plane=rotate.Geometry)  # -> Origin, XAxis, YAxis, ZAxis
box = BoxComponents(Box=bbox.Box)  # -> Plane, X, Y, Z
slider_2 = Slider(3, range=0..10)
domcomp = DomainComponents(Domain=box.X)  # -> Start, End
domcomp_2 = DomainComponents(Domain=box.Y)  # -> Start, End
amp = Amplitude(Vector=pcomp.XAxis, Amplitude=domcomp.Start)
amp_2 = Amplitude(Vector=pcomp.YAxis, Amplitude=domcomp_2.Start)
division_2 = Division(A=domcomp.End, B=slider_2)
division_3 = Division(A=domcomp_2.End, B=slider_2)
addition = Addition(A=amp, B=amp_2)
f_x = F1(Function="ceiling(x)", X=division_2)
move = Move(Geometry=rotate.Geometry, Translation=addition)  # -> Geometry, Transform
f_x_2 = F1(Function="ceiling(x)", X=division_3)
f_x_3 = F1(Function="(x*2)+1", X=f_x)
f_x_4 = F1(Function="(x*2)+1", X=f_x_2)
bang_3 = ExplodeTree(Tree=graft(move.Geometry))  # -> Branch0, Branch1, Branch2
bang_4 = ExplodeTree(Tree=graft(f_x_4))  # -> Branch0, Branch1, Branch2
bang_5 = ExplodeTree(Tree=graft(f_x_3))  # -> Branch0, Branch1, Branch2

# ---- group: Pill Benches
pt_2 = Point(bang_2.Branch7)
lng_2 = ListLength(List=pt_2)
subtraction = Subtraction(A=lng_2, B=1)
random = Random(Range=subtraction, Number=Slider(10, range=0..10), Seed=Slider(489, range=0..1000), Integers=False)
pi_2 = Pi(Factor=1)
item_4 = ListItem(List=bang_2.Branch4, Index=random, Wrap=False)
item_5 = ListItem(List=pt_2, Index=random, Wrap=False)
panel_12 = Panel("1")
pcomp_2 = Decompose(Point=item_4)  # -> XComponent, YComponent, ZComponent
division_4 = Division(A=Slider(3, range=0..10), B=pi_2)
X = UnitX(Factor=Slider(9, range=0..10))
Z = UnitZ(Factor=pcomp_2.ZComponent)
xy_3 = XYPlane(Origin=item_5)
Z_2 = UnitZ(Factor=1)
vrot = Rotate(Vector=X, Axis=Z_2, Angle=division_4)
align = AlignPlane(Plane=xy_3, Direction=vrot)  # -> Plane, Angle
lng_3 = ListLength(List=align.Plane)
panel_13 = Panel("""1
4""")
random_2 = Random(Range=Domain(0, 1), Number=lng_3, Seed=Slider(479, range=0..1000), Integers=True)
slider_3 = Slider(1, range=0..10)
not = GateNot(A=random_2)
weave = Weave(Pattern=[0, 1], Stream0=graft(random_2), Stream1=graft(not), NullGaps=False)
multiplication = Multiplication(A=panel_13, B=slider_3)
item_6 = ListItem(List=multiplication, Index=weave, Wrap=False)
dispatch_2 = Dispatch(List=item_6, DispatchPattern=[True, False])  # -> ListA, ListB
rectangle = Rectangle(Plane=graft(align.Plane), XSize=dispatch_2.ListA, YSize=dispatch_2.ListB, Radius=slider_3)  # -> Rec, Length
move_2 = Move(Geometry=rectangle.Rec, Translation=graft(Z))  # -> Geometry, Transform
Z_3 = UnitZ(Factor=Slider(0.5, range=0..1))
extr = Extrude(Base=move_2.Geometry, Direction=Z_3)
cap = CapHoles(Brep=extr)

# ----
concat_6 = Concatenate(Start=concat, End="-grid")
concat_7 = Concatenate(Start=concat_6, End=".3dm")
f_x_5 = F1(Function="x*1.2", X=bang_4.Branch2)
f_x_6 = F1(Function="ceiling(x*3^0.5) * 1.1", X=bang_5.Branch2)
panel_14 = Panel(concat_7)
trigrid = Triangular(Plane=bang_3.Branch2, Size=slider_2, ExtentX=f_x_6, ExtentY=f_x_5)  # -> Cells, Points
pt_3 = Point(trigrid.Points)

# ---- group: Dot Matrix Layer 1 / Site Area
area = BrepArea(Brep=dispatch.ListB)  # -> Area, Centroid

# ---- group: Should it have a throoughfare? / If there is more than one?
join = JoinCurves(Curves=item_3, Preserve=False)
lng_4 = ListLength(List=join)
larger = LargerThan(FirstNumber=lng_4, SecondNumber="1")  # -> LargerThan, OrEqualTo

# ---- group: Should it have a throoughfare? / Does it wrap a corner?
panel_15 = Panel("""0
1""")
item_7 = ListItem(List=join, Index=0, Wrap=False)
eval = EvaluateCurve(Curve=reparameterize(item_7), Parameter=panel_15)  # -> Point, Tangent, Length
dispatch_3 = Dispatch(List=eval.Tangent, DispatchPattern=[True, False])  # -> ListA, ListB
angle = Angle(VectorA=dispatch_3.ListA, VectorB=dispatch_3.ListB)  # -> Angle, Reflex
pi_3 = Pi(Factor=Slider(0.3, range=0..1))
min = Minimum(A=angle.Angle, B=angle.Reflex)
f_x_y = F2(Function="abs(x)>y", X=min, Y=pi_3)

# ---- group: Should it have a throoughfare?
or = GateOr(A=larger.LargerThan, B=f_x_y)

# ----
dispatch_4 = Dispatch(DispatchPattern=[True, False])  # -> ListA, ListB
Z_4 = UnitZ(Factor=1)
line = LineSDL(Start=dispatch_4.ListA, Direction=Z_4, Length=1)
scx = SurfaceLine(Line=line, Limit=True)  # -> Curves, Points, UVPoints, Normal
wild = Slider(0.146, range=0..1)
hard = Slider(0.542, range=0..1)
z = Slider(0.325, range=0..1)
base = Slider(0.325, range=0..1)
axes = Slider(0.863, range=0..1)
green = Slider(0.25, range=0..1)
ln = Line(PointA=dispatch_4.ListA, PointB=scx.Points)
num = Number([green, wild, hard])
num_2 = Number([z, base, axes])
path_mapper_2 = PathMapper(dispatch_4.ListA, source="{a;b}", target="{1;a;b}")
path_mapper_3 = PathMapper(scx.Points, source="{a;b}", target="{0;a;b}")
path_mapper_4 = PathMapper(ln, source="{a;b}", target="{2;a;b}")
hsl = ColourHSL(Alpha=1, Hue=num, Saturation=1, Luminance=num_2, DataComparison="cross_reference")
m3 = Merge03(StreamA=path_mapper_3, StreamB=path_mapper_2, StreamC=path_mapper_4)
preview = CustomPreview(Geometry=m3, Shader=graft(hsl))
viewer_3 = ParamViewer(m3)
python_4 = PythonScript(FilePath=panel_14, LayerColors=hsl, GeometryTree=m3, DoExport=Toggle(False), GhMemory=10)  # -> out, a; inputs FilePath: String, LayerNames: list of String, LayerColors: list of Color, GeometryTree: tree of GeometryBase, DoExport: Boolean
# ---------- python_4: Python ----------
import System
import System.Collections.Generic as SCG
import Rhino
import scriptcontext

import rhinoscriptsyntax as rs
from Rhino.FileIO import FileWriteOptions, FileReadOptions

def addRhinoLayer(layerName, layerColor=System.Drawing.Color.Black):
    """Creates a Layer in Rhino using a name and optional color. Returns the
    index of the layer requested. If the layer
    already exists, the color is updated and no new layer is created."""
    docLyrs = scriptcontext.doc.Layers
    layerIndex = docLyrs.Find(layerName, True)
    if layerIndex == -1:
        layerIndex = docLyrs.Add(layerName,layerColor)
    else: # it exists
        layer = docLyrs[layerIndex] # so get it
        if layer.Color != layerColor: # if it has a different color
            layer.Color = layerColor # reset the color
    return layerIndex

def layerAttributes(layerName, layerColor=System.Drawing.Color.Black):
    """Returns a Rhino ObjectAttributes object for a rhino layer with an optional color."""
    att = Rhino.DocObjects.ObjectAttributes()
    att.LayerIndex = addRhinoLayer(layerName, layerColor)
    return att

def deleteLayer(layerName, quiet=True):
    """Deletes a layer by Name. returns nothing."""
    layer_index = scriptcontext.doc.Layers.Find(layerName, True)
    settings = Rhino.DocObjects.ObjectEnumeratorSettings()
    settings.LayerIndexFilter = layer_index
    objs = scriptcontext.doc.Objects.FindByFilter(settings)
    ids = [obj.Id for obj in objs]
    scriptcontext.doc.Objects.Delete(ids, quiet)
    scriptcontext.doc.Layers.Delete(layer_index, quiet)

def bakeMany(listOfThings, objectAttributes=None):
    if not objectAttributes:
        objectAttributes = Rhino.DocObjects.ObjectAttributes()
    for thing in listOfThings:
        # move from specific to broad
        if isinstance(thing, Rhino.Geometry.Point3d):
            scriptcontext.doc.Objects.AddPoint(thing, objectAttributes)
        elif isinstance(thing, Rhino.Geometry.Point):
            scriptcontext.doc.Objects.AddPoint(thing.Location, objectAttributes)
        elif isinstance(thing, Rhino.Geometry.Curve):
            scriptcontext.doc.Objects.AddCurve(thing, objectAttributes)
        elif isinstance(thing, Rhino.Geometry.Surface):
            scriptcontext.doc.Objects.AddSurface(thing, objectAttributes)
        elif isinstance(thing, Rhino.Geometry.Brep):
            scriptcontext.doc.Objects.AddBrep(thing, objectAttributes)
        elif isinstance(thing, Rhino.Geometry.Mesh):
            scriptcontext.doc.Objects.AddSurface(thing, objectAttributes)
        elif isinstance(thing, Rhino.Geometry.Hatch):
            scriptcontext.doc.Objects.AddHatch(thing, objectAttributes)
        elif isinstance(thing, Rhino.Display.Text3d):
            scriptcontext.doc.Objects.AddText(thing, objectAttributes)
        else:
            print '''Unrecognized object type: %s''' % type(thing)

def deleteAll():
    """Deletes everything in the current Rhino scriptcontext.doc. Returns nothing."""
    guidList = []
    objType = Rhino.DocObjects.ObjectType.AnyObject
    objTable = scriptcontext.doc.Objects
    objs = objTable.GetObjectList(objType)
    for obj in objs:
        guidList.append(obj.Id)
    for guid in guidList:
        objTable.Delete(guid, True)

def exportFile(filePath,
        version=4,
        geomOnly=False,
        selectedOnly=False,
        ):
    '''Export a file.'''
    opt = FileWriteOptions()
    opt.FileVersion = version
    opt.WriteGeometryOnly = geomOnly
    opt.WriteSelectedObjectsOnly = selectedOnly
    return scriptcontext.doc.WriteFile(filePath, opt)

def exportLayers(layerNames, filePath, version=4):
    '''Export only the items on designated layers to a file.'''
    # save selection
    oldSelection = rs.SelectedObjects()
    # clear selection
    rs.UnselectAllObjects()
    # add everything on the layers to selection
    for name in layerNames:
        objs = scriptcontext.doc.Objects.FindByLayer(name)
        guids = [obj.Id for obj in objs]
        scriptcontext.doc.Objects.Select.Overloads[SCG.IEnumerable[System.Guid]](guids)
    # export selected items
    exportFile(filePath, version, selectedOnly=True)
    #clear selection
    rs.UnselectAllObjects()
    # restore selection
    if oldSelection:
        scriptcontext.doc.Objects.Select.Overloads[SCG.IEnumerable[System.Guid]](oldSelection)
    print 'exported %s' % filePath

# main script

if FilePath and DoExport and GeometryTree and LayerNames:
    numBranches = GeometryTree.BranchCount
    if numBranches == len(LayerNames):
        for i in range(GeometryTree.BranchCount):
            layer = LayerNames[i]
            if LayerColors and i < len(LayerColors):
                color = LayerColors[i]
            else:
                color = System.Drawing.Color.Black
            att = layerAttributes(layer, color)
            branchData = GeometryTree.Branch(i)
            bakeMany( branchData, att )
        exportLayers( LayerNames, FilePath )
        for lay in LayerNames:
            deleteLayer(lay)
    else:
        print '''Please ensure that there is one data tree branch
per layer name.'''
else:
    if DoExport:
        print '''Something is missing. Please make sure you input
a valid file path, a data tree of geometry (one branch per
layer), a list of layer names (one per branch), and that
you have entered 'True' into the 'DoExport' input.'''
# ---------- end python_4 ----------
panel_16 = Panel(python_4.out)

# ---- group: Dot Matrix Layer 1
pt_4 = Point(bang_2.Branch3)
pcomp_3 = Decompose(Point=pt_4)  # -> XComponent, YComponent, ZComponent
bnd = Bounds(Numbers=pcomp_3.ZComponent)
remap = RemapNumbers(Values=pcomp_3.ZComponent, Source=bnd, Target=Domain(0, 1))
domcomp_3 = DomainComponents(Domain=bnd)  # -> Start, End
graph = GraphMapper(
    remap,
    x0=0,
    x1=1,
    y0=0,
    y1=1,
    container_name="Bezier",
    cpx=[0, 0.1837020814, 0.734375, 1],
    cpy=[1, 0.1664048284, 0.2373188436, 0])
slider_4 = Slider(2, range=0..10)
sqrt = SquareRoot(Input=area.Area)
panel_17 = Panel("x/200")
pt_5 = PointXYZ(XComponent=pcomp_3.XComponent, YComponent=pcomp_3.YComponent, ZComponent=0)
xy_4 = XYPlane(Origin=Point(0, 0, 0))

# ---- group: Dot Matrix Layer 1 / Height Delta of Site
subtraction_2 = Subtraction(A=domcomp_3.End, B=domcomp_3.Start)

# ---- group: Dot Matrix Layer 1 (continued)
f_x_7 = F1(Function="x<0.3", X=subtraction_2)
multiplication_2 = Multiplication(A=subtraction_2, B=sqrt)
weave_2 = Weave(Pattern=f_x_7, Stream0=slider_4, Stream1=Slider(4.02, range=0..10), NullGaps=False)
max = Maximum(A=slider_4, B=weave_2)
dom = Domain(DomainStart=Slider(0, range=0..1), DomainEnd=max)
remap_2 = RemapNumbers(Values=graph, Source=Domain(0, 1), Target=dom)
smaller = SmallerThan(FirstNumber=remap_2, SecondNumber=Slider(0.417, range=0..1))  # -> SmallerThan, OrEqualTo
dispatch_5 = Dispatch(List=pt_5, DispatchPattern=smaller.OrEqualTo)  # -> ListA, ListB
dispatch_6 = Dispatch(List=remap_2, DispatchPattern=smaller.OrEqualTo)  # -> ListA, ListB
cir = Circle(Plane=dispatch_5.ListB, Radius=dispatch_6.ListB)
runion = RegionUnion(Curves=cir, Plane=xy_4)
len = Length(Curve=runion)
division_5 = Division(A=len, B=Slider(0.877, range=0..1))
reb = Rebuild(Curve=runion, Degree="1", Count=division_5, Tangents=False)
fillet = Fillet(Curve=reb, Radius=Slider(0.6, range=0..1))
planar = PlanarSrf(Edges=fillet)
eval_2 = EvaluateCurve(Curve=reparameterize(fillet), Parameter=Slider(0.5, range=0..1))  # -> Point, Tangent, Length
explode_3 = BrepComponents(Brep=planar)  # -> Faces, Edges, Vertices
item_8 = ListItem(List=explode_3.Vertices, Index=0, Wrap=False)
cp_3 = ClosestPoint(Point=item_8, Set=pt_5)  # -> ClosestPoint, CPIndex, Distance
item_9 = ListItem(List=pcomp_3.ZComponent, Index=flatten(cp_3.CPIndex), Wrap=False)
Z_5 = UnitZ(Factor=item_9)
move_3 = Move(Geometry=planar, Translation=Z_5)  # -> Geometry, Transform

# ---- group: Dot Matrix Layer 1 / Max Circle Size Factor
f_x_8 = F1(Function=panel_17, X=multiplication_2)

# ---- group: Thoroughfare Curves and Points
shatter = Shatter(Curve=reparameterize(item_7), Parameters="0.5")
int = Integer(larger.LargerThan)
lng_5 = ListLength(List=shatter)
weave_3 = Weave(Pattern=int, Stream0=shatter, Stream1=join, NullGaps=False)
eval_3 = EvaluateCurve(Curve=reparameterize(weave_3), Parameter="0.5")  # -> Point, Tangent, Length
xy_5 = XYPlane(Origin=Point(0, 0, 0))
reb_2 = Rebuild(Curve=site_outline, Degree=1, Count=10, Tangents=False)
pcen = PolygonCenter(Polyline=reb_2)
project_2 = Project(Geometry=pcen, Plane=xy_5)  # -> Geometry, Transform
pt_6 = Point(bang_2.Branch8)
slider_5 = Slider(1, range=0..10)

# ---- group: Thoroughfare Curves and Points / access points
pt_7 = Point(eval_3.Point)

# ---- group: Thoroughfare Curves and Points (continued)
project_3 = Project(Geometry=pt_7, Plane=xy_5)  # -> Geometry, Transform
dispatch_7 = Dispatch(List=project_3.Geometry, DispatchPattern=[True, False])  # -> ListA, ListB
avr = Average(Input=project_3.Geometry)
vec2pt = Vector2Pt(PointA=avr, PointB=project_2.Geometry, Unitize=False)  # -> Vector, Length
multiplication_3 = Multiplication(A=vec2pt.Length, B=Slider(0, range=0..1))
amp_3 = Amplitude(Vector=vec2pt.Vector, Amplitude=multiplication_3)
move_4 = Move(Geometry=avr, Translation=amp_3)  # -> Geometry, Transform
ln_2 = Line(PointA=dispatch_7.ListA, PointB=dispatch_7.ListB)
divlength = DivideLength(Curve=ln_2, Length=Slider(2, range=0..10))  # -> Points, Tangents, Parameters
weave_4 = Weave(
    Pattern=[0, 1, 2],
    Stream0=flatten(dispatch_7.ListA),
    Stream1=flatten(move_4.Geometry),
    Stream2=flatten(dispatch_7.ListB),
    NullGaps=False)
intcrv = Interpolate(Vertices=weave_4, Degree=3, Periodic=False)  # -> Curve, Length, Domain
cp_4 = ClosestPoint(Point=graft(divlength.Points), Set=pt_6)  # -> ClosestPoint, CPIndex, Distance
crv_cp = CurveCP(Point=pt_6, Curve=intcrv.Curve)  # -> Point, Parameter, Distance
sort_2 = SortList(Keys=crv_cp.Parameter, ValuesA=crv_cp.Distance)  # -> List, ValuesA
sort_3 = SortList(Keys=crv_cp.Parameter, ValuesA=pt_6)  # -> List, ValuesA
f_x_y_2 = F2(Function="x>y", X=sort_2.ValuesA, Y=Slider(2, range=0..10))
dispatch_8 = Dispatch(List=sort_3.ValuesA, DispatchPattern=f_x_y_2)  # -> ListA, ListB
pt_8 = Point(dispatch_8.ListB)

# ----
con = DelaunayEdges(Points=pt_6, Plane=PlaneXY(0, 0, 0))  # -> Connectivity, Edges
crv = Curve(con.Edges)

# ---- group: Pathway Geometry
len_2 = Length(Curve=intcrv.Curve)
lng_6 = ListLength(List=flatten(pt_8))
division_6 = Division(A=len_2, B=Slider(9, range=0..100))
subtraction_3 = Subtraction(A=lng_6, B=1)
div = DivideDomain(Domain=subtraction_3, Count=division_6)
subset = SubList(List=flatten(pt_8), Interval=div, Cycle=False)  # -> List, Index
xy_6 = XYPlane(Origin=Point(0, 0, 0))
hull = ConvexHull(Points=subset.List, Plane=xy_6)  # -> Hull, HullZ, Indices
item_10 = ListItem(List=subset.List, Index=hull.Indices, Wrap=False)
pline = PolyLine(Vertices=item_10, Closed=True)
offset = Offset(Curve=pline, Distance=slider_5, Plane=PlaneXY(0, 0, 0), Corners=2)
runion_2 = RegionUnion(Curves=flatten(offset))
divlength_2 = DivideLength(Curve=runion_2, Length="0.5")  # -> Points, Tangents, Parameters
pline_2 = PolyLine(Vertices=divlength_2.Points, Closed=True)
fillet_2 = Fillet(Curve=pline_2, Radius="0.5")
Z_6 = UnitZ(Factor=1)
project_4 = Project(Curve=fillet_2, Brep=bang_2.Branch0, Direction=Z_6)
crv_2 = Curve(project_4)
srfsplit_2 = SurfaceSplit(Surface=bang_2.Branch0, Curves=crv_2)
dispatch_9 = Dispatch(List=srfsplit_2, DispatchPattern=[True, False])  # -> ListA, ListB
srf = Surface(dispatch_9.ListB)
