# Grasshopper definition design_sketch_2.ghx (Grasshopper 0.8.11)

path = FilePath("C:\Users\demonchaux\Dropbox\localcode\site_ids.txt")
file = ReadFile(Path=path, Lines=True)
item = ListItem(List=file, Index=Slider(20, range=0..49), Wrap=False)
panel = Panel("""-site
-transportation
-drains
-water""")
panel_2 = Panel("""-terrain
-borders
-billboardpoints""")
concat = Concatenate(Start="C:\amigos\dump\", End=item)
panel_3 = Panel("""openchannels
gravitymains
lateraldrains
catchbasins
bikeways
drp_trails
hydrography""")
panel_4 = Panel("""foundbillboards-projected
geocodedbillboards-projected""")
concat_2 = Concatenate(Start=concat, End=panel_2)
panel_5 = Panel(file)
panel_6 = Panel("""freeways
metrobusstops-projected""")
concat_3 = Concatenate(Start=concat, End=panel)
panel_7 = Panel("""groundsurface
site-projected
parcel-projected""")
concat_4 = Concatenate(Start=concat_2, End=".3dm")
concat_5 = Concatenate(Start=concat_3, End=".3dm")
panel_8 = Panel(concat_5)
concat_6 = Concatenate(Start=panel_3, End="-projected")
panel_9 = Panel(concat_4)
merge = Merge(StreamA=panel_6, StreamB=concat_6)
python = PythonScript(FilePaths=concat_5, LayerNames=merge, DoImport=Toggle(True), GhMemory=0)  # -> out, layerTree, availableLayers; inputs FilePaths: list, LayerNames: list
# ---------- python: Python ----------
import Rhino


# for accesssing GH classes
import clr
clr.AddReference("Grasshopper")
from Grasshopper.Kernel.Data import GH_Path
from Grasshopper import DataTree


# read geometry out of 3dm files and filter by layernames
if DoImport and FilePaths and LayerNames:
    
    layerTree = DataTree[Rhino.Geometry.GeometryBase]() # make a DataTree
    availableLayers = []
    for filepath in FilePaths:
        model = Rhino.FileIO.File3dm.Read(filepath)
        for lay in model.Layers:
            availableLayers.append(lay.Name)
        if not model: continue
        for i, layer in enumerate(LayerNames):
            path = GH_Path(i)
            geometry = []
            objs = model.Objects.FindByLayer(layer)
            for obj in objs:
                geom = obj.Geometry
                geom.EnsurePrivateCopy()
                geometry.append(geom)
            layerTree.AddRange(geometry, path)
        
        # models can take up a considerable amount of
        # memory that we don't need, so get rid of it
        # after copying the geometry we want out of it
        model.Dispose()
# ---------- end python ----------
merge_2 = Merge(StreamA=panel_7, StreamB=panel_4)
python_2 = PythonScript(FilePaths=concat_4, LayerNames=merge_2, DoImport=Toggle(True), GhMemory=0)  # -> out, layerTree, availableLayers; inputs FilePaths: list, LayerNames: list; same code as python
bang = ExplodeTree(Tree=python.layerTree)  # -> Branch1, Branch2, Branch3, Branch4, Branch5, Branch6, Branch7, Branch8, Branch9, Branch10
bang_2 = ExplodeTree(Tree=python_2.layerTree)  # -> Branch0, Branch1, Branch2, Branch3, Branch4, Branch5, Branch6, Branch7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
panel_10 = Panel("""Default
hydrography
parcel
site
othersites
geocodedbillboards
roads
catchbasins
gravitymains
freeways
metrobusstops
stormdrains
censusblocks
lateraldrains
localnoncentralbus
openchannels
waterways
bikeways
rails
rapidbuslines
foundbillboards
streetlights
tin_pts
drp_trails
expressbuslines
waterbodies
raillines
localcentralbus
Default
rapidbuslines-projected
metrobusstops-projected
Default
gravitymains-projected
lateraldrains-projected
catchbasins-projected
Default""")
pt = Point(bang.Branch2)
merge_3 = Merge(StreamA=bang_2.Branch3, StreamB=bang_2.Branch4)
panel_11 = Panel(merge)
xy = XYPlane(Origin=Point(0, 0, 0))
flatten = FlattenTree(Data=merge_3, Path="{0}")

# ---- group: Storm Drains
merge_4 = MergeMultiple(Stream0=bang.Branch3, Stream1=bang.Branch4, Stream2=bang.Branch5, Stream3=bang.Branch6)
all_storm_drains = Curve(flatten(merge_4))
explode = Explode(Curve=all_storm_drains, Recursive=True)  # -> Segments, Vertices

# ----
viewer = ParamViewer(python_2.layerTree)
site_outline = Curve(bang_2.Branch1)
panel_12 = Panel(merge_2)
xy_2 = XYPlane(Origin=Point(0, 0, 0))
project = Project(Geometry=bang_2.Branch1, Plane=xy)  # -> Geometry, Transform
xy_3 = XYPlane(Origin=Point(0, 0, 0))
crv_cp = CurveCP(Point=pt, Curve=site_outline)  # -> Point, Parameter, Distance
parcels = Curve(bang_2.Branch2)
project_2 = Project(Geometry=bang_2.Branch1, Plane=xy_2)  # -> Geometry, Transform
fit = FitCrv(Curve=project.Geometry, Degree="1", Tolerance=Slider(0.462, range=0..1))
project_3 = Project(Geometry=site_outline, Plane=xy_3)  # -> Geometry, Transform
cset = CreateSet(List=crv_cp.Point)
slider = Slider(3, range=0..10)
crv = Curve(fit)
bus_stops_on_edges = Point(cset)
srfsplit = SurfaceSplit(Surface=bang_2.Branch0, Curves=site_outline)
dispatch = Dispatch(List=srfsplit, DispatchPattern=[True, False])  # -> ListA, ListB
srf = Surface(dispatch.ListB)

# ---- group: Access Edges
explode_2 = Explode(Curve=bang_2.Branch2, Recursive=True)  # -> Segments, Vertices
explode_3 = Explode(Curve=bang_2.Branch1, Recursive=True)  # -> Segments, Vertices
cset_2 = CreateSet(List=flatten(explode_3.Vertices))
cset_3 = CreateSet(List=explode_2.Vertices)
mindex = MemberIndex(Set=cset_3, Member=cset_2)  # -> Index, Count
path_mapper = PathMapper(mindex.Index, source="{a;b;c;d}", target="{a;b}")
clean = CleanTree(Data=path_mapper, CleanInvalid=True, CleanEmpty=True)
lng = ListLength(List=clean)
viewer_2 = ParamViewer(clean)
sort = SortList(Keys=flatten(lng), ValuesA=viewer_2)  # -> List, ValuesA
rev = ReverseList(List=sort.ValuesA)
str = String(viewer_2)
item_2 = ListItem(List=rev, Index=0, Wrap=False)
cset_4 = CreateSet(List=str)
str_2 = String(item_2)
cset_5 = CreateSet(List=str_2)
difference = SetDifference(SetA=cset_4, SetB=cset_5)
branch = TreeBranch(Tree=explode_2.Segments, Path=difference)
cp = ControlPoints(Curve=explode_3.Segments)  # -> Points, Weights, Knots
cp_2 = ControlPoints(Curve=branch)  # -> Points, Weights, Knots
python_3 = PythonScript(siteSegments=cp.Points, otherSegments=cp_2.Points, tol=Slider(0.0372, range=0..0.5), GhMemory=0)  # -> out, a; inputs siteSegments: tree, otherSegments: tree
# ---------- python_3: Python ----------
import Rhino
segmentSet = range(siteSegments.BranchCount)
out = []
for i in range(otherSegments.BranchCount):
    commonSegs = []
    thisSeg = list(otherSegments.Branch(i))
    for j in range(siteSegments.BranchCount):
        # now we have both segments
        trues = 0
        otherSeg = list(siteSegments.Branch(j))
        for otherPoint in otherSeg:
            for thisPoint in thisSeg:
                if otherPoint.DistanceTo(thisPoint) < tol:
                    trues += 1
        if trues == len(thisSeg) and j in segmentSet:
            segmentSet.remove(j)
        
a = segmentSet
# ---------- end python_3 ----------
item_3 = ListItem(List=explode_3.Segments, Index=python_3.a, Wrap=False)

# ----
circle = Circle(bang.Branch6)
xy_4 = XYPlane(Origin=Point(0, 0, 0))
pt_2 = Point(circle)
project_4 = Project(Geometry=pt_2, Plane=xy_4)  # -> Geometry, Transform
con = Containment(Point=project_4.Geometry, Curve=project.Geometry)  # -> Relationship, Point
panel_13 = Panel("""6
3
2""")
pi = Pi(Factor=1)
division = Division(A=pi, B=panel_13)
f_x = F1(Function="x<2", X=con.Relationship)
xy_5 = XYPlane(Origin=Point(0, 0, 0))
dispatch_2 = Dispatch(List=pt_2, DispatchPattern=f_x)  # -> ListA, ListB
concat_7 = Concatenate(Start=concat, End="-grid")
rotate = Rotate(Geometry=xy_5, Angle=division, Plane=xy_5)  # -> Geometry, Transform
bbox = BoundingBox(Content=site_outline, Union=True, Plane=rotate.Geometry)  # -> Box, Box_2
pcomp = PlaneComponents(Plane=rotate.Geometry)  # -> Origin, XAxis, YAxis, ZAxis
concat_8 = Concatenate(Start=concat_7, End=".3dm")
lng_2 = ListLength(List=dispatch_2.ListA)
distance_between_grid_points = Slider(9, range=0..10)
box = BoxComponents(Box=bbox.Box)  # -> Plane, X, Y, Z
panel_14 = Panel(concat_8)
crv_2 = Curve(bang_2.Branch1)
domcomp = DomainComponents(Domain=box.X)  # -> Start, End
domcomp_2 = DomainComponents(Domain=box.Y)  # -> Start, End
amp = Amplitude(Vector=pcomp.XAxis, Amplitude=domcomp.Start)
amp_2 = Amplitude(Vector=pcomp.YAxis, Amplitude=domcomp_2.Start)
div = DivideDomain(Domain=crv_2, Count=Slider(4, range=0..10))
addition = Addition(A=amp, B=amp_2)
division_2 = Division(A=domcomp.End, B=distance_between_grid_points)
division_3 = Division(A=domcomp_2.End, B=distance_between_grid_points)
subcrv = SubCurve(BaseCurve=crv_2, Domain=div)
move = Move(Geometry=rotate.Geometry, Translation=addition)  # -> Geometry, Transform
f_x_2 = F1(Function="ceiling(x)", X=division_2)
f_x_3 = F1(Function="ceiling(x)", X=division_3)
curvepoint = PointOnCurve(subcrv, parameter=0.5)
minimum_branch_length = Slider(35.2, range=0..50)
f_x_4 = F1(Function="(x*2)+1", X=f_x_3)
bang_3 = ExplodeTree(Tree=graft(move.Geometry))  # -> Branch0, Branch1, Branch2
f_x_5 = F1(Function="(x*2)+1", X=f_x_2)

# ---- group: Should it have a throoughfare? / If there is more than one?
join = JoinCurves(Curves=item_3, Preserve=False)
lng_3 = ListLength(List=join)
larger = LargerThan(FirstNumber=lng_3, SecondNumber="1")  # -> LargerThan, OrEqualTo

# ---- group: Should it have a throoughfare? / Does it wrap a corner?
panel_15 = Panel("""0
1""")
item_4 = ListItem(List=join, Index=0, Wrap=False)
eval = EvaluateCurve(Curve=reparameterize(item_4), Parameter=panel_15)  # -> Point, Tangent, Length
dispatch_3 = Dispatch(List=eval.Tangent, DispatchPattern=[True, False])  # -> ListA, ListB
angle = Angle(VectorA=dispatch_3.ListA, VectorB=dispatch_3.ListB)  # -> Angle, Reflex
pi_2 = Pi(Factor=Slider(0.3, range=0..1))
min = Minimum(A=angle.Angle, B=angle.Reflex)
f_x_y = F2(Function="abs(x)>y", X=min, Y=pi_2)

# ----
bang_4 = ExplodeTree(Tree=graft(f_x_5))  # -> Branch0, Branch1, Branch2
bang_5 = ExplodeTree(Tree=graft(f_x_4))  # -> Branch0, Branch1, Branch2
f_x_6 = F1(Function="ceiling(x*3^0.5) * 1.1", X=f_x_5)
f_x_7 = F1(Function="x*1.2", X=f_x_4)
sqgrid = Square(Plane=bang_3.Branch0, Size=distance_between_grid_points, ExtentX=bang_4.Branch0, ExtentY=bang_5.Branch0)  # -> Cells, Points
sqgrid_2 = Square(Plane=bang_3.Branch1, Size=distance_between_grid_points, ExtentX=bang_4.Branch1, ExtentY=bang_5.Branch1)  # -> Cells, Points
trigrid = Triangular(Plane=bang_3.Branch2, Size=distance_between_grid_points, ExtentX=f_x_6, ExtentY=f_x_7)  # -> Cells, Points
panel_16 = Panel("""0
1
2""")
explode_4 = Explode(Curve=trigrid.Cells, Recursive=True)  # -> Segments, Vertices
cset_6 = CreateSet(List=flatten(sqgrid.Points))
cset_7 = CreateSet(List=flatten(sqgrid_2.Points))
cset_8 = CreateSet(List=flatten(explode_4.Vertices))
bang_6 = ExplodeTree(Tree=graft(panel_16))  # -> Branch1, Branch2, Branch3
flat_site_outline = Curve(project_2.Geometry)

# ---- group: Should it have a throoughfare?
or = GateOr(A=larger.LargerThan, B=f_x_y)

# ----
flatten_2 = FlattenTree(Data=cset_6, Path=bang_6.Branch3)
flatten_3 = FlattenTree(Data=cset_7, Path=bang_6.Branch2)
flatten_4 = FlattenTree(Data=cset_8, Path=bang_6.Branch1)
billboards = Geometry(bang_2.Branch3)
m3 = Merge03(StreamA=flatten_4, StreamB=flatten_3, StreamC=flatten_2)
panel_17 = Panel("""0
1
2""")
con_2 = Containment(Point=m3, Curve=flat_site_outline)  # -> Relationship, Point
f_x_8 = F1(Function="x<2", X=con_2.Relationship)
dispatch_4 = Dispatch(List=m3, DispatchPattern=f_x_8)  # -> ListA, ListB
mesh = MeshBrep(
    Brep=dispatch.ListB,
    Settings={Refine=True, JaggedSeams=False, SimplePlanes=True, GridMinCount=16, GridMaxCount=0, Tolerance=0, RefineAngle=0, MinTolerance=0, RelativeTolerance=0.65, MinEdgeLength=0.0001, MaxEdgeLength=0})
Z = UnitZ(Factor=1)
wbedges = MeshEdges(Mesh=mesh)
drain_point_distance = Slider(6.2, range=0..50)
projected_hydrography = Curve(bang.Branch9)
meshray = MeshRay(Mesh=flatten(mesh), Point=dispatch_4.ListA, Direction=Z)  # -> Point, Hit
bikeways = Curve(bang.Branch7)
dispatch_5 = Dispatch(List=dispatch_4.ListA, DispatchPattern=meshray.Hit)  # -> ListA, ListB
trails = Curve(bang.Branch8)
grids_at_elevation = Point(meshray.Point)
interior_coincident_grids = Point(dispatch_5.ListA)
graft = GraftTree(Data=meshray.Point, Strip=False)
crv_cp_2 = CurveCP(Point=graft, Curve=flatten(projected_hydrography))  # -> Point, Parameter, Distance
sort_2 = SortList(Keys=crv_cp_2.Distance)  # -> List, ValuesA
crv_cp_3 = CurveCP(Point=graft, Curve=flatten(trails))  # -> Point, Parameter, Distance
crv_cp_4 = CurveCP(Point=graft, Curve=flatten(item_3))  # -> Point, Parameter, Distance
crv_cp_5 = CurveCP(Point=graft, Curve=flatten(bikeways))  # -> Point, Parameter, Distance

# ---- group: default value if null
panel_18 = Panel("10000.0")

# ----
freeways = Curve(bang.Branch1)
item_5 = ListItem(List=sort_2.List, Index=0, Wrap=False)
sort_3 = SortList(Keys=crv_cp_3.Distance)  # -> List, ValuesA
sort_4 = SortList(Keys=crv_cp_4.Distance)  # -> List, ValuesA
sort_5 = SortList(Keys=crv_cp_5.Distance)  # -> List, ValuesA
cp_3 = ClosestPoint(Point=graft, Set=flatten(pt))  # -> ClosestPoint, CPIndex, Distance
crv_cp_6 = CurveCP(Point=graft, Curve=flatten(freeways))  # -> Point, Parameter, Distance
item_6 = ListItem(List=sort_3.List, Index=0, Wrap=False)
item_7 = ListItem(List=sort_4.List, Index=0, Wrap=False)
item_8 = ListItem(List=sort_5.List, Index=0, Wrap=False)
sort_6 = SortList(Keys=crv_cp_6.Distance)  # -> List, ValuesA

# ---- group: Ensure Number or 0.0
num = Number(item_5)
str_3 = String(num)
f_x_y_2 = F2(Function="x=y", X=str_3, Y="NaN")
null = NullItem(Items=num)  # -> NullFlags, InvalidFlags
or_2 = GateOr(A=f_x_y_2, B=null.NullFlags)
item_9 = ListItem(List=or_2, Index=0, Wrap=False)
weave = Weave(Pattern=item_9, Stream0=num, Stream1=panel_18, NullGaps=False)

# ----
bang_7 = ExplodeTree(Tree=grids_at_elevation)  # -> Branch1, Branch2, Branch3
plant_grid = Point(bang_7.Branch2)
pcomp_2 = Decompose(Point=plant_grid)  # -> XComponent, YComponent, ZComponent
sort_7 = SortList(Keys=pcomp_2.ZComponent, ValuesA=plant_grid)  # -> List, ValuesA
item_10 = ListItem(List=sort_7.ValuesA, Index=0, Wrap=False)
weave_2 = Weave(Pattern=lng_2, Stream0=item_10, Stream1=dispatch_2.ListA, NullGaps=False)
panel_19 = Panel(weave_2)
ln = Line(PointA=weave_2, PointB=curvepoint)
len = Length(Curve=ln)
f_x_y_3 = F2(Function="x>y", X=len, Y=minimum_branch_length)
dispatch_6 = Dispatch(List=ln, DispatchPattern=f_x_y_3)  # -> ListA, ListB
ext = Extend(Curve=dispatch_6.ListA, Type=0, Start=0, End=Slider(-10.5, range=-20..21))
crv_3 = Curve(ext)
lng_4 = ListLength(List=crv_3)
crv_cp_7 = CurveCP(Point=graft(plant_grid), Curve=flatten(crv_3))  # -> Point, Parameter, Distance
series = Series(Start=0, Step=1, Count=lng_4)
sort_8 = SortList(Keys=crv_cp_7.Distance, ValuesA=flatten(series))  # -> List, ValuesA
sort_9 = SortList(Keys=crv_cp_7.Distance, ValuesA=crv_cp_7.Parameter)  # -> List, ValuesA
item_11 = ListItem(List=sort_8.ValuesA, Index=0, Wrap=False)
item_12 = ListItem(List=sort_9.ValuesA, Index=0, Wrap=False)
item_13 = ListItem(List=sort_9.List, Index=0, Wrap=False)
graft_2 = GraftTree(Data=flatten(plant_grid), Strip=False)
weave_3 = Weave(Pattern=panel_17, Stream0=item_13, Stream1=item_11, Stream2=item_12, NullGaps=False)
panel_20 = Panel(item_11)
flip = FlipMatrix(Data=weave_3)
bang_8 = ExplodeTree(Tree=flip)  # -> Branch1, Branch2, Branch3
curve_number = Integer(bang_8.Branch2)
graft_3 = GraftTree(Data=flatten(bang_8.Branch1), Strip=False)
graft_4 = GraftTree(Data=flatten(bang_8.Branch3), Strip=False)
viewer_3 = ParamViewer(graft_3)
viewer_4 = ParamViewer(graft_2)
viewer_5 = ParamViewer(graft_4)
replace = ReplaceBranches(Data=graft_3, Search=viewer_3, Replace=curve_number)
replace_2 = ReplaceBranches(Data=graft_2, Search=viewer_4, Replace=curve_number)
distance = Number(replace)
replace_3 = ReplaceBranches(Data=graft_4, Search=viewer_5, Replace=curve_number)

# ---- group: Canopy
xy_6 = XYPlane(Origin=Point(0, 0, 0))
project_5 = Project(Geometry=flatten, Plane=xy_6)  # -> Geometry, Transform
con_3 = Containment(Point=project_5.Geometry, Curve=project.Geometry)  # -> Relationship, Point
billboard_points = Point(flatten)
f_x_9 = F1(Function="x<2", X=con_3.Relationship)
dispatch_7 = Dispatch(List=billboard_points, DispatchPattern=f_x_9)  # -> ListA, ListB
billboard_radius = Slider(1.5, range=0.5..10)
area = BrepArea(Brep=crv)  # -> Area, Centroid
points_for_canopies = Point(dispatch_7.ListA)
hardscape_grid = Point(bang_7.Branch1)
rough_site_area = Number(area.Area)
max_canopy_radius = Slider(36, range=0..100)
clean_2 = CleanTree(Data=hardscape_grid, CleanInvalid=True, CleanEmpty=False)
cir = Circle(Plane=points_for_canopies, Radius=billboard_radius)
sqrt = SquareRoot(Input=rough_site_area)
multiplication = Multiplication(A=sqrt, B=Slider(0.338, range=0..1))
min_2 = Minimum(A=multiplication, B=max_canopy_radius)
vec2pt = Vector2Pt(PointA=cir, PointB=clean_2, Unitize=False)  # -> Vector, Length
panel_21 = Panel(multiplication)
f_x_y_4 = F2(Function="x<y", X=vec2pt.Length, Y=min_2)
pie = PieChart(f_x_y_4)
dispatch_8 = Dispatch(List=clean_2, DispatchPattern=f_x_y_4)  # -> ListA, ListB
crv_cp_8 = CurveCP(Point=dispatch_8.ListA, Curve=cir)  # -> Point, Parameter, Distance
python_4 = PythonScript(points=crv_cp_8.Point, tolerance=Slider(1, range=0..1), GhMemory=0)  # -> out, a; inputs points: list of Point3d, tolerance: Double
# ---------- python_4: Python ----------
import Rhino

a = Rhino.Geometry.Point3d.CullDuplicates( points, tolerance )
# ---------- end python_4 ----------
panel_22 = Panel(python_4.a)
crv_cp_9 = CurveCP(Point=python_4.a, Curve=cir)  # -> Point, Parameter, Distance
canopy_max = Slider(5, range=0..10)
canopy_min = Slider(2.3, range=0..10)
lng_5 = ListLength(List=dispatch_8.ListA)
random_seed = Slider(256, range=0..1000)
sort_10 = SortList(Keys=crv_cp_9.Parameter, ValuesA=crv_cp_9.Point)  # -> List, ValuesA
dom = Domain(DomainStart=canopy_min, DomainEnd=canopy_max)
f_x_10 = F1(Function="ceiling(x)", X=lng_5)
dup = DuplicateData(Data=[canopy_min, canopy_max], Number=f_x_10, Order=True)
lng_6 = ListLength(List=sort_10.ValuesA)
split = SplitList(List=dup, Index=lng_6)  # -> ListA, ListB
Z_2 = UnitZ(Factor=split.ListA)
random = Random(Range=dom, Number=lng_5, Seed=random_seed, Integers=False)
Z_3 = UnitZ(Factor=random)
move_2 = Move(Geometry=sort_10.ValuesA, Translation=Z_2)  # -> Geometry, Transform
move_3 = Move(Geometry=dispatch_8.ListA, Translation=Z_3)  # -> Geometry, Transform
weave_4 = Weave(Pattern=[0, 1], Stream0=flatten(move_3.Geometry), Stream1=flatten(move_2.Geometry), NullGaps=False)
xy_7 = XYPlane(Origin=Point(0, 0, 0))
cset_9 = CreateSet(List=weave_4)
del = DelaunayMesh(Points=cset_9, Plane=xy_7)
wbedges_2 = MeshEdges(Mesh=del)
canopy_points = Point(points_for_canopies)
canopy_mesh = Mesh(del)

# ----
f_x_y_5 = F2(Function="x<y", X=distance, Y=drain_point_distance)
dispatch_9 = Dispatch(List=replace_2, DispatchPattern=f_x_y_5)  # -> ListA, ListB
dispatch_10 = Dispatch(List=replace_3, DispatchPattern=f_x_y_5)  # -> ListA, ListB
drain_point = Point(weave_2)
points = Point(dispatch_9.ListA)
parameter_value = Number(dispatch_10.ListA)
cset_10 = CreateSet(List=drain_point)
sort_11 = SortList(Keys=parameter_value, ValuesA=points)  # -> List, ValuesA
item_14 = ListItem(List=sort_11.ValuesA, Index=0, Wrap=False)
cp_4 = ClosestPoint(Point=graft, Set=flatten(explode.Vertices))  # -> ClosestPoint, CPIndex, Distance

num_2 = Number(cp_3.Distance)
str_4 = String(num_2)
f_x_y_6 = F2(Function="x=y", X=str_4, Y="NaN")
null_2 = NullItem(Items=num_2)  # -> NullFlags, InvalidFlags
or_3 = GateOr(A=f_x_y_6, B=null_2.NullFlags)
item_15 = ListItem(List=or_3, Index=0, Wrap=False)
weave_5 = Weave(Pattern=item_15, Stream0=num_2, Stream1=panel_18, NullGaps=False)
path_mapper_2 = PathMapper(weave_5, source="{A;B;C;D}", target="{A}")

item_16 = ListItem(List=sort_6.List, Index=0, Wrap=False)
cset_11 = CreateSet(List=flatten(item_14))

# ---- group: Ensure Number or 0.0
num_3 = Number(item_6)
str_5 = String(num_3)
f_x_y_7 = F2(Function="x=y", X=str_5, Y="NaN")
null_3 = NullItem(Items=num_3)  # -> NullFlags, InvalidFlags
or_4 = GateOr(A=f_x_y_7, B=null_3.NullFlags)
item_17 = ListItem(List=or_4, Index=0, Wrap=False)
panel_23 = Panel("0.0")
weave_6 = Weave(Pattern=item_17, Stream0=num_3, Stream1=panel_18, NullGaps=False)

num_4 = Number(item_7)
str_6 = String(num_4)
f_x_y_8 = F2(Function="x=y", X=str_6, Y="NaN")
null_4 = NullItem(Items=num_4)  # -> NullFlags, InvalidFlags
or_5 = GateOr(A=f_x_y_8, B=null_4.NullFlags)
item_18 = ListItem(List=or_5, Index=0, Wrap=False)
weave_7 = Weave(Pattern=item_18, Stream0=num_4, Stream1=panel_18, NullGaps=False)

# ----
pline = PolyLine(Vertices=sort_11.ValuesA, Closed=False)

# ---- group: Ensure Number or 0.0
num_5 = Number(item_8)
str_7 = String(num_5)
f_x_y_9 = F2(Function="x=y", X=str_7, Y="NaN")
null_5 = NullItem(Items=num_5)  # -> NullFlags, InvalidFlags
or_6 = GateOr(A=f_x_y_9, B=null_5.NullFlags)
item_19 = ListItem(List=or_6, Index=0, Wrap=False)
weave_8 = Weave(Pattern=item_19, Stream0=num_5, Stream1=panel_18, NullGaps=False)

# ----
str_8 = String(item_16)
lng_7 = ListLength(List=cset_11)

num_6 = Number(cp_4.Distance)
str_9 = String(num_6)
f_x_y_10 = F2(Function="x=y", X=str_9, Y="NaN")
null_6 = NullItem(Items=num_6)  # -> NullFlags, InvalidFlags
or_7 = GateOr(A=f_x_y_10, B=null_6.NullFlags)
item_20 = ListItem(List=or_7, Index=0, Wrap=False)
weave_9 = Weave(Pattern=item_20, Stream0=num_6, Stream1=panel_18, NullGaps=False)
path_mapper_3 = PathMapper(weave_9, source="{A;B;C;D}", target="{A}")

f_x_y_11 = F2(Function="x=y", X=flatten(str_8), Y="NaN")
fsim = FindSimilarMember(Data=cset_10, Set=flatten(cset_11))  # -> Hit, Index
item_21 = ListItem(List=f_x_y_11, Index=0, Wrap=False)
item_22 = ListItem(List=flatten(pline), Index=fsim.Index, Wrap=False)
cull_i = CullIndex(List=cset_11, Indices=fsim.Index, Wrap=False)
weave_10 = Weave(Pattern=item_21, Stream0=item_16, Stream1="0.0", NullGaps=False)
cp_5 = ClosestPoint(Point=graft, Set=flatten)  # -> ClosestPoint, CPIndex, Distance
crv_cp_10 = CurveCP(Point=graft(cull_i), Curve=item_22)  # -> Point, Parameter, Distance
path_mapper_4 = PathMapper(weave_10, source="{A;B;C;D;E}", target="{A}")
ln_2 = Line(PointA=crv_cp_10.Point, PointB=graft(cull_i))
path_mapper_5 = PathMapper(weave, source="{A;B;C;D;E}", target="{A}")
path_mapper_6 = PathMapper(cp_5.Distance, source="{A;B;C}", target="{A}")
cull_i_2 = CullIndex(List=flatten(pline), Indices=fsim.Index, Wrap=False)
swatch = ColourSwatch(SwatchColor=RGB(0, 0, 0))
swatch_2 = ColourSwatch(SwatchColor=RGB(255, 255, 0))
weave_11 = Weave(Pattern=[0, 1], Stream0=ln_2, Stream1=graft(cull_i_2), NullGaps=False)
path_mapper_7 = PathMapper(weave_8, source="{A;B;C;D;E}", target="{A}")
path_mapper_8 = PathMapper(weave_7, source="{A;B;C;D;E}", target="{A}")
path_mapper_9 = PathMapper(weave_6, source="{A;B;C;D;E}", target="{A}")
join_2 = JoinCurves(Curves=weave_11, Preserve=False)
preview = CustomPreview(Geometry=billboards, Shader=swatch)
preview_2 = CustomPreview(Geometry=bang_7.Branch1, Shader=swatch)
preview_3 = CustomPreview(Geometry=bang_7.Branch2, Shader=ColourSwatch(SwatchColor=RGB(255, 0, 157)))
preview_4 = CustomPreview(Geometry=bang_7.Branch3, Shader=ColourSwatch(SwatchColor=RGB(0, 255, 255)))
weave_12 = Weave(Pattern=[0, 1], Stream0=item_22, Stream1=flatten(join_2), NullGaps=False)
panel_24 = Panel(weave_11)
drain_curves = Curve(weave_12)
drain_point_2 = Point(drain_point)

# ---- group: HydrographyDistance
hydrography_distance = Number(path_mapper_5)

# ---- group: Billboard Distance
billboard_distance = Number(path_mapper_6)

# ---- group: Freeway Distance
freeway_distance = Number(path_mapper_4)

# ---- group: Bus Stop Distance
bus_stop_rating = Number(path_mapper_2)

# ----
storm_drain_distance = Number(path_mapper_3)
bikeway_distance = Number(path_mapper_7)

# ---- group: Trials Distance
trails_distance = Number(path_mapper_9)

# ----
access_distance = Number(path_mapper_8)
dispatch_11 = Dispatch(DispatchPattern=[True, False])  # -> ListA, ListB
Z_4 = UnitZ(Factor=1)
line = LineSDL(Start=dispatch_11.ListA, Direction=Z_4, Length=1)
scx = SurfaceLine(Line=line, Limit=True)  # -> Curves, Points, UVPoints, Normal
wild = Slider(0.146, range=0..1)
hard = Slider(0.542, range=0..1)
z = Slider(0.325, range=0..1)
base = Slider(0.325, range=0..1)
axes = Slider(0.863, range=0..1)
green = Slider(0.25, range=0..1)
ln_3 = Line(PointA=dispatch_11.ListA, PointB=scx.Points)
num_7 = Number([green, wild, hard])
num_8 = Number([z, base, axes])
path_mapper_10 = PathMapper(dispatch_11.ListA, source="{a;b}", target="{1;a;b}")
path_mapper_11 = PathMapper(scx.Points, source="{a;b}", target="{0;a;b}")
path_mapper_12 = PathMapper(ln_3, source="{a;b}", target="{2;a;b}")
hsl = ColourHSL(Alpha=1, Hue=num_7, Saturation=1, Luminance=num_8, DataComparison="cross_reference")
m3_2 = Merge03(StreamA=path_mapper_11, StreamB=path_mapper_10, StreamC=path_mapper_12)
preview_5 = CustomPreview(Geometry=m3_2, Shader=graft(hsl))
viewer_6 = ParamViewer(m3_2)
python_5 = PythonScript(FilePath=panel_14, LayerColors=hsl, GeometryTree=m3_2, DoExport=Toggle(False), GhMemory=10)  # -> out, a; inputs FilePath: String, LayerNames: list of String, LayerColors: list of Color, GeometryTree: tree of GeometryBase, DoExport: Boolean
# ---------- python_5: Python ----------
import System
import System.Collections.Generic as SCG
import Rhino
import scriptcontext

import rhinoscriptsyntax as rs
from Rhino.FileIO import FileWriteOptions, FileReadOptions

def addRhinoLayer(layerName, layerColor=System.Drawing.Color.Black):
    """Creates a Layer in Rhino using a name and optional color. Returns the
    index of the layer requested. If the layer
    already exists, the color is updated and no new layer is created."""
    docLyrs = scriptcontext.doc.Layers
    layerIndex = docLyrs.Find(layerName, True)
    if layerIndex == -1:
        layerIndex = docLyrs.Add(layerName,layerColor)
    else: # it exists
        layer = docLyrs[layerIndex] # so get it
        if layer.Color != layerColor: # if it has a different color
            layer.Color = layerColor # reset the color
    return layerIndex

def layerAttributes(layerName, layerColor=System.Drawing.Color.Black):
    """Returns a Rhino ObjectAttributes object for a rhino layer with an optional color."""
    att = Rhino.DocObjects.ObjectAttributes()
    att.LayerIndex = addRhinoLayer(layerName, layerColor)
    return att

def deleteLayer(layerName, quiet=True):
    """Deletes a layer by Name. returns nothing."""
    layer_index = scriptcontext.doc.Layers.Find(layerName, True)
    settings = Rhino.DocObjects.ObjectEnumeratorSettings()
    settings.LayerIndexFilter = layer_index
    objs = scriptcontext.doc.Objects.FindByFilter(settings)
    ids = [obj.Id for obj in objs]
    scriptcontext.doc.Objects.Delete(ids, quiet)
    scriptcontext.doc.Layers.Delete(layer_index, quiet)

def bakeMany(listOfThings, objectAttributes=None):
    if not objectAttributes:
        objectAttributes = Rhino.DocObjects.ObjectAttributes()
    for thing in listOfThings:
        # move from specific to broad
        if isinstance(thing, Rhino.Geometry.Point3d):
            scriptcontext.doc.Objects.AddPoint(thing, objectAttributes)
        elif isinstance(thing, Rhino.Geometry.Point):
            scriptcontext.doc.Objects.AddPoint(thing.Location, objectAttributes)
        elif isinstance(thing, Rhino.Geometry.Curve):
            scriptcontext.doc.Objects.AddCurve(thing, objectAttributes)
        elif isinstance(thing, Rhino.Geometry.Surface):
            scriptcontext.doc.Objects.AddSurface(thing, objectAttributes)
        elif isinstance(thing, Rhino.Geometry.Brep):
            scriptcontext.doc.Objects.AddBrep(thing, objectAttributes)
        elif isinstance(thing, Rhino.Geometry.Mesh):
            scriptcontext.doc.Objects.AddSurface(thing, objectAttributes)
        elif isinstance(thing, Rhino.Geometry.Hatch):
            scriptcontext.doc.Objects.AddHatch(thing, objectAttributes)
        elif isinstance(thing, Rhino.Display.Text3d):
            scriptcontext.doc.Objects.AddText(thing, objectAttributes)
        else:
            print '''Unrecognized object type: %s''' % type(thing)

def deleteAll():
    """Deletes everything in the current Rhino scriptcontext.doc. Returns nothing."""
    guidList = []
    objType = Rhino.DocObjects.ObjectType.AnyObject
    objTable = scriptcontext.doc.Objects
    objs = objTable.GetObjectList(objType)
    for obj in objs:
        guidList.append(obj.Id)
    for guid in guidList:
        objTable.Delete(guid, True)

def exportFile(filePath,
        version=4,
        geomOnly=False,
        selectedOnly=False,
        ):
    '''Export a file.'''
    opt = FileWriteOptions()
    opt.FileVersion = version
    opt.WriteGeometryOnly = geomOnly
    opt.WriteSelectedObjectsOnly = selectedOnly
    return scriptcontext.doc.WriteFile(filePath, opt)

def exportLayers(layerNames, filePath, version=4):
    '''Export only the items on designated layers to a file.'''
    # save selection
    oldSelection = rs.SelectedObjects()
    # clear selection
    rs.UnselectAllObjects()
    # add everything on the layers to selection
    for name in layerNames:
        objs = scriptcontext.doc.Objects.FindByLayer(name)
        guids = [obj.Id for obj in objs]
        scriptcontext.doc.Objects.Select.Overloads[SCG.IEnumerable[System.Guid]](guids)
    # export selected items
    exportFile(filePath, version, selectedOnly=True)
    #clear selection
    rs.UnselectAllObjects()
    # restore selection
    if oldSelection:
        scriptcontext.doc.Objects.Select.Overloads[SCG.IEnumerable[System.Guid]](oldSelection)
    print 'exported %s' % filePath

# main script

if FilePath and DoExport and GeometryTree and LayerNames:
    numBranches = GeometryTree.BranchCount
    if numBranches == len(LayerNames):
        for i in range(GeometryTree.BranchCount):
            layer = LayerNames[i]
            if LayerColors and i < len(LayerColors):
                color = LayerColors[i]
            else:
                color = System.Drawing.Color.Black
            att = layerAttributes(layer, color)
            branchData = GeometryTree.Branch(i)
            bakeMany( branchData, att )
        exportLayers( LayerNames, FilePath )
        for lay in LayerNames:
            deleteLayer(lay)
    else:
        print '''Please ensure that there is one data tree branch
per layer name.'''
else:
    if DoExport:
        print '''Something is missing. Please make sure you input
a valid file path, a data tree of geometry (one branch per
layer), a list of layer names (one per branch), and that
you have entered 'True' into the 'DoExport' input.'''
# ---------- end python_5 ----------
panel_25 = Panel(python_5.out)
