# Grasshopper definition design_sketch_5 (MacBook's conflicted copy 2011-07-05).ghx (Grasshopper 0.8.11)

path = FilePath("C:\Users\demonchaux\Dropbox\localcode\site_ids.txt")
file = ReadFile(Path=path, Lines=True)
item = ListItem(List=file, Index=Slider(48, range=0..48), Wrap=False)
panel = Panel("""-site
-transportation
-drains
-water""")
panel_2 = Panel("""-terrain
-borders
-billboardpoints""")
concat = Concatenate(Start="C:\amigos\dump\", End=item)
panel_3 = Panel("""openchannels
gravitymains
lateraldrains
catchbasins
bikeways
drp_trails
hydrography""")
panel_4 = Panel("""foundbillboards-projected
geocodedbillboards-projected""")
concat_2 = Concatenate(Start=concat, End=panel_2)
panel_5 = Panel(file)
panel_6 = Panel("""freeways
metrobusstops-projected""")
concat_3 = Concatenate(Start=concat, End=panel)
panel_7 = Panel("""groundsurface
site-projected
parcel-projected""")
concat_4 = Concatenate(Start=concat_2, End=".3dm")
concat_5 = Concatenate(Start=concat_3, End=".3dm")
panel_8 = Panel(concat_5)
concat_6 = Concatenate(Start=panel_3, End="-projected")
panel_9 = Panel(concat_4)
merge = Merge(StreamA=panel_6, StreamB=concat_6)
python = PythonScript(FilePaths=concat_5, LayerNames=merge, DoImport=Toggle(True), GhMemory=0)  # -> out, layerTree, availableLayers; inputs FilePaths: list, LayerNames: list
# ---------- python: Python ----------
import Rhino


# for accesssing GH classes
import clr
clr.AddReference("Grasshopper")
from Grasshopper.Kernel.Data import GH_Path
from Grasshopper import DataTree


# read geometry out of 3dm files and filter by layernames
if DoImport and FilePaths and LayerNames:
    
    layerTree = DataTree[Rhino.Geometry.GeometryBase]() # make a DataTree
    availableLayers = []
    for filepath in FilePaths:
        model = Rhino.FileIO.File3dm.Read(filepath)
        for lay in model.Layers:
            availableLayers.append(lay.Name)
        if not model: continue
        for i, layer in enumerate(LayerNames):
            path = GH_Path(i)
            geometry = []
            objs = model.Objects.FindByLayer(layer)
            for obj in objs:
                geom = obj.Geometry
                geom.EnsurePrivateCopy()
                geometry.append(geom)
            layerTree.AddRange(geometry, path)
        
        # models can take up a considerable amount of
        # memory that we don't need, so get rid of it
        # after copying the geometry we want out of it
        model.Dispose()
# ---------- end python ----------
merge_2 = Merge(StreamA=panel_7, StreamB=panel_4)
python_2 = PythonScript(FilePaths=concat_4, LayerNames=merge_2, DoImport=Toggle(True), GhMemory=0)  # -> out, layerTree, availableLayers; inputs FilePaths: list, LayerNames: list; same code as python
bang = ExplodeTree(Tree=python.layerTree)  # -> Branch1, Branch2, Branch3, Branch4, Branch5, Branch6, Branch7, Branch8, Branch9, Branch10
bang_2 = ExplodeTree(Tree=python_2.layerTree)  # -> Branch0, Branch1, Branch2, Branch3, Branch4, Branch5, Branch6, Branch7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
panel_10 = Panel("""Default
hydrography
parcel
site
othersites
geocodedbillboards
roads
catchbasins
gravitymains
freeways
metrobusstops
stormdrains
censusblocks
lateraldrains
localnoncentralbus
openchannels
waterways
bikeways
rails
rapidbuslines
foundbillboards
streetlights
tin_pts
drp_trails
expressbuslines
waterbodies
raillines
localcentralbus
Default
rapidbuslines-projected
metrobusstops-projected
Default
gravitymains-projected
lateraldrains-projected
catchbasins-projected
Default""")
pt = Point(bang.Branch2)
merge_3 = Merge(StreamA=bang_2.Branch3, StreamB=bang_2.Branch4)
srf = Surface(bang_2.Branch0)
panel_11 = Panel(merge)
xy = XYPlane(Origin=Point(0, 0, 0))
flatten = FlattenTree(Data=merge_3, Path="{0}")

# ---- group: Storm Drains
merge_4 = MergeMultiple(Stream0=bang.Branch3, Stream1=bang.Branch4, Stream2=bang.Branch5, Stream3=bang.Branch6)
all_storm_drains = Curve(flatten(merge_4))
explode = Explode(Curve=all_storm_drains, Recursive=True)  # -> Segments, Vertices

# ----
viewer = ParamViewer(python_2.layerTree)
panel_12 = Panel(merge_2)
site_outline = Curve(bang_2.Branch1)
xy_2 = XYPlane(Origin=Point(0, 0, 0))
project = Project(Geometry=bang_2.Branch1, Plane=xy)  # -> Geometry, Transform
xy_3 = XYPlane(Origin=Point(0, 0, 0))
crv_cp = CurveCP(Point=pt, Curve=site_outline)  # -> Point, Parameter, Distance
parcels = Curve(bang_2.Branch2)
project_2 = Project(Geometry=bang_2.Branch1, Plane=xy_2)  # -> Geometry, Transform
fit = FitCrv(Curve=project.Geometry, Degree="1", Tolerance=Slider(0.462, range=0..1))
project_3 = Project(Geometry=site_outline, Plane=xy_3)  # -> Geometry, Transform
cset = CreateSet(List=crv_cp.Point)
slider = Slider(3, range=0..10)
crv = Curve(fit)
bus_stops_on_edges = Point(cset)
srfsplit = SurfaceSplit(Surface=bang_2.Branch0, Curves=site_outline)
dispatch = Dispatch(List=srfsplit, DispatchPattern=[True, False])  # -> ListA, ListB
srf_2 = Surface(dispatch.ListB)

# ---- group: Access Edges
explode_2 = Explode(Curve=bang_2.Branch2, Recursive=True)  # -> Segments, Vertices
explode_3 = Explode(Curve=bang_2.Branch1, Recursive=True)  # -> Segments, Vertices
cset_2 = CreateSet(List=flatten(explode_3.Vertices))
cset_3 = CreateSet(List=explode_2.Vertices)
mindex = MemberIndex(Set=cset_3, Member=cset_2)  # -> Index, Count
path_mapper = PathMapper(mindex.Index, source="{a;b;c;d}", target="{a;b}")
clean = CleanTree(Data=path_mapper, CleanInvalid=True, CleanEmpty=True)
lng = ListLength(List=clean)
viewer_2 = ParamViewer(clean)
sort = SortList(Keys=flatten(lng), ValuesA=viewer_2)  # -> List, ValuesA
rev = ReverseList(List=sort.ValuesA)
str = String(viewer_2)
item_2 = ListItem(List=rev, Index=0, Wrap=False)
cset_4 = CreateSet(List=str)
str_2 = String(item_2)
cset_5 = CreateSet(List=str_2)
difference = SetDifference(SetA=cset_4, SetB=cset_5)
branch = TreeBranch(Tree=explode_2.Segments, Path=difference)
cp = ControlPoints(Curve=explode_3.Segments)  # -> Points, Weights, Knots
cp_2 = ControlPoints(Curve=branch)  # -> Points, Weights, Knots
python_3 = PythonScript(siteSegments=cp.Points, otherSegments=cp_2.Points, tol=Slider(0.037, range=0..0.5), GhMemory=0)  # -> out, a; inputs siteSegments: tree, otherSegments: tree
# ---------- python_3: Python ----------
import Rhino
segmentSet = range(siteSegments.BranchCount)
out = []
for i in range(otherSegments.BranchCount):
    commonSegs = []
    thisSeg = list(otherSegments.Branch(i))
    for j in range(siteSegments.BranchCount):
        # now we have both segments
        trues = 0
        otherSeg = list(siteSegments.Branch(j))
        for otherPoint in otherSeg:
            for thisPoint in thisSeg:
                if otherPoint.DistanceTo(thisPoint) < tol:
                    trues += 1
        if trues == len(thisSeg) and j in segmentSet:
            segmentSet.remove(j)
        
a = segmentSet
# ---------- end python_3 ----------
item_3 = ListItem(List=explode_3.Segments, Index=python_3.a, Wrap=False)

# ----
panel_13 = Panel("""6
3
2""")
pi = Pi(Factor=1)
division = Division(A=pi, B=panel_13)
xy_4 = XYPlane(Origin=Point(0, 0, 0))
concat_7 = Concatenate(Start=concat, End="-grid")
rotate = Rotate(Geometry=xy_4, Angle=division, Plane=xy_4)  # -> Geometry, Transform
bbox = BoundingBox(Content=site_outline, Union=True, Plane=rotate.Geometry)  # -> Box, Box_2
pcomp = PlaneComponents(Plane=rotate.Geometry)  # -> Origin, XAxis, YAxis, ZAxis
concat_8 = Concatenate(Start=concat_7, End=".3dm")
distance_between_grid_points = Slider(9, range=0..10)
box = BoxComponents(Box=bbox.Box)  # -> Plane, X, Y, Z
panel_14 = Panel(concat_8)
domcomp = DomainComponents(Domain=box.X)  # -> Start, End
domcomp_2 = DomainComponents(Domain=box.Y)  # -> Start, End
amp = Amplitude(Vector=pcomp.XAxis, Amplitude=domcomp.Start)
amp_2 = Amplitude(Vector=pcomp.YAxis, Amplitude=domcomp_2.Start)
addition = Addition(A=amp, B=amp_2)
division_2 = Division(A=domcomp.End, B=distance_between_grid_points)
division_3 = Division(A=domcomp_2.End, B=distance_between_grid_points)
move = Move(Geometry=rotate.Geometry, Translation=addition)  # -> Geometry, Transform
f_x = F1(Function="ceiling(x)", X=division_2)
f_x_2 = F1(Function="ceiling(x)", X=division_3)
f_x_3 = F1(Function="(x*2)+1", X=f_x_2)
bang_3 = ExplodeTree(Tree=graft(move.Geometry))  # -> Branch0, Branch1, Branch2
f_x_4 = F1(Function="(x*2)+1", X=f_x)

# ---- group: Should it have a throoughfare? / If there is more than one?
join = JoinCurves(Curves=item_3, Preserve=False)
lng_2 = ListLength(List=join)
larger = LargerThan(FirstNumber=lng_2, SecondNumber="1")  # -> LargerThan, OrEqualTo

# ---- group: Should it have a throoughfare? / Does it wrap a corner?
panel_15 = Panel("""0
1""")
item_4 = ListItem(List=join, Index=0, Wrap=False)
eval = EvaluateCurve(Curve=reparameterize(item_4), Parameter=panel_15)  # -> Point, Tangent, Length
dispatch_2 = Dispatch(List=eval.Tangent, DispatchPattern=[True, False])  # -> ListA, ListB
angle = Angle(VectorA=dispatch_2.ListA, VectorB=dispatch_2.ListB)  # -> Angle, Reflex
pi_2 = Pi(Factor=Slider(0.3, range=0..1))
min = Minimum(A=angle.Angle, B=angle.Reflex)
f_x_y = F2(Function="abs(x)>y", X=min, Y=pi_2)

# ----
bang_4 = ExplodeTree(Tree=graft(f_x_4))  # -> Branch0, Branch1, Branch2
bang_5 = ExplodeTree(Tree=graft(f_x_3))  # -> Branch0, Branch1, Branch2
preview = CustomPreview(Geometry=item_3, Shader=ColourSwatch(SwatchColor=RGB(255, 178, 0)))
f_x_5 = F1(Function="ceiling(x*3^0.5) * 1.1", X=f_x_4)
f_x_6 = F1(Function="x*1.2", X=f_x_3)
sqgrid = Square(Plane=bang_3.Branch0, Size=distance_between_grid_points, ExtentX=bang_4.Branch0, ExtentY=bang_5.Branch0)  # -> Cells, Points
sqgrid_2 = Square(Plane=bang_3.Branch1, Size=distance_between_grid_points, ExtentX=bang_4.Branch1, ExtentY=bang_5.Branch1)  # -> Cells, Points
trigrid = Triangular(Plane=bang_3.Branch2, Size=distance_between_grid_points, ExtentX=f_x_5, ExtentY=f_x_6)  # -> Cells, Points
panel_16 = Panel("""0
1
2""")
explode_4 = Explode(Curve=trigrid.Cells, Recursive=True)  # -> Segments, Vertices
cset_6 = CreateSet(List=flatten(sqgrid.Points))
cset_7 = CreateSet(List=flatten(sqgrid_2.Points))
cset_8 = CreateSet(List=flatten(explode_4.Vertices))
bang_6 = ExplodeTree(Tree=graft(panel_16))  # -> Branch1, Branch2, Branch3
flat_site_outline = Curve(project_2.Geometry)

# ---- group: Should it have a throoughfare?
or = GateOr(A=larger.LargerThan, B=f_x_y)

# ----
flatten_2 = FlattenTree(Data=cset_6, Path=bang_6.Branch3)
flatten_3 = FlattenTree(Data=cset_7, Path=bang_6.Branch2)
flatten_4 = FlattenTree(Data=cset_8, Path=bang_6.Branch1)
billboards = Geometry(bang_2.Branch3)
m3 = Merge03(StreamA=flatten_4, StreamB=flatten_3, StreamC=flatten_2)
con = Containment(Point=m3, Curve=flat_site_outline)  # -> Relationship, Point
f_x_7 = F1(Function="x<2", X=con.Relationship)
dispatch_3 = Dispatch(List=m3, DispatchPattern=f_x_7)  # -> ListA, ListB
mesh = MeshBrep(
    Brep=dispatch.ListB,
    Settings={Refine=True, JaggedSeams=False, SimplePlanes=True, GridMinCount=16, GridMaxCount=0, Tolerance=0, RefineAngle=0, MinTolerance=0, RelativeTolerance=0.65, MinEdgeLength=0.0001, MaxEdgeLength=0})
Z = UnitZ(Factor=1)
wbedges = MeshEdges(Mesh=mesh)
projected_hydrography = Curve(bang.Branch9)

# ---- group: default value if null
panel_17 = Panel("10000.0")

# ----
meshray = MeshRay(Mesh=flatten(mesh), Point=dispatch_3.ListA, Direction=Z)  # -> Point, Hit
bikeways = Curve(bang.Branch7)
dispatch_4 = Dispatch(List=dispatch_3.ListA, DispatchPattern=meshray.Hit)  # -> ListA, ListB
trails = Curve(bang.Branch8)
grids_at_elevation = Point(meshray.Point)
interior_coincident_grids = Point(dispatch_4.ListA)
graft = GraftTree(Data=meshray.Point, Strip=False)
crv_cp_2 = CurveCP(Point=graft, Curve=flatten(projected_hydrography))  # -> Point, Parameter, Distance
sort_2 = SortList(Keys=crv_cp_2.Distance)  # -> List, ValuesA
crv_cp_3 = CurveCP(Point=graft, Curve=flatten(trails))  # -> Point, Parameter, Distance
crv_cp_4 = CurveCP(Point=graft, Curve=flatten(item_3))  # -> Point, Parameter, Distance
crv_cp_5 = CurveCP(Point=graft, Curve=flatten(bikeways))  # -> Point, Parameter, Distance
freeways = Curve(bang.Branch1)
item_5 = ListItem(List=sort_2.List, Index=0, Wrap=False)
clean_2 = CleanTree(Data=grids_at_elevation, CleanInvalid=True, CleanEmpty=False)
sort_3 = SortList(Keys=crv_cp_3.Distance)  # -> List, ValuesA
sort_4 = SortList(Keys=crv_cp_4.Distance)  # -> List, ValuesA
sort_5 = SortList(Keys=crv_cp_5.Distance)  # -> List, ValuesA
cp_3 = ClosestPoint(Point=graft, Set=flatten(pt))  # -> ClosestPoint, CPIndex, Distance
crv_cp_6 = CurveCP(Point=graft, Curve=flatten(freeways))  # -> Point, Parameter, Distance
item_6 = ListItem(List=sort_3.List, Index=0, Wrap=False)
item_7 = ListItem(List=sort_4.List, Index=0, Wrap=False)
item_8 = ListItem(List=sort_5.List, Index=0, Wrap=False)
sort_6 = SortList(Keys=crv_cp_6.Distance)  # -> List, ValuesA
bang_7 = ExplodeTree(Tree=clean_2)  # -> Branch1, Branch2, Branch3
cp_4 = ClosestPoint(Point=graft, Set=flatten(explode.Vertices))  # -> ClosestPoint, CPIndex, Distance
item_9 = ListItem(List=sort_6.List, Index=0, Wrap=False)

num = Number(item_8)
python_4 = PythonScript(value=num, defaultValue=panel_17, GhMemory=0)  # -> out, a
# ---------- python_4: Python ----------
if not value:
    a = defaultValue
else:
    a = value
# ---------- end python_4 ----------
path_mapper_2 = PathMapper(python_4.a, source="{A;B;C;D}", target="{A}")

num_2 = Number(item_5)
python_5 = PythonScript(value=num_2, defaultValue=panel_17, GhMemory=0)  # -> out, a; same code as python_4
path_mapper_3 = PathMapper(python_5.a, source="{A;B;C;D}", target="{A}")

num_3 = Number(item_7)
python_6 = PythonScript(value=num_3, defaultValue=panel_17, GhMemory=0)  # -> out, a; same code as python_4
path_mapper_4 = PathMapper(python_6.a, source="{A;B;C;D}", target="{A}")

num_4 = Number(cp_4.Distance)
python_7 = PythonScript(value=num_4, defaultValue=panel_17, GhMemory=0)  # -> out, a; same code as python_4
path_mapper_5 = PathMapper(python_7.a, source="{A;B;C}", target="{A}")

num_5 = Number(item_6)
python_8 = PythonScript(value=num_5, defaultValue=panel_17, GhMemory=0)  # -> out, a; same code as python_4
path_mapper_6 = PathMapper(python_8.a, source="{A;B;C;D}", target="{A}")

num_6 = Number(cp_3.Distance)
python_9 = PythonScript(value=num_6, defaultValue=panel_17, GhMemory=0)  # -> out, a; same code as python_4
path_mapper_7 = PathMapper(python_9.a, source="{A;B;C}", target="{A}")

cp_5 = ClosestPoint(Point=graft, Set=flatten)  # -> ClosestPoint, CPIndex, Distance

num_7 = Number(item_9)
python_10 = PythonScript(value=num_7, defaultValue=panel_17, GhMemory=0)  # -> out, a; same code as python_4
path_mapper_8 = PathMapper(python_10.a, source="{A;B;C;D}", target="{A}")

num_8 = Number(cp_5.Distance)
python_11 = PythonScript(value=num_8, defaultValue=panel_17, GhMemory=0)  # -> out, a; same code as python_4
path_mapper_9 = PathMapper(python_11.a, source="{A;B;C}", target="{A}")

swatch = ColourSwatch(SwatchColor=RGB(0, 0, 0))
swatch_2 = ColourSwatch(SwatchColor=RGB(255, 255, 0))
preview_2 = CustomPreview(Geometry=billboards, Shader=swatch)
preview_3 = CustomPreview(Geometry=bang_7.Branch1, Shader=swatch)
preview_4 = CustomPreview(Geometry=bang_7.Branch2, Shader=ColourSwatch(SwatchColor=RGB(255, 0, 157)))
preview_5 = CustomPreview(Geometry=bang_7.Branch3, Shader=ColourSwatch(SwatchColor=RGB(0, 255, 255)))

# ---- group: HydrographyDistance
hydrography_distance = Number(path_mapper_3)

# ---- group: Billboard Distance
billboard_distance = Number(path_mapper_9)

# ---- group: Freeway Distance
freeway_distance = Number(path_mapper_8)

# ---- group: Bus Stop Distance
bus_stop_rating = Number(path_mapper_7)

# ----
storm_drain_distance = Number(path_mapper_5)
bikeway_distance = Number(path_mapper_2)

# ---- group: Trials Distance
trails_distance = Number(path_mapper_6)

# ----
access_distance = Number(path_mapper_4)
panel_18 = Panel(bus_stop_rating)
dispatch_5 = Dispatch(DispatchPattern=[True, False])  # -> ListA, ListB
Z_2 = UnitZ(Factor=1)
line = LineSDL(Start=dispatch_5.ListA, Direction=Z_2, Length=1)
scx = SurfaceLine(Line=line, Limit=True)  # -> Curves, Points, UVPoints, Normal
wild = Slider(0.146, range=0..1)
hard = Slider(0.542, range=0..1)
z = Slider(0.325, range=0..1)
base = Slider(0.325, range=0..1)
axes = Slider(0.863, range=0..1)
green = Slider(0.25, range=0..1)
ln = Line(PointA=dispatch_5.ListA, PointB=scx.Points)
num_9 = Number([green, wild, hard])
num_10 = Number([z, base, axes])
path_mapper_10 = PathMapper(dispatch_5.ListA, source="{a;b}", target="{1;a;b}")
path_mapper_11 = PathMapper(scx.Points, source="{a;b}", target="{0;a;b}")
path_mapper_12 = PathMapper(ln, source="{a;b}", target="{2;a;b}")
hsl = ColourHSL(Alpha=1, Hue=num_9, Saturation=1, Luminance=num_10, DataComparison="cross_reference")
m3_2 = Merge03(StreamA=path_mapper_11, StreamB=path_mapper_10, StreamC=path_mapper_12)
preview_6 = CustomPreview(Geometry=m3_2, Shader=graft(hsl))
viewer_3 = ParamViewer(m3_2)
python_12 = PythonScript(FilePath=panel_14, LayerColors=hsl, GeometryTree=m3_2, DoExport=Toggle(False), GhMemory=10)  # -> out, a; inputs FilePath: String, LayerNames: list of String, LayerColors: list of Color, GeometryTree: tree of GeometryBase, DoExport: Boolean
# ---------- python_12: Python ----------
import System
import System.Collections.Generic as SCG
import Rhino
import scriptcontext

import rhinoscriptsyntax as rs
from Rhino.FileIO import FileWriteOptions, FileReadOptions

def addRhinoLayer(layerName, layerColor=System.Drawing.Color.Black):
    """Creates a Layer in Rhino using a name and optional color. Returns the
    index of the layer requested. If the layer
    already exists, the color is updated and no new layer is created."""
    docLyrs = scriptcontext.doc.Layers
    layerIndex = docLyrs.Find(layerName, True)
    if layerIndex == -1:
        layerIndex = docLyrs.Add(layerName,layerColor)
    else: # it exists
        layer = docLyrs[layerIndex] # so get it
        if layer.Color != layerColor: # if it has a different color
            layer.Color = layerColor # reset the color
    return layerIndex

def layerAttributes(layerName, layerColor=System.Drawing.Color.Black):
    """Returns a Rhino ObjectAttributes object for a rhino layer with an optional color."""
    att = Rhino.DocObjects.ObjectAttributes()
    att.LayerIndex = addRhinoLayer(layerName, layerColor)
    return att

def deleteLayer(layerName, quiet=True):
    """Deletes a layer by Name. returns nothing."""
    layer_index = scriptcontext.doc.Layers.Find(layerName, True)
    settings = Rhino.DocObjects.ObjectEnumeratorSettings()
    settings.LayerIndexFilter = layer_index
    objs = scriptcontext.doc.Objects.FindByFilter(settings)
    ids = [obj.Id for obj in objs]
    scriptcontext.doc.Objects.Delete(ids, quiet)
    scriptcontext.doc.Layers.Delete(layer_index, quiet)

def bakeMany(listOfThings, objectAttributes=None):
    if not objectAttributes:
        objectAttributes = Rhino.DocObjects.ObjectAttributes()
    for thing in listOfThings:
        # move from specific to broad
        if isinstance(thing, Rhino.Geometry.Point3d):
            scriptcontext.doc.Objects.AddPoint(thing, objectAttributes)
        elif isinstance(thing, Rhino.Geometry.Point):
            scriptcontext.doc.Objects.AddPoint(thing.Location, objectAttributes)
        elif isinstance(thing, Rhino.Geometry.Curve):
            scriptcontext.doc.Objects.AddCurve(thing, objectAttributes)
        elif isinstance(thing, Rhino.Geometry.Surface):
            scriptcontext.doc.Objects.AddSurface(thing, objectAttributes)
        elif isinstance(thing, Rhino.Geometry.Brep):
            scriptcontext.doc.Objects.AddBrep(thing, objectAttributes)
        elif isinstance(thing, Rhino.Geometry.Mesh):
            scriptcontext.doc.Objects.AddSurface(thing, objectAttributes)
        elif isinstance(thing, Rhino.Geometry.Hatch):
            scriptcontext.doc.Objects.AddHatch(thing, objectAttributes)
        elif isinstance(thing, Rhino.Display.Text3d):
            scriptcontext.doc.Objects.AddText(thing, objectAttributes)
        else:
            print '''Unrecognized object type: %s''' % type(thing)

def deleteAll():
    """Deletes everything in the current Rhino scriptcontext.doc. Returns nothing."""
    guidList = []
    objType = Rhino.DocObjects.ObjectType.AnyObject
    objTable = scriptcontext.doc.Objects
    objs = objTable.GetObjectList(objType)
    for obj in objs:
        guidList.append(obj.Id)
    for guid in guidList:
        objTable.Delete(guid, True)

def exportFile(filePath,
        version=4,
        geomOnly=False,
        selectedOnly=False,
        ):
    '''Export a file.'''
    opt = FileWriteOptions()
    opt.FileVersion = version
    opt.WriteGeometryOnly = geomOnly
    opt.WriteSelectedObjectsOnly = selectedOnly
    return scriptcontext.doc.WriteFile(filePath, opt)

def exportLayers(layerNames, filePath, version=4):
    '''Export only the items on designated layers to a file.'''
    # save selection
    oldSelection = rs.SelectedObjects()
    # clear selection
    rs.UnselectAllObjects()
    # add everything on the layers to selection
    for name in layerNames:
        objs = scriptcontext.doc.Objects.FindByLayer(name)
        guids = [obj.Id for obj in objs]
        scriptcontext.doc.Objects.Select.Overloads[SCG.IEnumerable[System.Guid]](guids)
    # export selected items
    exportFile(filePath, version, selectedOnly=True)
    #clear selection
    rs.UnselectAllObjects()
    # restore selection
    if oldSelection:
        scriptcontext.doc.Objects.Select.Overloads[SCG.IEnumerable[System.Guid]](oldSelection)
    print 'exported %s' % filePath

# main script

if FilePath and DoExport and GeometryTree and LayerNames:
    numBranches = GeometryTree.BranchCount
    if numBranches == len(LayerNames):
        for i in range(GeometryTree.BranchCount):
            layer = LayerNames[i]
            if LayerColors and i < len(LayerColors):
                color = LayerColors[i]
            else:
                color = System.Drawing.Color.Black
            att = layerAttributes(layer, color)
            branchData = GeometryTree.Branch(i)
            bakeMany( branchData, att )
        exportLayers( LayerNames, FilePath )
        for lay in LayerNames:
            deleteLayer(lay)
    else:
        print '''Please ensure that there is one data tree branch
per layer name.'''
else:
    if DoExport:
        print '''Something is missing. Please make sure you input
a valid file path, a data tree of geometry (one branch per
layer), a list of layer names (one per branch), and that
you have entered 'True' into the 'DoExport' input.'''
# ---------- end python_12 ----------
panel_19 = Panel(python_12.out)
plant_grid = Point(bang_7.Branch2)

# ----
# Lowest Point or Drains
circle = Circle(bang.Branch6)
pt_2 = Point(circle)
xy_5 = XYPlane(Origin=Point(0, 0, 0))
project_4 = Project(Geometry=pt_2, Plane=xy_5)  # -> Geometry, Transform
con_2 = Containment(Point=project_4.Geometry, Curve=project.Geometry)  # -> Relationship, Point
f_x_8 = F1(Function="x<2", X=con_2.Relationship)
pcomp_2 = Decompose(Point=plant_grid)  # -> XComponent, YComponent, ZComponent
dispatch_6 = Dispatch(List=pt_2, DispatchPattern=f_x_8)  # -> ListA, ListB
sort_7 = SortList(Keys=pcomp_2.ZComponent, ValuesA=plant_grid)  # -> List, ValuesA
null = NullItem(Items=dispatch_6.ListA)  # -> NullFlags, InvalidFlags
lng_3 = ListLength(List=dispatch_6.ListA)
not = GateNot(A=null.NullFlags)
item_10 = ListItem(List=sort_7.ValuesA, Index=0, Wrap=False)
and = GateAnd(A=lng_3, B=not)
weave = Weave(Pattern=and, Stream0=item_10, Stream1=dispatch_6.ListA, NullGaps=False)
lowest_point_or_drains = Point(weave)

hard_grid = Point(bang_7.Branch1)
pt_3 = PointXYZ(XComponent=0, YComponent=0, ZComponent=0)
pcomp_3 = Decompose(Point=plant_grid)  # -> XComponent, YComponent, ZComponent
X = UnitX(Factor=1)
area = BrepArea(Brep=crv)  # -> Area, Centroid
approximate_site_area = Number(area.Area)
sqrt = SquareRoot(Input=approximate_site_area)
multiplication = Multiplication(A=sqrt, B=Slider(0.202, range=0..1))
amp_3 = Amplitude(Vector=X, Amplitude=multiplication)
line_2 = LineSDL(Start=pt_3, Direction=amp_3, Length=amp_3)
crv_2 = Curve(bang_2.Branch1)
approximate_site_area_2 = Number(area.Area)
slider_2 = Slider(5, range=0..10)
slider_3 = Slider(0.9, range=0..1000)
len = Length(Curve=crv_2)
division_4 = Division(A=approximate_site_area_2, B=len)
remap = RemapNumbers(Source=Domain(0, 1), Target=Domain(0, 1))
division_5 = Division(A=division_4, B=Slider(14.5, range=0..20))
hard_grid_score = Number(remap)
panel_20 = Panel(division_5)
div = DivideDomain(Domain=crv_2, Count=division_5)
subcrv = SubCurve(BaseCurve=crv_2, Domain=div)
panel_21 = Panel(weave)
curvepoint = PointOnCurve(subcrv, parameter=0.5)
minimum_branch_length = Slider(26.6, range=0..50)
ln_2 = Line(PointA=weave, PointB=curvepoint)
sqrt_2 = SquareRoot(Input=approximate_site_area_2)
len_2 = Length(Curve=ln_2)
bnd = Bounds(Numbers=pcomp_3.ZComponent)
f_x_y_2 = F2(Function="x>y", X=len_2, Y=minimum_branch_length)
multiplication_2 = Multiplication(A=sqrt_2, B=Slider(0.12, range=0..1))
drain_drop = Slider(0.5, range=0..1)
dispatch_7 = Dispatch(List=ln_2, DispatchPattern=f_x_y_2)  # -> ListA, ListB
multiplication_3 = Multiplication(A=multiplication_2, B=-1)
domcomp_3 = DomainComponents(Domain=bnd)  # -> Start, End
panel_22 = Panel(multiplication_3)
ext = Extend(Curve=dispatch_7.ListA, Type=0, Start=0, End=multiplication_3)
subtraction = Subtraction(A=domcomp_3.Start, B=drain_drop)
crv_3 = Curve(ext)
end = EndPoints(Curve=crv_3)  # -> Start, End
total_site_height_interval_raw = Domain(bnd)
dom = Domain(DomainStart=subtraction, DomainEnd=domcomp_3.End)
srf_cp = SurfaceCP(Point=end.End, Surface=srf_2)  # -> Point, UVPoint, Distance
pt_4 = Point(srf_cp.Point)
python_13 = PythonScript(startPoint=pt_4, terrainSurface=dispatch.ListB, stepSize=Slider(1, range=0..10), tol=Slider(0.1, range=0..1), GhMemory=0)  # -> out, a; inputs startPoint: Point3d, terrainSurface: Surface, stepSize: Double, maxSteps: Int32, tol: Double
# ---------- python_13: Python ----------
import Rhino



class DrainBoid(object):
    def __init__(self, point3d, surface, stepsize=0.5, maxsteps=None, tolerance=0.001):
        self.start = point3d
        self.pos = self.start
        result, self.u, self.v = surface.ClosestPoint(self.pos)
        self.surface = surface
        self.stepsize = stepsize
        self.points = [self.start]
        self.state = 'on'
        self.tolerance = tolerance
        self.maxsteps = maxsteps

    def makeDrainCurve(self):
        i = 0
        while self.state == 'on':
            i += 1
            if self.maxsteps:
                if i >= self.maxsteps:
                    self.state = 'finished'
            self.nextStep()
        return Rhino.Geometry.Curve.CreateControlPointCurve(self.points, 1)

    def nextStep(self):
        result, newFrame = self.surface.FrameAt(self.u, self.v)
        # create a vector from newFrame XAxis
        downVect = newFrame.XAxis
        # figure out hw far to rotate it.
        deltaAngle = Rhino.Geometry.Vector3d.VectorAngle( downVect, Rhino.Geometry.Vector3d(0.0, 0.0, -1.0), newFrame )
        # rotate it in the plane
        downVect.Rotate( deltaAngle, newFrame.ZAxis)
        # set the length
        downVect = downVect.Multiply( self.stepsize, downVect )
        spacePoint = Rhino.Geometry.Point3d.Add(self.pos, downVect)
        result, self.u, self.v = self.surface.ClosestPoint(spacePoint)
        out, newPoint, vects = self.surface.Evaluate(self.u, self.v, 0)
        if newPoint.Z >= self.pos.Z: # if higher
            self.state = 'finished'
        elif not self.checkTolerance(newPoint): # if too close
            self.state = 'finished'
        else:
            self.updatePos( newPoint )

    def updatePos(self, newPoint):
        self.points.append(newPoint)
        self.pos = newPoint

    def checkTolerance(self, other):
        # checks against another point
        # if it is outside of tolerance, returns True
        return self.pos.DistanceTo( other ) > self.tolerance


b = DrainBoid(startPoint, terrainSurface, stepSize, maxSteps, tol)
a = b.makeDrainCurve()
# ---------- end python_13 ----------
crv_4 = Curve(python_13.a)
lng_4 = ListLength(List=crv_4)
series = Series(Start=0, Step=1, Count=lng_4)
crv_cp_7 = CurveCP(Point=graft(plant_grid), Curve=flatten(crv_4))  # -> Point, Parameter, Distance
sort_8 = SortList(Keys=crv_cp_7.Distance, ValuesA=flatten(series))  # -> List, ValuesA
sort_9 = SortList(Keys=crv_cp_7.Distance, ValuesA=crv_cp_7.Parameter)  # -> List, ValuesA
item_11 = ListItem(List=sort_8.ValuesA, Index=0, Wrap=False)
item_12 = ListItem(List=sort_9.ValuesA, Index=0, Wrap=False)
item_13 = ListItem(List=sort_9.List, Index=0, Wrap=False)
graft_2 = GraftTree(Data=flatten(plant_grid), Strip=False)
panel_23 = Panel("""0
1
2""")
weave_2 = Weave(Pattern=panel_23, Stream0=item_13, Stream1=item_11, Stream2=item_12, NullGaps=False)
panel_24 = Panel(item_11)
flip = FlipMatrix(Data=weave_2)
bang_8 = ExplodeTree(Tree=flip)  # -> Branch1, Branch2, Branch3
viewer_4 = ParamViewer(graft_2)
curve_number = Integer(bang_8.Branch2)
graft_3 = GraftTree(Data=flatten(bang_8.Branch1), Strip=False)
viewer_5 = ParamViewer(graft_3)
replace = ReplaceBranches(Data=graft_2, Search=viewer_4, Replace=curve_number)
replace_2 = ReplaceBranches(Data=graft_3, Search=viewer_5, Replace=curve_number)

# ----
# Canopies
xy_6 = XYPlane(Origin=Point(0, 0, 0))
project_5 = Project(Geometry=flatten, Plane=xy_6)  # -> Geometry, Transform
con_3 = Containment(Point=project_5.Geometry, Curve=project.Geometry)  # -> Relationship, Point
billboard_points = Point(flatten)
f_x_9 = F1(Function="x<2", X=con_3.Relationship)
dispatch_8 = Dispatch(List=billboard_points, DispatchPattern=f_x_9)  # -> ListA, ListB
billboard_radius = Slider(1.5, range=0.5..10)
area_2 = BrepArea(Brep=crv)  # -> Area, Centroid
points_for_canopies = Point(dispatch_8.ListA)
hardscape_grid = Point(bang_7.Branch1)
rough_site_area = Number(area_2.Area)
max_canopy_radius = Slider(36, range=0..100)
cir = Circle(Plane=points_for_canopies, Radius=billboard_radius)
sqrt_3 = SquareRoot(Input=rough_site_area)
multiplication_4 = Multiplication(A=sqrt_3, B=Slider(0.338, range=0..1))
min_2 = Minimum(A=multiplication_4, B=max_canopy_radius)
vec2pt = Vector2Pt(PointA=cir, PointB=hardscape_grid, Unitize=False)  # -> Vector, Length
panel_25 = Panel(multiplication_4)
f_x_y_3 = F2(Function="x<y", X=vec2pt.Length, Y=min_2)
pie = PieChart(f_x_y_3)
dispatch_9 = Dispatch(List=hardscape_grid, DispatchPattern=f_x_y_3)  # -> ListA, ListB
crv_cp_8 = CurveCP(Point=dispatch_9.ListA, Curve=cir)  # -> Point, Parameter, Distance
python_14 = PythonScript(points=crv_cp_8.Point, tolerance=Slider(1, range=0..1), GhMemory=0)  # -> out, a; inputs points: list of Point3d, tolerance: Double
# ---------- python_14: Python ----------
import Rhino

a = Rhino.Geometry.Point3d.CullDuplicates( points, tolerance )
# ---------- end python_14 ----------
panel_26 = Panel(python_14.a)
crv_cp_9 = CurveCP(Point=python_14.a, Curve=cir)  # -> Point, Parameter, Distance
canopy_max = Slider(5, range=0..10)
canopy_min = Slider(2.3, range=0..10)
lng_5 = ListLength(List=dispatch_9.ListA)
random_seed = Slider(256, range=0..1000)
sort_10 = SortList(Keys=crv_cp_9.Parameter, ValuesA=crv_cp_9.Point)  # -> List, ValuesA
dom_2 = Domain(DomainStart=canopy_min, DomainEnd=canopy_max)
f_x_10 = F1(Function="ceiling(x)", X=lng_5)
dup = DuplicateData(Data=[canopy_min, canopy_max], Number=f_x_10, Order=True)
lng_6 = ListLength(List=sort_10.ValuesA)
split = SplitList(List=dup, Index=lng_6)  # -> ListA, ListB
Z_3 = UnitZ(Factor=split.ListA)
random = Random(Range=dom_2, Number=lng_5, Seed=random_seed, Integers=False)
Z_4 = UnitZ(Factor=random)
move_2 = Move(Geometry=sort_10.ValuesA, Translation=Z_3)  # -> Geometry, Transform
move_3 = Move(Geometry=dispatch_9.ListA, Translation=Z_4)  # -> Geometry, Transform
weave_3 = Weave(Pattern=[0, 1], Stream0=flatten(move_3.Geometry), Stream1=flatten(move_2.Geometry), NullGaps=False)
xy_7 = XYPlane(Origin=Point(0, 0, 0))
cset_9 = CreateSet(List=weave_3)
del = DelaunayMesh(Points=cset_9, Plane=xy_7)
wbedges_2 = MeshEdges(Mesh=del)
canopy_points = Point(points_for_canopies)
canopy_mesh = Mesh(del)
wbedges_3 = MeshEdges(Mesh=canopy_mesh)

drain_point = Point(weave)
distance = Number(replace_2)

# ----
# Drain Network Topology
drain_point_distance = Slider(5.5, range=0..50)
graft_4 = GraftTree(Data=flatten(bang_8.Branch3), Strip=False)
viewer_6 = ParamViewer(graft_4)
replace_3 = ReplaceBranches(Data=graft_4, Search=viewer_6, Replace=curve_number)
f_x_y_4 = F2(Function="x<y", X=distance, Y=drain_point_distance)
dispatch_10 = Dispatch(List=replace, DispatchPattern=f_x_y_4)  # -> ListA, ListB
dispatch_11 = Dispatch(List=replace_3, DispatchPattern=f_x_y_4)  # -> ListA, ListB
points = Point(dispatch_10.ListA)
parameter_value = Number(dispatch_11.ListA)
sort_11 = SortList(Keys=parameter_value, ValuesA=points)  # -> List, ValuesA

lng_7 = ListLength(List=hardscape_grid)
series_2 = Series(Start=0, Step=1, Count=lng_7)
dispatch_12 = Dispatch(List=series_2, DispatchPattern=f_x_y_3)  # -> ListA, ListB
indices_of_points_used_under_canopy = Integer(dispatch_12.ListA)
drain_point_2 = Point(drain_point)
pt_5 = Point(dispatch_9.ListA)

# ----
# Drainage Area Blobs
drain_point_distance_2 = Slider(23.5, range=0..50)
dom_3 = Domain(DomainStart=Slider(0, range=0..1), DomainEnd=drain_point_distance_2)
remap_2 = RemapNumbers(Values=distance, Source=dom_3, Target=Domain(0, 1))
drain_point_distance_3 = Slider(18.9, range=0..50)
xy_8 = XYPlane(Origin=Point(0, 0, 0))
graph = GraphMapper(
    remap_2,
    x0=0,
    x1=1,
    y0=0,
    y1=1,
    container_name="Bezier",
    cpx=[0, 0.2826865315, 0.02149499021, 1],
    cpy=[1, 0.004953068681, 0, 0])
project_6 = Project(Geometry=replace, Plane=xy_8)  # -> Geometry, Transform
division_6 = Division(A=drain_point_distance_2, B=drain_point_distance_3)
remap_3 = RemapNumbers(Values=graph, Source=Domain(0, 1), Target=dom_3)
pcomp_4 = Decompose(Point=drain_point)  # -> XComponent, YComponent, ZComponent
panel_27 = Panel(remap_3)
metaball_t = MetaBallTCustom(
    Points=flatten(project_6.Geometry),
    Charge=flatten(remap_3),
    Plane=PlaneXY(0, 0, 0),
    Threshold=division_6,
    Accuracy=Slider(0.502, range=0..1))
Z_5 = UnitZ(Factor=pcomp_4.ZComponent)
move_4 = Move(Geometry=metaball_t, Translation=Z_5)  # -> Geometry, Transform

# ----
# Graded Terran Mesh
distances_from_each_grid_point_to_closes = Number(distance)  # "Distances From each Grid Point to Closest Drainage Path"
grid_points_organized_by_closest_drain_p = Point(replace)  # "grid points organized by closest drain path"
drain_line_points = Point(sort_11.ValuesA)
drain_drop_2 = Number(drain_drop)
lowest_grid_z_minus_drain_drop = Number(subtraction)
cp_6 = ClosestPoint(Point=grid_points_organized_by_closest_drain_p, Set=drain_line_points)  # -> ClosestPoint, CPIndex, Distance
pcomp_5 = Decompose(Point=drain_line_points)  # -> XComponent, YComponent, ZComponent
pcomp_6 = Decompose(Point=grid_points_organized_by_closest_drain_p)  # -> XComponent, YComponent, ZComponent
bnd_2 = Bounds(Numbers=cp_6.Distance)
subtraction_2 = Subtraction(A=pcomp_5.ZComponent, B=drain_drop_2)
remap_4 = RemapNumbers(Values=cp_6.Distance, Source=bnd_2, Target=Domain(0, 1))
item_14 = ListItem(List=subtraction_2, Index=cp_6.CPIndex, Wrap=False)
panel_28 = Panel(bnd_2)
graph_2 = GraphMapper(
    remap_4,
    x0=0,
    x1=1,
    y0=0,
    y1=1,
    container_name="Bezier",
    cpx=[0, 0.2115956247, 0.04927394539, 1],
    cpy=[0, 0, 0.9927536249, 1])
pt_6 = PointXYZ(XComponent=pcomp_5.XComponent, YComponent=pcomp_5.YComponent, ZComponent=subtraction_2)
dropped_z_of_closest_drain_path_point = Number(item_14)
bnd_3 = Bounds(Numbers=graph_2)
dom_4 = Domain(DomainStart=dropped_z_of_closest_drain_path_point, DomainEnd=pcomp_6.ZComponent)
remap_5 = RemapNumbers(Values=graph_2, Source=Domain(0, 1), Target=dom_4)
pt_7 = PointXYZ(XComponent=pcomp_6.XComponent, YComponent=pcomp_6.YComponent, ZComponent=remap_5)
cyl = Cylinder(Base=flatten(pt_7), Radius=Slider(1, range=0..1), Length=1)
del_2 = DelaunayMesh(Points=flatten(pt_7), Plane=PlaneXY(0, 0, 0))
cap = CapHoles(Brep=cyl)
bnd_4 = Bounds(Numbers=flatten(remap_5))
dom_5 = Domain(DomainStart=Slider(0.666, range=0..1), DomainEnd=Slider(0, range=0..1))
wbedges_4 = MeshEdges(Mesh=del_2)
preview_7 = CustomPreview(Geometry=del_2, Shader=ColourSwatch(SwatchColor=RGB(209, 209, 209)))
explode_5 = BrepComponents(Brep=cap)  # -> Faces, Edges, Vertices
dom_6 = Domain(DomainStart=Slider(0.34, range=0..1), DomainEnd=Slider(0, range=0..1))
remap_6 = RemapNumbers(Values=flatten(remap_5), Source=bnd_4, Target=dom_5)
dom_7 = Domain(DomainStart=Slider(0.238, range=0..1), DomainEnd=Slider(1, range=0..1))
preview_8 = CustomPreview(Geometry=wbedges_4, Shader=ColourSwatch(SwatchColor=RGB(217, 217, 217)))
remap_7 = RemapNumbers(Values=flatten(remap_5), Source=bnd_4, Target=dom_6)
item_15 = ListItem(List=explode_5.Faces, Index=Slider(0, range=0..10), Wrap=False)
remap_8 = RemapNumbers(Values=flatten(remap_5), Source=bnd_4, Target=dom_7)
cmyk = ColourCMYK(Cyan=remap_6, Magenta=remap_7, Yellow=remap_8, Key=0)
preview_9 = CustomPreview(Geometry=flatten(item_15), Shader=cmyk)

Z_6 = UnitZ(Factor=1)
project_7 = Project(Curve=metaball_t, Brep=srf_2, Direction=Z_6)
preview_10 = CustomPreview(Geometry=project_7, Shader=ColourSwatch(SwatchColor=RGB(0, 175, 0)))

# ----
# Drain Network Curves
cset_10 = CreateSet(List=drain_point)
item_16 = ListItem(List=sort_11.ValuesA, Index=0, Wrap=False)
cset_11 = CreateSet(List=flatten(item_16))
pline = PolyLine(Vertices=sort_11.ValuesA, Closed=False)
fsim = FindSimilarMember(Data=cset_10, Set=flatten(cset_11))  # -> Hit, Index
item_17 = ListItem(List=flatten(pline), Index=fsim.Index, Wrap=False)
cull_i = CullIndex(List=cset_11, Indices=fsim.Index, Wrap=False)
crv_cp_10 = CurveCP(Point=graft(cull_i), Curve=item_17)  # -> Point, Parameter, Distance
lng_8 = ListLength(List=flatten(pline))
ln_3 = Line(PointA=crv_cp_10.Point, PointB=graft(cull_i))
cull_i_2 = CullIndex(List=flatten(pline), Indices=fsim.Index, Wrap=False)
f_x_11 = F1(Function="x>1", X=lng_8)
weave_4 = Weave(Pattern=[0, 1], Stream0=ln_3, Stream1=graft(cull_i_2), NullGaps=False)
lng_9 = ListLength(List=cull_i_2)
join_2 = JoinCurves(Curves=weave_4, Preserve=False)
weave_5 = Weave(Pattern=[0, 1], Stream0=item_17, Stream1=flatten(join_2), NullGaps=False)
python_15 = PythonScript(x=flatten(weave_5), GhMemory=0)  # -> out, a
# ---------- python_15: Python ----------
if x:
    a = x
else:
    a = y
# ---------- end python_15 ----------
weave_6 = Weave(Pattern=f_x_11, Stream0=flatten(pline), Stream1=python_15.a, NullGaps=False)
drain_network_curves = Curve(weave_6)

crv_5 = Curve(python_15.a)

preview_11 = CustomPreview(Geometry=crv_5, Shader=ColourSwatch(SwatchColor=RGB(0, 0, 255)))
