# Grasshopper definition drain arrows.ghx (Grasshopper 0.8.11)

path = FilePath("C:\Users\demonchaux\Dropbox\localcode\site_ids.txt")
file = ReadFile(Path=path, Lines=True)
item = ListItem(List=file, Index=Slider(48, range=0..48), Wrap=False)
str = String(item)
panel = Panel("""drainpoint
draincurves
terrainmesh
plantgrid
drainpoint""")
concat = Concatenate(Start="/amigos/db/", End=str)
concat_2 = Concatenate(Start=concat, End=panel)
python = PythonScript(path=concat_2, read=Toggle(True), GhMemory=0)  # -> out, a; inputs path: String, read: Boolean
# ---------- python: Python ----------
import cPickle as pickle

if path and read:
    try:
        f = open(path, 'rb')
        a = pickle.load(f)
        f.close()
    except:
        print 'problem loading %s\nfile may not exist' % path
# ---------- end python ----------
bang = ExplodeTree(Tree=python.a)  # -> Branch1, Branch2, Branch3, Branch4, Branch5, Branch6, Branch7
mesh = Mesh(bang.Branch3)
mcomp = Decompose(Mesh=mesh)  # -> Vertices, Faces, Colours, Normals
str_2 = String(mcomp.Faces)
python_2 = PythonScript(x=str_2, GhMemory=0)  # -> out, a
# ---------- python_2: Python ----------
a = str(x)[2:-1]
# ---------- end python_2 ----------
split = StringSplit(String=python_2.a, Separators=";")
item_2 = ListItem(List=mcomp.Vertices, Index=split, Wrap=False)
flip = FlipMatrix(Data=item_2)
bang_2 = ExplodeTree(Tree=flip)  # -> Branch1, Branch2, Branch3
md_slider = MDSlider(slider_value=Point(0.5, 0.5, 0.5), x_domain=Domain(0, 1), y_domain=Domain(0, 1), z_domain=Domain(0, 1))
srf4pt = _4PointSurface(CornerA=bang_2.Branch1, CornerB=bang_2.Branch2, CornerC=bang_2.Branch3, CornerD=bang_2.Branch3)
eval = EvaluateSurface(Surface=reparameterize(srf4pt), Point=md_slider)  # -> Point, Normal, Frame
edges = BrepEdges(Brep=srf4pt)  # -> Naked, Interior, NonManifold
Z = UnitZ(Factor=1)
rev = Reverse(Vector=Z)
join = JoinCurves(Curves=edges.Naked, Preserve=False)
crv = Curve(join)
angle = Angle(VectorA=eval.Normal, VectorB=Z)  # -> Angle, Reflex
pcen = PolygonCenter(Polyline=crv)
f_x_y = F2(Function="x<=y", X=angle.Angle, Y=Slider(0.001, range=0..0.01))
dispatch = Dispatch(List=flatten(eval.Frame), DispatchPattern=f_x_y)  # -> ListA, ListB
align = AlignPlane(Plane=dispatch.ListB, Direction=rev)  # -> Plane, Angle
dispatch_2 = Dispatch(List=flatten(pcen), DispatchPattern=f_x_y)  # -> ListA, ListB
pl_origin = PlaneOrigin(Base=align.Plane, Origin=flatten(dispatch_2.ListB))
slider = Slider(5.975, range=0..10)
pcomp = PlaneComponents(Plane=pl_origin)  # -> Origin, XAxis, YAxis, ZAxis
rev_2 = Reverse(Vector=pcomp.XAxis)
division = Division(A=slider, B=2)
amp = Amplitude(Vector=rev_2, Amplitude=division)
move = Move(Geometry=pcomp.Origin, Translation=amp)  # -> Geometry, Transform
line = LineSDL(Start=move.Geometry, Direction=pcomp.XAxis, Length=slider)
end = EndPoints(Curve=line)  # -> Start, End
pl_origin_2 = PlaneOrigin(Base=pl_origin, Origin=end.End)
dispatch_3 = Dispatch(List=flatten(angle.Angle), DispatchPattern=f_x_y)  # -> ListA, ListB
polygon = Polygon(Plane=pl_origin_2, Radius=Slider(1, range=0..1), Segments=Slider(3, range=0..10), FilletRadius=0)  # -> Polygon, Length
dom = Domain(DomainStart=Slider(-0.03, range=-0.5..1), DomainEnd=Slider(0.36, range=0..1))
remap = RemapNumbers(Values=dispatch_3.ListB, Source=dom, Target=Domain(0, 1))
scale = Scale(Geometry=polygon.Polygon, Center=pcomp.Origin, Factor=remap)  # -> Geometry, Transform
scale_2 = Scale(Geometry=line, Center=pcomp.Origin, Factor=remap)  # -> Geometry, Transform
weave = Weave(Pattern=[0, 1], Stream0=scale_2.Geometry, Stream1=scale.Geometry, NullGaps=False)
str_3 = String(concat)
concat_3 = Concatenate(Start=str_3, End="drainarrows")
drain_arrows = Curve(flatten(weave))
str_4 = String(concat_3)
pickler = PythonScript(data=drain_arrows, path=str_4, write=Toggle(False), GhMemory=0)  # -> out, a; inputs data: list, path: String
# ---------- pickler: Python ----------
import cPickle as pickle
 
if path and data and write:
    f = open(path, 'wb')
    pickle.dump(data, f)
    f.close()
    fcheck = open(path)
    a = pickle.load(fcheck)
    fcheck.close()
# ---------- end pickler ----------
panel_2 = Panel(pickler.out)
panel_3 = Panel(pickler.a)
