# Grasshopper definition drainMaker.ghx (Grasshopper 0.8.10)

panel = Panel("""78
112""")
panel_2 = Panel("""-site
-terrain""")
item = ListItem(List=panel, Index=Slider(1, range=0..1), Wrap=False)
concat = Concatenate(Start="C:\amigos\dump\", End=item)
concat_2 = Concatenate(Start=concat, End=panel_2)
concat_3 = Concatenate(Start=concat_2, End=".3dm")
panel_3 = Panel(concat_3)
panel_4 = Panel("""groundsurface
openchannels
gravitymains
lateraldrains
catchbasins""")
concat_4 = Concatenate(Start=concat, End="-drains")
concat_5 = Concatenate(Start=concat_4, End=".3dm")
python = PythonScript(FilePaths=concat_3, LayerNames=panel_4, DoImport=Toggle(False), DoDelete=Toggle(True), GhMemory=10)  # -> out, a; inputs FilePaths: list of String, LayerNames: list of String, DoImport: Boolean, DoDelete: Boolean
# ---------- python: Python ----------
import Rhino
import scriptcontext

# for accesssing GH classes
import clr
clr.AddReference("Grasshopper")
from Grasshopper.Kernel.Data import GH_Path
from Grasshopper import DataTree

do_import = False
delete = False
fpaths = []
layernames = []

print scriptcontext.doc

if FilePaths:
    for f in FilePaths:
        fpaths.append(f)
if LayerNames:
    for lyr in LayerNames:
        layernames.append(lyr)

# transfer values.
if DoImport:
    do_import = DoImport
    if DoDelete:
        delete = DoDelete
if do_import:
    opt = Rhino.FileIO.FileReadOptions()
    opt.ImportMode = True
    # if the delete is on:
    if delete:
        enumSettings = Rhino.DocObjects.ObjectEnumeratorSettings()
        enumSettings.VisibleFilter = True
        guids = [o.Id for o in scriptcontext.doc.Objects.FindByFilter(enumSettings)]
        scriptcontext.doc.Objects.Delete(guids, True)
        delete = False # set it to false
    # for each file:
    for fpath in fpaths:
        # import it
        scriptcontext.doc.ReadFile(fpath, opt)
    fpaths = []
    do_import = False
# get everything on the layers
layerTree = DataTree[Rhino.Geometry.GeometryBase]() # make a DataTree
for i in range(len(layernames)):
    objs = scriptcontext.doc.Objects.FindByLayer(layernames[i])
    geoms = [obj.Geometry for obj in objs]
    path = GH_Path(i)
    layerTree.AddRange(geoms, path)
a = layerTree
# ---------- end python ----------
split = SplitList(List=panel_4, Index="1")  # -> ListA, ListB
bang = ExplodeTree(Tree=python.a)  # -> Branch0, Branch1, Branch2, Branch3, Branch4
concat_6 = Concatenate(Start=split.ListB, End="_projected")
viewer = ParamViewer(python.a)
Z = UnitZ(Factor=1)
move = Move(Geometry=bang.Branch4, Translation=Z)  # -> Geometry, Transform
ln = Line(PointA=bang.Branch4, PointB=move.Geometry)
project = Project(Curve=bang.Branch1, Brep=bang.Branch0, Direction=Z)
project_2 = Project(Curve=bang.Branch2, Brep=bang.Branch0, Direction=Z)
project_3 = Project(Curve=bang.Branch3, Brep=bang.Branch0, Direction=Z)
scx = SurfaceLine(Surface=bang.Branch0, Line=ln, Limit=False)  # -> Curves, Points, UVPoints, Normal
slider = Slider(5, range=0..20)
series = Series(Start=0, Step=1, Count=slider)
cir = Circle(Plane=scx.Points, Radius=".5")
panel_5 = Panel("""{
}""")
int = Integer(series)
weave = Weave(Pattern=[0, 1], Stream0=panel_5, Stream1=graft(int), NullGaps=False)
join = StringJoin(Strings=weave)
range = Range(Domain=Domain(0, 1), Steps=slider)
bang_2 = ExplodeTree(Tree=join)  # -> Branch0, Branch1, Branch2, Branch3, Branch4, Branch5, Branch6, Branch7, Branch8
panel_6 = Panel(join)
gradient = Gradient(LowerLimit=0, UpperLimit=1, Parameter=range, stops=[0: None, 0: None])
flatten = FlattenTree(Data=project, Path=bang_2.Branch0)
flatten_2 = FlattenTree(Data=project_2, Path=bang_2.Branch1)
flatten_3 = FlattenTree(Data=project_3, Path=bang_2.Branch2)
flatten_4 = FlattenTree(Data=cir, Path=bang_2.Branch3)
panel_7 = Panel(concat_6)
merge = MergeMultiple(Stream0=flatten, Stream1=flatten_2, Stream2=flatten_3, Stream3=flatten_4)
panel_8 = Panel(merge)
panel_9 = Panel(concat_5)
preview = CustomPreview(Geometry=merge, Shader=graft(gradient))
localcodeexport = LocalCodeExport(DestinationFilePath=concat_5, Export=Toggle(False), LayerNames=panel_7, LayerColors=gradient, GeometryTree=merge)
