# Grasshopper definition drainareas.ghx (Grasshopper 0.8.11)

path = FilePath("C:\Users\demonchaux\Dropbox\localcode\site_ids.txt")
file = ReadFile(Path=path, Lines=True)
item = ListItem(List=file, Index=Slider(48, range=0..48), Wrap=False)
str = String(item)
panel = Panel("""drainpoint
draincurves
terrainmesh
plantgrid
drainpoint
groundsurface""")
concat = Concatenate(Start="/amigos/db/", End=str)
concat_2 = Concatenate(Start=concat, End=panel)
item_2 = ListItem(List=concat_2, Index=Slider(0, range=0..10), Wrap=False)
panel_2 = Panel(item_2)
slider = Slider(0, range=0..100)  # disabled
slider_2 = Slider(0, range=0..100)  # disabled
slider_3 = Slider(1.81, range=0..10)  # disabled
slider_4 = Slider(0.001, range=0..0.001)  # disabled
slider_5 = Slider(5.35, range=0..10)  # disabled
python = PythonScript(path=concat_2, read=Toggle(True), GhMemory=0)  # -> out, a; inputs path: String, read: Boolean
# ---------- python: Python ----------
import cPickle as pickle

if path and read:
    try:
        f = open(path, 'rb')
        a = pickle.load(f)
        f.close()
    except:
        print 'problem loading %s\nfile may not exist' % path
# ---------- end python ----------
toggle = BooleanToggle(True)  # disabled
bang = ExplodeTree(Tree=python.a)  # -> Branch1, Branch2, Branch3, Branch4, Branch5, Branch6, Branch7
custom_mesh_settings = SettingsCustom(
    StitchSeams=True,
    SimplePlanes=False,
    Refine=toggle,
    MinCount=slider,
    MaxCount=slider_2,
    AspectRatio=slider_3,
    MaxDistance=slider_4,
    MaxAngle=slider_5,
    MinEdge=0,
    MaxEdge=0)  # disabled
mesh = MeshBrep(Brep=bang.Branch6, Settings=custom_mesh_settings)  # disabled
mesh_2 = Mesh(bang.Branch3)
mcomp = Decompose(Mesh=mesh_2)  # -> Vertices, Faces, Colours, Normals
panel_3 = Panel(bang.Branch1)
panel_4 = Panel(bang.Branch2)
panel_5 = Panel(bang.Branch3)
str_2 = String(mcomp.Faces)
python_2 = PythonScript(x=str_2, GhMemory=0)  # -> out, a
# ---------- python_2: Python ----------
a = str(x)[2:-1]
# ---------- end python_2 ----------
split = StringSplit(String=python_2.a, Separators=";")
item_3 = ListItem(List=mcomp.Vertices, Index=split, Wrap=False)
panel_6 = Panel(split)
flip = FlipMatrix(Data=item_3)
bang_2 = ExplodeTree(Tree=flip)  # -> Branch1, Branch2, Branch3
srf4pt = _4PointSurface(CornerA=bang_2.Branch1, CornerB=bang_2.Branch2, CornerC=bang_2.Branch3, CornerD=bang_2.Branch3)
edges = BrepEdges(Brep=srf4pt)  # -> Naked, Interior, NonManifold
pt = Point(bang.Branch4)
join = JoinCurves(Curves=edges.Naked, Preserve=False)
plant_grid = Point(pt)
drain_point = Point(bang.Branch1)
crv = Curve(bang.Branch2)
crv_2 = Curve(join)

crv_3 = Curve(bang.Branch2)
lng = ListLength(List=crv_3)
series = Series(Start=0, Step=1, Count=lng)
crv_cp = CurveCP(Point=graft(plant_grid), Curve=flatten(crv_3))  # -> Point, Parameter, Distance
sort = SortList(Keys=crv_cp.Distance, ValuesA=flatten(series))  # -> List, ValuesA
sort_2 = SortList(Keys=crv_cp.Distance, ValuesA=crv_cp.Parameter)  # -> List, ValuesA
item_4 = ListItem(List=sort.ValuesA, Index=0, Wrap=False)
item_5 = ListItem(List=sort_2.ValuesA, Index=0, Wrap=False)
item_6 = ListItem(List=sort_2.List, Index=0, Wrap=False)
graft = GraftTree(Data=flatten(plant_grid), Strip=False)
panel_7 = Panel("""0
1
2""")
weave = Weave(Pattern=panel_7, Stream0=item_6, Stream1=item_4, Stream2=item_5, NullGaps=False)
flip_2 = FlipMatrix(Data=weave)
bang_3 = ExplodeTree(Tree=flip_2)  # -> Branch1, Branch2, Branch3
viewer = ParamViewer(graft)
curve_number = Integer(bang_3.Branch2)
graft_2 = GraftTree(Data=flatten(bang_3.Branch1), Strip=False)
viewer_2 = ParamViewer(graft_2)
replace = ReplaceBranches(Data=graft_2, Search=viewer_2, Replace=curve_number)
replace_2 = ReplaceBranches(Data=graft, Search=viewer, Replace=curve_number)

pt_2 = Point(bang.Branch5)
drain_point_2 = Point(pt_2)
distance = Number(replace)
drain_point_distance = Slider(35, range=0..50)
dom = Domain(DomainStart=Slider(0, range=0..1), DomainEnd=drain_point_distance)
remap = RemapNumbers(Values=distance, Source=dom, Target=Domain(0, 1))
drain_point_distance_2 = Slider(13.5, range=0..50)
slider_6 = Slider(4, range=0..10)
graph = GraphMapper(
    remap,
    x0=0,
    x1=1,
    y0=0,
    y1=1,
    container_name="Bezier",
    cpx=[0, 0.2531207502, 0.00677224854, 1],
    cpy=[0.7962690592, 0.004178493284, 0.1338364929, 0])
division = Division(A=drain_point_distance, B=drain_point_distance_2)
series_2 = Series(Start=0, Step=Slider(5, range=0..100), Count=Slider(7, range=0..100))
lng_2 = ListLength(List=series_2)
range = Range(Domain=dom, Steps=lng_2)
div = DivideDomain(Domain=dom, Count=lng_2)
remap_2 = RemapNumbers(Values=graph, Source=Domain(0, 1), Target=dom)
shift = ShiftList(List=range, Shift=-1, Wrap=False)
inc = Includes(Value=flatten(remap_2), Domain=graft(div))  # -> Includes, Deviation
lng_3 = ListLength(List=flatten(remap_2))
dispatch = Dispatch(List=flatten(remap_2), DispatchPattern=inc.Includes)  # -> ListA, ListB
# Drainage Area Blobs
series_3 = Series(Start=0, Step=1, Count=lng_3)
panel_8 = Panel(div)
dispatch_2 = Dispatch(List=series_3, DispatchPattern=inc.Includes)  # -> ListA, ListB
lng_4 = ListLength(List=dispatch.ListA)
dup = DuplicateData(Data=graft(shift), Number=lng_4, Order=True)
item_7 = ListItem(List=flatten(replace_2), Index=dispatch_2.ListA, Wrap=False)
slider_7 = Slider(0.482, range=0..1)
flatten = FlattenTree(Data=dup, Path="{0}")
flatten_2 = FlattenTree(Data=item_7, Path="{0}")
xy = XYPlane(Origin=Point(0, 0, 0))
clean = CleanTree(Data=flatten_2, CleanInvalid=True, CleanEmpty=False)
clean_2 = CleanTree(Data=flatten, CleanInvalid=True, CleanEmpty=False)
division_2 = Division(A=clean_2, B=2)
f_x_y = F2(Function="x>y", X=division_2, Y=Slider(0.001, range=0..0.001))
dispatch_3 = Dispatch(List=clean, DispatchPattern=f_x_y)  # -> ListA, ListB
fullterrainmesh = Mesh(mesh)
pie = PieChart(f_x_y)
dispatch_4 = Dispatch(List=division_2, DispatchPattern=f_x_y)  # -> ListA, ListB
Z = UnitZ(Factor=1)
project = Project()  # -> Geometry, Transform
cir = Circle(Plane=dispatch_3.ListA, Radius=dispatch_4.ListA)
cp = ClosestPoint()  # -> ClosestPoint, CPIndex, Distance
meshray = MeshRay(Mesh=fullterrainmesh, Direction=Z)  # -> Point, Hit; disabled
panel_9 = Panel(flatten)
mesh_3 = Mesh(Vertices=meshray.Point)  # disabled
drainareamesh = Mesh(mesh_3)  # disabled
