# Grasshopper definition drainareas2.ghx (Grasshopper 0.8.11)

path = FilePath("C:\Users\demonchaux\Dropbox\localcode\site_ids.txt")
file = ReadFile(Path=path, Lines=True)
item = ListItem(List=file, Index=Slider(48, range=0..48), Wrap=False)
str = String(item)
panel = Panel("""drainpoint
draincurves
terrainmesh
plantgrid
drainpoint
groundsurface""")
concat = Concatenate(Start="/amigos/db/", End=str)
concat_2 = Concatenate(Start=concat, End=panel)
item_2 = ListItem(List=concat_2, Index=Slider(0, range=0..10), Wrap=False)
panel_2 = Panel(item_2)
python = PythonScript(path=concat_2, read=Toggle(True), GhMemory=0)  # -> out, a; inputs path: String, read: Boolean
# ---------- python: Python ----------
import cPickle as pickle

if path and read:
    try:
        f = open(path, 'rb')
        a = pickle.load(f)
        f.close()
    except:
        print 'problem loading %s\nfile may not exist' % path
# ---------- end python ----------
bang = ExplodeTree(Tree=python.a)  # -> Branch1, Branch2, Branch3, Branch4, Branch5, Branch6, Branch7
custom_mesh_settings = SettingsCustom(
    StitchSeams=True,
    SimplePlanes=False,
    Refine=Toggle(True),
    MinCount=Slider(0, range=0..100),
    MaxCount=Slider(0, range=0..100),
    AspectRatio=Slider(1.81, range=0..10),
    MaxDistance=Slider(0.001, range=0..0.001),
    MaxAngle=Slider(5.35, range=0..10),
    MinEdge=0,
    MaxEdge=0)
crv = Curve(bang.Branch2)
mesh = MeshBrep(Brep=bang.Branch6, Settings=custom_mesh_settings)
mesh_2 = Mesh(bang.Branch3)
preview = CustomPreview(Geometry=crv, Shader=ColourSwatch(SwatchColor=RGB(0, 93, 255)))
pt = Point(bang.Branch4)
mcomp = Decompose(Mesh=mesh_2)  # -> Vertices, Faces, Colours, Normals
mesh_3 = Mesh(bang.Branch3)
panel_3 = Panel(bang.Branch1)
panel_4 = Panel(bang.Branch2)
panel_5 = Panel(bang.Branch3)
wbedges = MeshEdges(Mesh=bang.Branch3)
str_2 = String(mcomp.Faces)
python_2 = PythonScript(x=str_2, GhMemory=0)  # -> out, a
# ---------- python_2: Python ----------
a = str(x)[2:-1]
# ---------- end python_2 ----------
split = StringSplit(String=python_2.a, Separators=";")
item_3 = ListItem(List=mcomp.Vertices, Index=split, Wrap=False)
panel_6 = Panel(split)
flip = FlipMatrix(Data=item_3)
bang_2 = ExplodeTree(Tree=flip)  # -> Branch1, Branch2, Branch3
srf4pt = _4PointSurface(CornerA=bang_2.Branch1, CornerB=bang_2.Branch2, CornerC=bang_2.Branch3, CornerD=bang_2.Branch3)
edges = BrepEdges(Brep=srf4pt)  # -> Naked, Interior, NonManifold
pt_2 = Point(bang.Branch4)  # disabled
join = JoinCurves(Curves=edges.Naked, Preserve=False)
plant_grid = Point(pt_2)  # disabled
drain_point = Point(bang.Branch1)
crv_2 = Curve(bang.Branch2)
crv_3 = Curve(join)

crv_4 = Curve(bang.Branch2)  # disabled
lng = ListLength(List=crv_4)  # disabled
series = Series(Start=0, Step=1, Count=lng)  # disabled
crv_cp = CurveCP(Point=graft(plant_grid), Curve=flatten(crv_4))  # -> Point, Parameter, Distance; disabled
sort = SortList(Keys=crv_cp.Distance, ValuesA=flatten(series))  # -> List, ValuesA; disabled
sort_2 = SortList(Keys=crv_cp.Distance, ValuesA=crv_cp.Parameter)  # -> List, ValuesA; disabled
item_4 = ListItem(List=sort.ValuesA, Index=0, Wrap=False)  # disabled
item_5 = ListItem(List=sort_2.ValuesA, Index=0, Wrap=False)  # disabled
item_6 = ListItem(List=sort_2.List, Index=0, Wrap=False)  # disabled
graft = GraftTree(Data=flatten(plant_grid), Strip=False)  # disabled
panel_7 = Panel("""0
1
2""")  # disabled
weave = Weave(Pattern=panel_7, Stream0=item_6, Stream1=item_4, Stream2=item_5, NullGaps=False)  # disabled
flip_2 = FlipMatrix(Data=weave)  # disabled
bang_3 = ExplodeTree(Tree=flip_2)  # -> Branch1, Branch2, Branch3; disabled
viewer = ParamViewer(graft)  # disabled
curve_number = Integer(bang_3.Branch2)  # disabled
graft_2 = GraftTree(Data=flatten(bang_3.Branch1), Strip=False)  # disabled
viewer_2 = ParamViewer(graft_2)  # disabled
replace = ReplaceBranches(Data=graft_2, Search=viewer_2, Replace=curve_number)  # disabled
replace_2 = ReplaceBranches(Data=graft, Search=viewer, Replace=curve_number)  # disabled

id = String(concat)
pt_3 = Point(bang.Branch5)
mshadow = MeshShadow(Mesh=bang.Branch3, Light=Vector(0, 0, -1), Plane=PlaneXY(0, 0, 0))  # disabled
area = BrepArea(Brep=mshadow)  # -> Area, Centroid
int = Integer(area.Area)
max_boundary_from_drain_lines = Slider(35, range=0..100)  # disabled
division = Division(A=int, B=Slider(183, range=0..1000))  # disabled
division_2 = Division(A=division, B=Slider(167, range=0..1000))  # disabled
max_possible_diameter = Slider(21, range=0..100)  # disabled
max_distance_from_drain_lines = Integer(division)  # disabled
distance = Number(replace)  # disabled
panel_8 = Panel(division_2)  # disabled
pt_4 = Point(flatten(replace_2))
number_of_size_steps = Slider(7, range=0..10)  # disabled
xy = XYPlane(Origin=Point(0, 0, 0))  # disabled
max = Maximum(A=max_distance_from_drain_lines, B=max_boundary_from_drain_lines)  # disabled
min_diameter = Slider(0, range=0..100)  # disabled
lowest_max_diameter = Slider(11, range=0..100)  # disabled
project = Project(Geometry=pt_4, Plane=xy)  # -> Geometry, Transform; disabled
min = Minimum(A=division, B=max_possible_diameter)  # disabled
panel_9 = Panel(max_distance_from_drain_lines)  # disabled
max_2 = Maximum(A=lowest_max_diameter, B=min)  # disabled
division_3 = Division(A=max_possible_diameter, B=number_of_size_steps)  # disabled
dom = Domain(DomainStart=min_diameter, DomainEnd=max_2)  # disabled
distances = Number(flatten(distance))  # disabled
remap = RemapNumbers(Values=distances, Source=max, Target=Domain(0, 1))  # disabled
slider = Slider(1, range=0..1)  # disabled
series_2 = Series(Start=0, Step=division_3, Count=number_of_size_steps)  # disabled
graph = GraphMapper(
    remap,
    x0=0,
    x1=1,
    y0=0,
    y1=1,
    container_name="Bezier",
    cpx=[0, 0.07212135941, 0.01029829588, 1],
    cpy=[1, 0, 0.07249861211, 0])  # disabled
item_7 = ListItem(List=series_2, Index=slider, Wrap=False)  # disabled
div = DivideDomain(Domain=max_possible_diameter, Count=number_of_size_steps)  # disabled
remap_2 = RemapNumbers(Values=graph, Source=Domain(0, 1), Target=dom)  # disabled
subtraction = Subtraction(A=remap_2, B=division_2)  # disabled
panel_10 = Panel(subtraction)  # disabled
inc = Includes(Value=flatten(subtraction), Domain=graft(div))  # -> Includes, Deviation; disabled
lng_2 = ListLength(List=flatten(project.Geometry))  # disabled
series_3 = Series(Start=0, Step=1, Count=lng_2)  # disabled
dispatch = Dispatch(List=flatten(remap_2), DispatchPattern=inc.Includes)  # -> ListA, ListB; disabled
dispatch_2 = Dispatch(List=series_3, DispatchPattern=inc.Includes)  # -> ListA, ListB; disabled
lng_3 = ListLength(List=dispatch.ListA)  # disabled
dup = DuplicateData(Data=graft(series_2), Number=lng_3, Order=True)  # disabled
sort_3 = SortList(Keys=flatten(dup))  # -> List, ValuesA; disabled
rev = ReverseList(List=sort_3.List)  # disabled
item_8 = ListItem(List=rev, Index=0, Wrap=False)  # disabled
max_3 = Maximum(A=item_8, B=item_7)  # disabled
# Drainage Area Blobs
item_9 = ListItem(List=flatten(project.Geometry), Index=dispatch_2.ListA, Wrap=False)  # disabled
flatten = FlattenTree(Data=dup, Path="{0}")  # disabled
flatten_2 = FlattenTree(Data=item_9, Path="{0}")  # disabled
slider_2 = Slider(0.01, range=0..0.01)  # disabled
clean = CleanTree(Data=flatten_2, CleanInvalid=True, CleanEmpty=False)  # disabled
panel_11 = Panel("x<y")  # disabled
clean_2 = CleanTree(Data=flatten, CleanInvalid=True, CleanEmpty=False)  # disabled
xy_2 = XYPlane(Origin=Point(0, 0, 0))  # disabled
f_x_y = F2(Function=panel_11, X=clean_2, Y=slider_2)  # disabled
drain_point_2 = Point(pt_3)  # disabled
division_4 = Division(A=clean_2, B=2)  # disabled
project_2 = Project(Geometry=drain_point_2, Plane=xy_2)  # -> Geometry, Transform; disabled
dispatch_3 = Dispatch(List=clean, DispatchPattern=f_x_y)  # -> ListA, ListB; disabled
dispatch_4 = Dispatch(List=division_4, DispatchPattern=f_x_y)  # -> ListA, ListB; disabled
weave_2 = Weave(Pattern=[0, 1], Stream0=max_3, Stream1=dispatch_4.ListB, NullGaps=False)  # disabled
weave_3 = Weave(Pattern=[0, 1], Stream0=project_2.Geometry, Stream1=dispatch_3.ListB, NullGaps=False)  # disabled
slider_3 = Slider(0.108, range=0..1)  # disabled
panel_12 = Panel("1")  # disabled
cir = Circle(Plane=weave_3, Radius=weave_2)  # disabled
fit = FitCrv(Curve=cir, Degree=flatten(panel_12), Tolerance=slider_3)  # disabled
fullterrainmesh = Mesh(mesh)
cp = ControlPoints(Curve=fit)  # -> Points, Weights, Knots; disabled
shift = ShiftList(List=cp.Points, Shift=1, Wrap=False)  # disabled
pline = PolyLine(Vertices=shift, Closed=True)  # disabled
mesh_4 = Mesh(pline)  # disabled
mcomp_2 = Decompose(Mesh=flatten(mesh_4))  # -> Vertices, Faces, Colours, Normals; disabled
wbedges_2 = MeshEdges(Mesh=mesh_4)
Z = UnitZ(Factor=1)
meshray = MeshRay(Mesh=flatten(fullterrainmesh), Point=mcomp_2.Vertices, Direction=Z)  # -> Point, Hit; disabled
panel_13 = Panel(flatten)  # disabled
dispatch_5 = Dispatch(List=mcomp_2.Vertices, DispatchPattern=meshray.Hit)  # -> ListA, ListB; disabled
dispatch_6 = Dispatch(List=meshray.Point, DispatchPattern=meshray.Hit)  # -> ListA, ListB; disabled
weave_4 = Weave(Pattern=meshray.Hit, Stream0=dispatch_5.ListB, Stream1=dispatch_6.ListA, NullGaps=False)  # disabled
concat_3 = Concatenate(Start=id, End="fullterrainmesh")
mesh_5 = Mesh(Vertices=weave_4, Faces=mcomp_2.Faces)  # disabled
panel_14 = Panel(concat_3)
drainareamesh = Mesh(flatten(mesh_5))  # disabled
pickler = PythonScript(data=fullterrainmesh, path=concat_3, write=Toggle(False), GhMemory=0)  # -> out, a; inputs data: list, path: String
# ---------- pickler: Python ----------
import cPickle as pickle
 
if path and data and write:
    f = open(path, 'wb')
    pickle.dump(data, f)
    f.close()
    fcheck = open(path)
    a = pickle.load(fcheck)
    fcheck.close()
# ---------- end pickler ----------
panel_15 = Panel(pickler.out)
panel_16 = Panel(pickler.a)
preview_2 = CustomPreview(Geometry=drainareamesh, Shader=ColourSwatch(SwatchColor=RGB(0, 255, 34)))
