# Grasshopper definition file_lister.ghx (Grasshopper 0.8.10)

python = PythonScript(folder="C:\amigos\dump", extension=".3dm", include_folders=Toggle(False), GhMemory=0)  # -> out, a, b; inputs folder: String, extension: String, include_folders: Boolean
# ---------- python: Python ----------
import os
folderpath = os.path.abspath(folder)
contents = os.listdir(folder)
outList = []
bList = []
for f in contents:
    p = os.path.join(folder, f)
    if extension and extension != '':
        if os.path.splitext(p)[1] == extension:
            outList.append(p)
    if include_folders:
        if os.path.isdir(p):
            outList.append(p)
    else:
        if os.path.isfile(p):
            outList.append(p)
        else:
            bList.append(p)
a = outList
b = bList
# ---------- end python ----------
panel = Panel(python.a)
