# Grasshopper definition geometry_database.ghx (Grasshopper 0.8.11)

python = PythonScript(key="terrain", filepath="/amigos/sitedb", GhMemory=0)  # -> out, a; inputs geometry: list of GeometryBase, ID: String, key: String, filepath: String
# ---------- python: Python ----------
import shelve
if geometry and ID and key and filepath:
    db = shelve.open(filepath)
    data = geometry
    db[str(ID)+str(key)] = data
    db.close()
# ---------- end python ----------
