# Grasshopper definition hardscape.ghx (Grasshopper 0.8.11)

path = FilePath("C:\Users\demonchaux\Dropbox\localcode\site_ids.txt")
file = ReadFile(Path=path, Lines=True)
item = ListItem(List=file, Index=Slider(48, range=0..48), Wrap=False)
str = String(item)
panel = Panel("""hardgrid
siteoutline
canopymeshes
canopygrid
accessedges
busstops
drainareamesh
fullterrainmesh""")
concat = Concatenate(Start="/amigos/db/", End=str)
concat_2 = Concatenate(Start=concat, End=panel)
item_2 = ListItem(List=concat_2, Index=Slider(0, range=0..10), Wrap=False)
panel_2 = Panel(item_2)
python = PythonScript(path=flatten(concat_2), read=Toggle(True), GhMemory=0)  # -> out, a; inputs path: String, read: Boolean
# ---------- python: Python ----------
import cPickle as pickle

if path and read:
    try:
        f = open(path, 'rb')
        a = pickle.load(f)
        f.close()
    except:
        print 'problem loading %s\nfile may not exist' % path
        a = []
# ---------- end python ----------
bang = ExplodeTree(Tree=python.a)  # -> Branch1, Branch2, Branch3, Branch4, Branch5, Branch6, Branch7, Branch8

# ---- group: canopy grid
pt = Point(bang.Branch4)

# ----
pt_2 = Point(bang.Branch6)
mesh = Mesh(bang.Branch3)

# ---- group: hard grid
pt_3 = Point(bang.Branch1)

# ----
pcomp = Decompose(Point=pt_3)  # -> XComponent, YComponent, ZComponent
wbedges = MeshEdges(Mesh=mesh)
pcomp_2 = Decompose(Point=pt)  # -> XComponent, YComponent, ZComponent
avr = Average(Input=pcomp.YComponent)
avr_2 = Average(Input=pcomp.XComponent)
avr_3 = Average(Input=pcomp.ZComponent)
panel_3 = Panel(python.a)
avr_4 = Average(Input=pcomp_2.YComponent)
avr_5 = Average(Input=pcomp_2.XComponent)
avr_6 = Average(Input=pcomp_2.ZComponent)
pt_4 = PointXYZ(XComponent=avr_2, YComponent=avr, ZComponent=avr_3)

# ---- group: access edges
crv = Curve(bang.Branch5)

# ----
pt_5 = PointXYZ(XComponent=avr_5, YComponent=avr_4, ZComponent=avr_6)
preview = CustomPreview(Geometry=crv, Shader=ColourSwatch(SwatchColor=RGB(0, 225, 255)))
bnd = Bounds(Numbers=pcomp.ZComponent)
domcomp = DomainComponents(Domain=bnd)  # -> Start, End

# ---- group: Should it have a throoughfare? / Does it wrap a corner?
panel_4 = Panel("""0
1""")
item_3 = ListItem(List=crv, Index=0, Wrap=False)
eval = EvaluateCurve(Curve=reparameterize(item_3), Parameter=panel_4)  # -> Point, Tangent, Length
dispatch = Dispatch(List=eval.Tangent, DispatchPattern=[True, False])  # -> ListA, ListB
angle = Angle(VectorA=dispatch.ListA, VectorB=dispatch.ListB)  # -> Angle, Reflex
pi = Pi(Factor=Slider(0.3, range=0..1))
min = Minimum(A=angle.Angle, B=angle.Reflex)
f_x_y = F2(Function="abs(x)>y", X=min, Y=pi)

# ---- group: Should it have a throoughfare? / If there is more than one?
lng = ListLength(List=crv)
larger = LargerThan(FirstNumber=lng, SecondNumber="1")  # -> LargerThan, OrEqualTo

# ----
pt_6 = Point(pt_2)

# ---- group: Should it have a throoughfare?
or = GateOr(A=larger.LargerThan, B=f_x_y)

# ----
python_2 = PythonScript(x=pt_6, GhMemory=0)  # -> out, a
# ---------- python_2: Python ----------
a = bool(x)
# ---------- end python_2 ----------
crv_cp = CurveCP(Point=graft(pt_6), Curve=flatten(crv))  # -> Point, Parameter, Distance
max_distance_for_busstops = Slider(91, range=0..100)
sort = SortList(Keys=crv_cp.Distance, ValuesA=crv_cp.Point)  # -> List, ValuesA
item_4 = ListItem(List=sort.ValuesA, Index=0, Wrap=False)
item_5 = ListItem(List=sort.List, Index=0, Wrap=False)
f_x_y_2 = F2(Function="x<y", X=flatten(item_5), Y=max_distance_for_busstops)
dispatch_2 = Dispatch(List=flatten(item_4), DispatchPattern=f_x_y_2)  # -> ListA, ListB
and = GateAnd(A=python_2.a, B=f_x_y_2)

# ---- group: should have thoroughfare
bool = Boolean(or)

# ---- group: min points for thoroughfare
panel_5 = Panel("2")

# ----
cset = CreateSet(List=flatten(dispatch_2.ListA))

# ---- group: has busstops
bool_2 = Boolean(and)

# ----
python_3 = PythonScript(x=cset, GhMemory=0)  # -> out, a
# ---------- python_3: Python ----------
import Rhino
if x:
    a = x
else:
    a = Rhino.Geometry.Point3d(0.0,0.0,0.0)
# ---------- end python_3 ----------
lng_2 = ListLength(List=python_3.a)
pie = PieChart(bool_2)
slider = Slider(0.5, range=0..1)
max = Maximum(A=lng_2, B=panel_5)
series = Series(Start=0, Step=1, Count=lng)
weave = Weave(Pattern=bool, Stream0="1", Stream1=max, NullGaps=False)
slider_2 = Slider(0.1, range=0..1)
not = GateNot(A=larger.LargerThan)
larger_2 = LargerThan(FirstNumber=weave, SecondNumber=lng_2)  # -> LargerThan, OrEqualTo
python_4 = PythonScript(x=bool_2, y="0", GhMemory=0)  # -> out, a
# ---------- python_4: Python ----------
import Rhino
if x:
    a = x
else:
    a = y
# ---------- end python_4 ----------
subtraction = Subtraction(A=weave, B=lng_2)
subtraction_2 = Subtraction(A="1", B=slider_2)
and_2 = GateAnd(A=not, B=f_x_y)
weave_2 = Weave(Pattern=series, Stream0=slider, Stream1=slider, NullGaps=False)
weave_3 = Weave(Pattern=larger_2.LargerThan, Stream0="0", Stream1=subtraction, NullGaps=False)
weave_4 = Weave(Pattern=[0, 1], Stream0=slider_2, Stream1=subtraction_2, NullGaps=False)
weave_5 = Weave(Pattern=and_2, Stream0=weave_2, Stream1=weave_4, NullGaps=False)

# ---- group: closest access points to busstops if they exist
pt_7 = Point(python_3.a)

# ---- group: num points to add to busstops
panel_6 = Panel(weave_3)

# ---- group: number of access points
panel_7 = Panel(weave)

# ---- group: access edges
crv_2 = Curve(crv)

# ----
weave_6 = Weave(Pattern=panel_6, Stream0=panel_7, Stream1=panel_6, NullGaps=False)
eval_2 = EvaluateLength(Curve=crv_2, Length=weave_5, Normalized=True)  # -> Point, Tangent, Parameter
dist = Distance(PointA=pt_7, PointB=eval_2.Point)
sort_2 = SortList(Keys=dist, ValuesA=eval_2.Point)  # -> List, ValuesA

# ---- group: center of canopy area
pt_8 = Point(pt_5)

# ----
rev = ReverseList(List=sort_2.ValuesA)
python_5 = PythonScript(x=pt_8, y="0", GhMemory=0)  # -> out, a; same code as python_4
split = SplitList(List=rev, Index=panel_6)  # -> ListA, ListB
weave_7 = Weave(Pattern=[0, 1], Stream0=pt_7, Stream1=split.ListA, NullGaps=False)

# ---- group: number of points to find on edges
panel_8 = Panel(weave_6)

# ----
weave_8 = Weave(Pattern=[0, 1], NullGaps=False)
weave_9 = Weave(Pattern=python_4.a, Stream0=eval_2.Point, Stream1=weave_7, NullGaps=False)
weave_10 = Weave(Pattern=[0, 1], Stream0=weave_9, Stream1=python_5.a, NullGaps=False)
weave_11 = Weave(Pattern=[0, 1], Stream0=weave_10, Stream1=pt_3, NullGaps=False)
weave_12 = Weave(Pattern=[0, 1, 2], Stream0=pt_8, Stream1=weave_9, Stream2=pt_4, NullGaps=False)
cset_2 = CreateSet(List=weave_10)
cset_3 = CreateSet(List=weave_11)
pcomp_3 = Decompose(Point=weave_12)  # -> XComponent, YComponent, ZComponent
avr_7 = Average(Input=pcomp_3.YComponent)
del = DelaunayMesh(Points=flatten(cset_3), Plane=PlaneXY(0, 0, 0))
avr_8 = Average(Input=pcomp_3.XComponent)
avr_9 = Average(Input=pcomp_3.ZComponent)
pt_9 = PointXYZ(XComponent=avr_8, YComponent=avr_7, ZComponent=avr_9)
mcomp = Decompose(Mesh=del)  # -> Vertices, Faces, Colours, Normals
dispatch_3 = Dispatch(List=pt_6, DispatchPattern=bool_2)  # -> ListA, ListB
cp = ClosestPoint(Point=graft(cset_2), Set=flatten(mcomp.Vertices))  # -> ClosestPoint, CPIndex, Distance

# ---- group: point to get to
pt_10 = Point(pt_9)

# ----
preview_2 = CustomPreview(Geometry=pt_9, Shader=ColourSwatch(SwatchColor=RGB(157, 0, 255)))
int = Integer(flatten(cp.CPIndex))
cp_2 = ClosestPoint(Point=pt_10, Set=flatten(mcomp.Vertices))  # -> ClosestPoint, CPIndex, Distance
flatness_bias = Slider(1, range=0..1)
subtraction_3 = Subtraction(A=domcomp.End, B=domcomp.Start)
panel_9 = Panel(cp_2.CPIndex)
min_2 = Minimum(A=flatness_bias, B=subtraction_3)
python_6 = PythonScript(mesh=del, from_node=int, to_node=cp_2.CPIndex, flatness_bias=min_2, GhMemory=0)  # -> out, a; inputs mesh: Mesh, from_node: Int32, to_node: Int32, flatness_bias: Double
# ---------- python_6: Python ----------
import sys
import os

import Rhino

pathbits = [
        'C:\\Program Files (x86)',
        'Python26',
        'Lib',
        'site-packages'
        ]

importPath = os.path.join(*pathbits)
sys.path.append( importPath )

import networkx

G = networkx.Graph()
G.add_nodes_from(range(mesh.Vertices.Count))

def weight_function(i, j):
    p1 = Rhino.Geometry.Point3d((mesh.TopologyVertices[i]))
    p2 = Rhino.Geometry.Point3d((mesh.TopologyVertices[j]))
    base_weight = p1.DistanceTo(p2)
    deltaZ = p2.Z - p1.Z
    if deltaZ < 0.0:
        deltaZ *= -1
    return base_weight * (deltaZ ** flatness_bias)

for i in range(mesh.TopologyEdges.Count):
    pair = mesh.TopologyEdges.GetTopologyVertices(i)
    G.add_edge(pair.I, pair.J)
    weight = weight_function( pair.I, pair.J )
    G[pair.I][pair.J]['weight'] = weight

from_v = mesh.TopologyVertices.TopologyVertexIndex(from_node)
to_v = mesh.TopologyVertices.TopologyVertexIndex(to_node)

topology_list = networkx.algorithms.shortest_paths.generic.shortest_path(G, from_v, to_v, True)

a = [Rhino.Geometry.Point3d(mesh.TopologyVertices[v]) for v in topology_list]
# ---------- end python_6 ----------
pline = PolyLine(Vertices=python_6.a, Closed=False)

# ---- group: hard grid
pt_11 = Point(pt_3)

# ----
crv_cp_2 = CurveCP(Point=graft(pt_11), Curve=flatten(pline))  # -> Point, Parameter, Distance
preview_3 = CustomPreview(Geometry=flatten([weave_10, pline]), Shader=ColourSwatch(SwatchColor=RGB(0, 93, 255)))
sort_3 = SortList(Keys=crv_cp_2.Distance)  # -> List, ValuesA
item_6 = ListItem(List=sort_3.List, Index=0, Wrap=False)
f_x_y_3 = F2(Function="x<y", X=flatten(item_6), Y=Slider(9, range=0..100))
dispatch_4 = Dispatch(List=flatten(item_6), DispatchPattern=f_x_y_3)  # -> ListA, ListB
dispatch_5 = Dispatch(List=pt_11, DispatchPattern=f_x_y_3)  # -> ListA, ListB

# ---- group: canopy grid
pt_12 = Point(pt)

# ----
pt_13 = Point(dispatch_5.ListA)
lng_3 = ListLength(List=pt_13)
series_2 = Series(Start=0, Step=1, Count=lng_3)
mesh_2 = Mesh(bang.Branch7)
weave_13 = Weave(Pattern=[0, 1], Stream0=pt_12, Stream1=pt_13, NullGaps=False)
cset_4 = CreateSet(List=weave_13)
cp_3 = ClosestPoint(Point=graft(python_6.a), Set=cset_4)  # -> ClosestPoint, CPIndex, Distance
viewer = ParamViewer(cp_3.CPIndex)
path_mapper = PathMapper(cp_3.CPIndex, source="{a;b;c;d;e;f;g;h;i;j;k;l;m}", target="{l}")
crv_cp_3 = CurveCP(Point=graft(cset_4), Curve=flatten(pline))  # -> Point, Parameter, Distance
crv_cp_4 = CurveCP(Point=graft(cset_4), Curve=flatten(crv))  # -> Point, Parameter, Distance
sort_4 = SortList(Keys=crv_cp_3.Distance)  # -> List, ValuesA
shift = ShiftList(List=path_mapper, Shift=1, Wrap=False)
shift_2 = ShiftList(List=path_mapper, Shift=-1, Wrap=False)
sort_5 = SortList(Keys=crv_cp_4.Distance)  # -> List, ValuesA
item_7 = ListItem(List=sort_4.List, Index=0, Wrap=False)
weave_14 = Weave(Pattern=[0, 1], Stream0=graft(shift_2), Stream1=graft(shift), NullGaps=False)
item_8 = ListItem(List=sort_5.List, Index=0, Wrap=False)
bnd_2 = Bounds(Numbers=flatten(item_7))
lng_4 = ListLength(List=weave_14)
division = Division(A=lng_4, B=2)
bnd_3 = Bounds(Numbers=flatten(item_8))
remap = RemapNumbers(Values=flatten(item_7), Source=bnd_2, Target=Domain(0, 1))
series_3 = Series(Start=0, Step="2", Count=division)
remap_2 = RemapNumbers(Values=flatten(item_8), Source=bnd_3, Target=Domain(0, 1))
series_4 = Series(Start=series_3, Step=1, Count="2")
graph = GraphMapper(
    remap,
    x0=0,
    x1=1,
    y0=0,
    y1=1,
    container_name="Bezier",
    cpx=[0, 0.5491917133, 0.2223861367, 1],
    cpy=[1, 0.5639998913, 0.422382772, 0])
panel_10 = Panel(weave_14)
graph_2 = GraphMapper(remap_2, x0=0, x1=1, y0=0, y1=1, container_name="Bezier", cpx=[0, 0.01957280561, 0, 1], cpy=[1, 0.3748935163, 0, 0])
multiplication = Multiplication(A=graph_2, B=Slider(0.626, range=0..1))
multiplication_2 = Multiplication(A=graph, B=Slider(0.574, range=0..1))
python_7 = PythonScript(x=multiplication, y="0", GhMemory=0)  # -> out, a; same code as python_4
addition = Addition(A=python_7.a, B=multiplication_2)
bnd_4 = Bounds(Numbers=addition)
dom = Domain(DomainStart=Slider(0.5, range=0..10), DomainEnd=Slider(15, range=0..30))
remap_3 = RemapNumbers(Values=addition, Source=bnd_4, Target=dom)
slider_3 = Slider(0.108, range=0..1)
division_2 = Division(A=remap_3, B=2)
smaller = SmallerThan(FirstNumber=division_2, SecondNumber=Slider(1.896, range=0..5))  # -> SmallerThan, OrEqualTo
dispatch_6 = Dispatch(List=weave_13, DispatchPattern=smaller.SmallerThan)  # -> ListA, ListB
cir = Circle(Plane=weave_13, Radius=division_2)
fit = FitCrv(Curve=cir, Degree=flatten("1"), Tolerance=slider_3)
item_9 = ListItem(List=flatten(fit), Index=weave_14, Wrap=False)
cp_4 = ClosestPoint(Point=graft(pt_12), Set=flatten(weave_13))  # -> ClosestPoint, CPIndex, Distance
pt_14 = Point(dispatch_6.ListA)
cp_5 = ControlPoints(Curve=item_9)  # -> Points, Weights, Knots
prox = Proximity3D(Points=flatten(pt_14), Group=5, MaxRadius=Slider(12, range=0..100))  # -> Links, Topology
flatten = FlattenTree(Data=cp_4.CPIndex, Path="{0}")
cset_5 = CreateSet(List=flatten([weave_14, flatten]))
cull_i = CullIndex(List=flatten(fit), Indices=cset_5, Wrap=False)
path_mapper_2 = PathMapper(cp_5.Points, source="{a;b;c;d;e}", target="{a;b;c}")
item_10 = ListItem(List=prox.Links, Index=0, Wrap=False)
item_11 = ListItem(List=flatten(fit), Index=flatten, Wrap=False)
shift_3 = ShiftList(List=path_mapper_2, Shift=1, Wrap=False)
cp_6 = ControlPoints(Curve=cull_i)  # -> Points, Weights, Knots
mesh_3 = Mesh(bang.Branch8)
cp_7 = ControlPoints(Curve=item_11)  # -> Points, Weights, Knots
shift_4 = ShiftList(List=cp_6.Points, Shift=1, Wrap=False)
hull = ConvexHull(Points=shift_3, Plane=PlaneXY(0, 0, 0))  # -> Hull, HullZ, Indices
cset_6 = CreateSet(List=flatten(cp_7.Points))
cp_8 = ControlPoints(Curve=item_10)  # -> Points, Weights, Knots
pline_2 = PolyLine(Vertices=shift_4, Closed=True)
crv_3 = Curve(flatten(hull.Hull))
xy = XYPlane(Origin=Point(0, 0, 0))
hull_2 = ConvexHull(Points=flatten(cset_6), Plane=PlaneXY(0, 0, 0))  # -> Hull, HullZ, Indices
cir_2 = Circle(Plane=cp_8.Points, Radius=1)
runion = RegionUnion(Curves=flatten([crv_3, hull_2.Hull]), Plane=xy)
fit_2 = FitCrv(Curve=cir_2, Degree=flatten("1"), Tolerance=slider_3)
cp_9 = ControlPoints(Curve=fit_2)  # -> Points, Weights, Knots
crv_4 = Curve(bang.Branch2)
xy_2 = XYPlane(Origin=Point(0, 0, 0))
shift_5 = ShiftList(List=cp_9.Points, Shift=1, Wrap=False)
path_mapper_3 = PathMapper(shift_5, source="{a;b;c;d;e}", target="{b}")
fullterrainmesh = Mesh(mesh_3)
project = Project(Geometry=crv_4, Plane=xy_2)  # -> Geometry, Transform
fit_3 = FitCrv(Curve=project.Geometry, Degree=flatten("1"), Tolerance=slider_3)
rint = RegionIntersection(GroupA=pline_2, GroupB=fit_3, Plane=xy_2)
Z = UnitZ(Factor=1)
hull_3 = ConvexHull(Points=path_mapper_3, Plane=xy_2)  # -> Hull, HullZ, Indices
python_8 = PythonScript(x=runion, y="0", GhMemory=0)  # -> out, a; same code as python_4
rint_2 = RegionIntersection(GroupA=runion, GroupB=fit_3, Plane=xy_2)
mesh_4 = Mesh(flatten([rint, rint_2]))
clean = CleanTree(Data=mesh_4, CleanInvalid=True, CleanEmpty=False)
mcomp_2 = Decompose(Mesh=flatten(clean))  # -> Vertices, Faces, Colours, Normals
meshray = MeshRay(Mesh=flatten(fullterrainmesh), Point=mcomp_2.Vertices, Direction=Z)  # -> Point, Hit
bool_3 = Boolean(python_8.a)
crv_5 = Curve(hull_3.Hull)
dispatch_7 = Dispatch(List=mcomp_2.Vertices, DispatchPattern=meshray.Hit)  # -> ListA, ListB
int_2 = Integer(bool_3)
viewer_2 = ParamViewer(path_mapper_3)
dispatch_8 = Dispatch(List=meshray.Point, DispatchPattern=meshray.Hit)  # -> ListA, ListB
runion_2 = RegionUnion(Curves=flatten(crv_5))
weave_15 = Weave(Pattern=meshray.Hit, Stream0=dispatch_7.ListB, Stream1=dispatch_8.ListA, NullGaps=False)
panel_11 = Panel(cp_9.Points)
mesh_5 = Mesh(flatten(runion_2))
mesh_6 = Mesh(Vertices=weave_15, Faces=mcomp_2.Faces)
mcomp_3 = Decompose(Mesh=flatten(mesh_5))  # -> Vertices, Faces, Colours, Normals
meshray_2 = MeshRay(Mesh=flatten(fullterrainmesh), Point=mcomp_3.Vertices, Direction=Z)  # -> Point, Hit
mesh_7 = Mesh(Vertices=meshray_2.Point, Faces=mcomp_3.Faces)
wbthicken = MeshThicken(Mesh=mesh_7, Distance=Slider(0.5, range=0..1), OffsetType=0)
toggle = BooleanToggle(False)
panel_12 = Panel("""pathsourcepoints
pathdestpoint
pathways
benchmeshes
hardscapemesh
activebusstops""")
wbedges_2 = MeshEdges(Mesh=wbthicken)
concat_3 = Concatenate(Start=concat, End=panel_12)
bang_2 = ExplodeTree(Tree=graft(concat_3))  # -> Branch1, Branch2, Branch3, Branch4, Branch5, Branch6
panel_13 = Panel(bang_2.Branch3)
pathsourcepoints = Point(flatten(cp.ClosestPoint))
wbedges_3 = MeshEdges(Mesh=mesh_6)
hardscapemesh = Mesh(flatten(mesh_6))
pathdestpoint = Point(cp_2.ClosestPoint)
pathways = Curve(flatten(pline))
benchmeshes = Mesh(flatten(wbthicken))
preview_4 = CustomPreview(Geometry=flatten([wbthicken, wbedges_2]), Shader=ColourSwatch(SwatchColor=RGB(71, 71, 71)))
preview_5 = CustomPreview(Geometry=mesh_6, Shader=ColourSwatch(SwatchColor=RGB(0, 0, 0)))

# ---- group: INfluencing busstops
pt_15 = Point(dispatch_3.ListA)

# ----
pickler = PythonScript(data=pathways, path=panel_13, write=Toggle(False), GhMemory=0)  # -> out, a; inputs data: list, path: String
# ---------- pickler: Python ----------
import cPickle as pickle
 
if path and data and write:
    f = open(path, 'wb')
    pickle.dump(data, f)
    f.close()
    fcheck = open(path)
    a = pickle.load(fcheck)
    fcheck.close()
# ---------- end pickler ----------
cir_3 = Circle(Plane=pt_15, Radius=Slider(5, range=0..10))
panel_14 = Panel(pickler.a)
