# Grasshopper definition import_error.ghx (Grasshopper 0.8.13)

srf = Surface(<surface referenced from the Rhino model>)
python = PythonScript(x=srf, GhMemory=0)  # -> out, a; inputs x: Surface
# ---------- python: Python ----------
print 'type(x) =',type(x)
# ---------- end python ----------
panel = Panel(python.out)
