# Grasshopper definition layer_exporter.ghx (Grasshopper 0.8.11)

panel = Panel("150")
panel_2 = Panel("""-terrain
-borders
-billboardpoints
-billboards
-transportation""")
path = FilePath("C:\Users\demonchaux\Dropbox\localcode\site_ids.txt")
file = ReadFile(Path=path, Lines=True)
item = ListItem(List=file, Index=Slider(48, range=0..48), Wrap=False)
concat = Concatenate(Start="C:\amigos\dump\", End=item)
concat_2 = Concatenate(Start=concat, End=panel_2)
panel_3 = Panel(file)
panel_4 = Panel("""foundbillboards-projected
geocodedbillboards-projected
billboards
metrobusstops-projected""")
panel_5 = Panel("""groundsurface
site-projected
parcel-projected""")
concat_3 = Concatenate(Start=concat_2, End=".3dm")
panel_6 = Panel(concat_3)
merge = Merge(StreamA=panel_5, StreamB=panel_4)
python = PythonScript(FilePaths=concat_3, LayerNames=merge, DoImport=Toggle(True), GhMemory=0)  # -> out, layerTree, availableLayers; inputs FilePaths: list, LayerNames: list
# ---------- python: Python ----------
import Rhino


# for accesssing GH classes
import clr
clr.AddReference("Grasshopper")
from Grasshopper.Kernel.Data import GH_Path
from Grasshopper import DataTree


# read geometry out of 3dm files and filter by layernames
if DoImport and FilePaths and LayerNames:
    
    layerTree = DataTree[Rhino.Geometry.GeometryBase]() # make a DataTree
    availableLayers = []
    for filepath in FilePaths:
        model = Rhino.FileIO.File3dm.Read(filepath)
        for lay in model.Layers:
            availableLayers.append(lay.Name)
        if not model: continue
        for i, layer in enumerate(LayerNames):
            path = GH_Path(i)
            geometry = []
            objs = model.Objects.FindByLayer(layer)
            for obj in objs:
                geom = obj.Geometry
                geom.EnsurePrivateCopy()
                geometry.append(geom)
            layerTree.AddRange(geometry, path)
        
        # models can take up a considerable amount of
        # memory that we don't need, so get rid of it
        # after copying the geometry we want out of it
        model.Dispose()
# ---------- end python ----------
panel_7 = Panel(merge)
item_2 = ListItem(List=python.availableLayers, Index=Slider(6, range=0..10), Wrap=False)
bang = ExplodeTree(Tree=python.layerTree)  # -> Branch0, Branch1, Branch2, Branch3, Branch4, Branch5, Branch6, Branch7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
crv = Curve(bang.Branch2)
concat_4 = Concatenate(Start=item, End="parcels")
concat_5 = Concatenate(Start="/amigos/db/", End=concat_4)
panel_8 = Panel(concat_5)
# Canopies
# Drainage Area Blobs
# Lowest Point or Drains
# Graded Terrain Mesh
# Drain Network Topology
# Drain Network Curves
pickler = PythonScript(data=crv, path=panel_8, write=Toggle(False), GhMemory=0)  # -> out, a; inputs data: list, path: String
# ---------- pickler: Python ----------
import cPickle as pickle
 
if path and data and write:
    f = open(path, 'wb')
    pickle.dump(data, f)
    f.close()
    fcheck = open(path)
    a = pickle.load(fcheck)
    fcheck.close()
# ---------- end pickler ----------
