# Grasshopper definition layer_tree.ghx (Grasshopper 0.8.10)

panel = Panel("""Layer 01
Layer 02""")
python = PythonScript(layernames=panel, GhMemory=10)  # -> out, a; inputs layernames: list of String
# ---------- python: Python ----------
import Rhino
import scriptcontext


# for accesssing GH classes
import clr
clr.AddReference("Grasshopper")
from Grasshopper.Kernel.Data import GH_Path
from Grasshopper import DataTree


layerTree = DataTree[Rhino.Geometry.GeometryBase]() # make a DataTree
for i in range(len(layernames)):
    objs = scriptcontext.doc.Objects.FindByLayer(layernames[i])
    geoms = [obj.Geometry for obj in objs]
    path = GH_Path(i)
    layerTree.AddRange(geoms, path)
a = layerTree
# ---------- end python ----------
panel_2 = Panel(python.a)
