# Grasshopper definition least_cost_path.ghx (Grasshopper 0.8.11)

trigrid = Triangular(Plane=PlaneXY(0, 0, 0), Size=1, ExtentX=Slider(33, range=0..100), ExtentY=Slider(19, range=0..100))  # -> Cells, Points
cp = ControlPoints(Curve=trigrid.Cells)  # -> Points, Weights, Knots
shift = ShiftList(List=cp.Points, Shift=1, Wrap=False)
cset = CreateSet(List=flatten(shift))
lng = ListLength(List=cset)
subtraction = Subtraction(A=lng, B=1)
range = Range(Domain=Domain(0, 1), Steps=subtraction)
graph = GraphMapper(
    range,
    x0=0,
    x1=1,
    y0=0,
    y1=1,
    container_name="Perlin",
    x_offset=0.6766392589,
    y_offset=0.4363473952,
    frequency=0.2924061716,
    amplitude=0.9386667721,
    decay=0.2063187361)
jitter = Jitter(List=graph, Jitter=Slider(0.178, range=0..1), Seed=2)  # -> Range, Indices
Z = UnitZ(Factor=jitter.Range)
domain = Domain(subtraction)
move = Move(Geometry=cset, Translation=Z)  # -> Geometry, Transform
remap = RemapNumbers(
    Values=[Slider(0.107, range=0..1), Slider(0.891, range=0..1), Slider(0.179, range=0..1), Slider(0.732, range=0..1)],
    Source=Domain(0, 1),
    Target=domain)
split = SplitList(List=remap, Index=1)  # -> ListA, ListB
con = DelaunayEdges(Points=move.Geometry, Plane=PlaneXY(0, 0, 0))  # -> Connectivity, Edges
del = DelaunayMesh(Points=move.Geometry, Plane=PlaneXY(0, 0, 0))
item = ListItem(List=move.Geometry, Index=remap, Wrap=False)
Z_2 = UnitZ(Factor=1)
preview = CustomPreview(
    Geometry=flatten([del, con.Edges]),
    Shader=[ColourSwatch(SwatchColor=RGB(130, 130, 130)), ColourSwatch(SwatchColor=RGB(107, 107, 107))])
line = LineSDL(Start=item, Direction=Z_2, Length=Slider(0.6, range=0..10))
flatness_bias = Slider(1, range=0..1)
slider = Slider(1, range=0..1)
slider_2 = Slider(100, range=0..100)
python = PythonScript(mesh=del, from_node=split.ListA, to_node=split.ListB, flatness_bias=flatness_bias, GhMemory=0)  # -> out, a; inputs mesh: Mesh, from_node: Int32, to_node: Int32, flatness_bias: Double
# ---------- python: Python ----------
import sys
import os

import Rhino

pathbits = [
        'C:\\Program Files (x86)',
        'Python26',
        'Lib',
        'site-packages'
        ]

importPath = os.path.join(*pathbits)
sys.path.append( importPath )

import networkx

G = networkx.Graph()
G.add_nodes_from(range(mesh.Vertices.Count))

def weight_function(i, j):
    p1 = Rhino.Geometry.Point3d((mesh.TopologyVertices[i]))
    p2 = Rhino.Geometry.Point3d((mesh.TopologyVertices[j]))
    base_weight = p1.DistanceTo(p2)
    deltaZ = p2.Z - p1.Z
    if deltaZ < 0.0:
        deltaZ *= -1
    return base_weight * (deltaZ ** flatness_bias)

for i in range(mesh.TopologyEdges.Count):
    pair = mesh.TopologyEdges.GetTopologyVertices(i)
    G.add_edge(pair.I, pair.J)
    weight = weight_function( pair.I, pair.J )
    G[pair.I][pair.J]['weight'] = weight

from_v = mesh.TopologyVertices.TopologyVertexIndex(from_node)
to_v = mesh.TopologyVertices.TopologyVertexIndex(to_node)

topology_list = networkx.algorithms.shortest_paths.generic.shortest_path(G, from_v, to_v, True)

a = [Rhino.Geometry.Point3d(mesh.TopologyVertices[v]) for v in topology_list]
# ---------- end python ----------
pline = PolyLine(Vertices=python.a, Closed=False)
preview_2 = CustomPreview(Geometry=flatten([pline, item]), Shader=ColourSwatch(SwatchColor=RGB(255, 0, 255)))
lng_2 = ListLength(List=python.a)
f_x = F1(Function="x*2-2", X=lng_2)
reb = Rebuild(Curve=reparameterize(pline), Degree=3, Count=f_x, Tangents=False)
pframes = PerpFrames(Curve=reparameterize(reb), Number=f_x, Align=True)  # -> Frames, Parameters
fit = FitCrv(Curve=pline, Degree=3, Tolerance=Slider(1, range=0..1))
Z_3 = UnitZ(Factor=1)
slider_3 = Slider(0.193, range=0..1)
slider_4 = Slider(0.885, range=0..1)
align = AlignPlane(Plane=pframes.Frames, Direction=Z_3)  # -> Plane, Angle
multiplication = Multiplication(A=slider_3, B=-1)
multiplication_2 = Multiplication(A=slider_4, B=-1)
dom = Domain(DomainStart=multiplication, DomainEnd=slider_3)
dom_2 = Domain(DomainStart=multiplication_2, DomainEnd=slider_4)
rectangle = Rectangle(Plane=align.Plane, XSize=dom, YSize=dom_2, Radius=0)  # -> Rec, Length
scale = Scale(Geometry=rectangle.Rec, Center=pframes.Frames, Factor=Slider(0.25, range=0..1))  # -> Geometry, Transform
explode = Explode(Curve=scale.Geometry, Recursive=True)  # -> Segments, Vertices
item_2 = ListItem(List=explode.Segments, Index=Slider(1, range=0..10), Wrap=False)
path_mapper = PathMapper(item_2, source="{a;b;c;d;e;f;g}", target="{e}")
bang = ExplodeTree(Tree=path_mapper)  # -> Branch1, Branch2, Branch3
viewer = ParamViewer(path_mapper)
slider_5 = Slider(1, range=0..10)
end = EndPoints(Curve=bang.Branch2)  # -> Start, End
intcrv = Interpolate(Vertices=end.End, Degree=slider_5, Periodic=False)  # -> Curve, Length, Domain
intcrv_2 = Interpolate(Vertices=end.Start, Degree=slider_5, Periodic=False)  # -> Curve, Length, Domain
loft = Loft(
    Section=[intcrv_2.Curve, intcrv.Curve],
    Options={Adjust=False, Closed=False, Rebuild=10, Refit=0.01, LoftType=0, LoftEnds=0, LoftSimp=0})
