# Grasshopper definition make2dprep.ghx (Grasshopper 0.8.13)

path = FilePath("C:\Users\demonchaux\Dropbox\localcode\site_ids.txt")
file = ReadFile(Path=path, Lines=True)
item = ListItem(List=file, Index=Slider(14, range=0..48), Wrap=False)
concat = Concatenate(Start="/amigos/dump/", End=item)
concat_2 = Concatenate(Start=concat, End="-terrain.3dm")
panel = Panel(concat_2)
panel_2 = Panel("""bigcontours
smallcontours""")
python = PythonScript(FilePaths=concat_2, LayerNames=panel_2, DoImport=Toggle(True), GhMemory=0)  # -> out, layerTree; inputs FilePaths: list, LayerNames: list
# ---------- python: Python ----------
import Rhino


# for accesssing GH classes
import clr
clr.AddReference("Grasshopper")
from Grasshopper.Kernel.Data import GH_Path
from Grasshopper import DataTree


# read geometry out of 3dm files and filter by layernames
if DoImport and FilePaths and LayerNames:
    
    layerTree = DataTree[Rhino.Geometry.GeometryBase]() # make a DataTree
    
    for filepath in FilePaths:
        model = Rhino.FileIO.File3dm.Read(filepath)
        if not model: continue
        for i, layer in enumerate(LayerNames):
            path = GH_Path(i)
            geometry = []
            objs = model.Objects.FindByLayer(layer)
            for obj in objs:
                geom = obj.Geometry
                geom.EnsurePrivateCopy()
                geometry.append(geom)
            layerTree.AddRange(geometry, path)
        # models can take up a considerable amount of
        # memory that we don't need, so get rid of it
        # after copying the geometry we want out of it
        model.Dispose()
# ---------- end python ----------
bang = ExplodeTree(Tree=python.layerTree)  # -> Branch1, Branch2
viewer = ParamViewer(python.layerTree)
panel_3 = Panel(python.out)
crv = Curve(bang.Branch2)
