# Grasshopper definition new_import.ghx (Grasshopper 0.8.10)

panel = Panel("""78
112""")
item = ListItem(List=panel, Index=Slider(0, range=0..1), Wrap=False)
panel_2 = Panel("""-site
-terrain""")
concat = Concatenate(Start="C:\amigos\sample\", End=item)
concat_2 = Concatenate(Start=concat, End=panel_2)
concat_3 = Concatenate(Start=concat_2, End=".3dm")
panel_3 = Panel("""gravitymains
lateraldrains""")
panel_4 = Panel(concat_3)
python = PythonScript(FilePaths=concat_3, LayerNames=panel_3, DoImport=Toggle(True), GhMemory=0)  # -> out, layerTree; inputs FilePaths: list, LayerNames: list
# ---------- python: Python ----------
import Rhino


# for accesssing GH classes
import clr
clr.AddReference("Grasshopper")
from Grasshopper.Kernel.Data import GH_Path
from Grasshopper import DataTree


# read geometry out of 3dm files and filter by layernames
if DoImport and FilePaths and LayerNames:
    
    layerTree = DataTree[Rhino.Geometry.GeometryBase]() # make a DataTree
    
    for filepath in FilePaths:
        model = Rhino.FileIO.File3dm.Read(filepath)
        if not model: continue
        for i, layer in enumerate(LayerNames):
            path = GH_Path(i)
            geometry = []
            objs = model.Objects.FindByLayer(layer)
            for obj in objs:
                geom = obj.Geometry
                geom.EnsurePrivateCopy()
                geometry.append(geom)
            layerTree.AddRange(geometry, path)
        # models can take up a considerable amount of
        # memory that we don't need, so get rid of it
        # after copying the geometry we want out of it
        model.Dispose()
# ---------- end python ----------
bang = ExplodeTree(Tree=python.layerTree)  # -> Branch1, Branch2
crv = Curve(bang.Branch2)
viewer = ParamViewer(python.layerTree)
panel_5 = Panel(python.out)
panel_6 = Panel(python.layerTree)
