# Grasshopper definition pickler.ghx (Grasshopper 0.8.11)

python = PythonScript(key="terrain", path="/amigos/sitedb", write=Toggle(False), GhMemory=0)  # -> out, a; inputs data: list, key: String, path: String
# ---------- python: Python ----------
import cPickle as pickle
 
if path and data and write:
    f = open(path, 'wb')
    pickle.dump(data, f)
    f.close()
    fcheck = open(path)
    a = pickle.load(fcheck)
    fcheck.close()
# ---------- end python ----------
