# Grasshopper definition pickling tools.ghx (Grasshopper 0.8.13)

str = String("/amigos/db/viewdb")
str_2 = String()
pickler = PythonScript(path=str, write=Toggle(False), GhMemory=0)  # -> out, a; inputs data: list, path: String
# ---------- pickler: Python ----------
import cPickle as pickle
 
if path and data and write:
    f = open(path, 'wb')
    pickle.dump(data, f)
    f.close()
    fcheck = open(path)
    a = pickle.load(fcheck)
    fcheck.close()
# ---------- end pickler ----------
unshelver = PythonScript(path="/amigos/db/viewdb", key=Slider(71, range=0..100), read=Toggle(False), GhMemory=0)  # -> out, a; inputs path: String, key: String, read: Boolean
# ---------- unshelver: Python ----------
import shelve

if path and key and read:
    db = shelve.open(path)
    data = db[key]
    a = data
# ---------- end unshelver ----------
unpickler = PythonScript(path=str_2, read=Toggle(False), GhMemory=0)  # -> out, a; inputs path: String, read: Boolean
# ---------- unpickler: Python ----------
import cPickle as pickle

if path and read:
    try:
        f = open(path, 'rb')
        a = pickle.load(f)
        f.close()
    except:
        print 'problem loading %s\nfile may not exist' % path
# ---------- end unpickler ----------
panel = Panel(pickler.out)
panel_2 = Panel(pickler.a)
panel_3 = Panel(unpickler.a)
panel_4 = Panel(unpickler.out)
