# Grasshopper definition projector.ghx (Grasshopper 0.8.10)

path = FilePath("C:\Users\demonchaux\Dropbox\localcode\site_ids.txt")
file = ReadFile(Path=path, Lines=True)
item = ListItem(List=file, Index=Slider(49, range=0..49), Wrap=False)
panel = Panel(item)
panel_2 = Panel("""-site
-terrain""")
concat = Concatenate(Start="C:\amigos\dump\", End=panel)
doclyrs = RhinoLayers()  # -> Layers, LayerColours
concat_2 = Concatenate(Start=concat, End=panel_2)
concat_3 = Concatenate(Start=concat_2, End=".3dm")
split = SplitList(List=doclyrs.Layers, Index="6")  # -> ListA, ListB
panel_3 = Panel(concat_3)
item_2 = ListItem(List=split.ListB, Index=[Slider(12, range=0..31), Slider(2, range=0..31)], Wrap=False)
localcodeimport = LocalCodeImport(FilePathsForImport=concat_3, LayersToImport="tin_pts", OnOffSwitch=Toggle(True), DeleteExistingGeometry=Toggle(False))
panel_4 = Panel(item_2)
bang = ExplodeTree(Tree=localcodeimport)  # -> Branch1, Branch2
panel_5 = Panel(split.ListB)
series = Series(Start=0, Step=1, Count=10)
int = Integer(series)
panel_6 = Panel("""{
}""")
split_2 = SplitList(List=int, Index="3")  # -> ListA, ListB
weave = Weave(Pattern=[0, 1], Stream0=panel_6, Stream1=graft(split_2.ListA), NullGaps=False)
join = StringJoin(Strings=weave)
bang_2 = ExplodeTree(Tree=join)  # -> Branch0, Branch1, Branch2
flatten = FlattenTree(Path=bang_2.Branch2)
flatten_2 = FlattenTree(Path=bang_2.Branch1)
flatten_3 = FlattenTree(Path=bang_2.Branch0)
panel_7 = Panel(join)
panel_8 = Panel(item)
panel_9 = Panel("""groundsurface
smallcontours
bigcontours""")
m3 = Merge03(StreamA=flatten_3, StreamB=flatten_2, StreamC=flatten)
concat_4 = Concatenate(Start="C:\amigos\dump\", End=panel_8)
concat_5 = Concatenate(Start=concat_4, End="-terrain")
concat_6 = Concatenate(Start=concat_5, End=".3dm")
localcodeexport = LocalCodeExport(
    DestinationFilePath=concat_6,
    Export=Toggle(False),
    LayerNames=panel_9,
    LayerColors=[ColourSwatch(SwatchColor=RGB(255, 255, 255)), ColourSwatch(SwatchColor=RGB(120, 120, 120)), ColourSwatch(SwatchColor=RGB(0, 0, 0))],
    GeometryTree=m3)
panel_10 = Panel(concat_6)
