# Grasshopper definition region fill.ghx (Grasshopper 0.8.11)

range = Range(Domain=Domain(0, 1), Steps=10)
graph = GraphMapper(
    range,
    x0=0,
    x1=1,
    y0=0,
    y1=1,
    container_name="Bezier",
    cpx=[0, 0.3484377861, 0.6445307732, 1],
    cpy=[0.1567173302, 0.183582142, 0.4738815129, 0.07880640775])
pt = PointXYZ(XComponent=range, YComponent=graph, ZComponent=0)
crv = Curve(Vertices=pt, Degree=3, Periodic=False)  # -> Curve, Length, Domain
trigrid = Triangular(
    Plane=PlaneXY(0, 0, 0),
    Size=Slider(1.47, range=0..10),
    ExtentX=Slider(35, range=0..100),
    ExtentY=Slider(9, range=0..100))  # -> Cells, Points
cp = ControlPoints(Curve=trigrid.Cells)  # -> Points, Weights, Knots
scale = Scale(Geometry=crv.Curve, Center=Point(0, 0, 0), Factor=Slider(26.9, range=0..100))  # -> Geometry, Transform
shift = ShiftList(List=cp.Points, Shift=1, Wrap=False)
crv_2 = Curve(scale.Geometry)
cset = CreateSet(List=flatten(shift))
crv_cp = CurveCP(Point=cset, Curve=scale.Geometry)  # -> Point, Parameter, Distance
bnd = Bounds(Numbers=crv_cp.Distance)
remap = RemapNumbers(Values=crv_cp.Distance, Source=bnd, Target=Domain(0, 1))
graph_2 = GraphMapper(
    remap,
    x0=0,
    x1=1,
    y0=0,
    y1=1,
    container_name="Bezier",
    cpx=[0, 0.4646873474, 0.004687309265, 1],
    cpy=[0.6185075045, 0.2555223107, 0, 0])
metaball_t = MetaBallTCustom(
    Points=cset,
    Charge=graph_2,
    Plane=PlaneXY(0, 0, 0),
    Threshold=Slider(4.105, range=0..5),
    Accuracy=Slider(0.313, range=0..1))
mesh = Mesh(metaball_t)
