# Grasshopper definition renderprep.ghx (Grasshopper 0.8.13)

path = FilePath("C:\Users\demonchaux\Dropbox\localcode\site_ids.txt")
file = ReadFile(Path=path, Lines=True)
sort = SortList(Keys=file)  # -> List, ValuesA
int = Integer(sort.List)
item = ListItem(List=int, Index=Slider(48, range=0..48), Wrap=False)
str = String(item)
panel = Panel(int)
concat = Concatenate(Start="/amigos/db/", End=str)
panel_2 = Panel("""canopymeshes
billboards
drainpoint
siteoutline
drainareamesh
pathsourcepoints
pathdestpoint
pathways
benchmeshes
hardscapemesh
drainarrows
draincurves
parcels
terrainmesh""")
concat_2 = Concatenate(Start=concat, End=panel_2)
item_2 = ListItem(List=concat_2, Index=Slider(0, range=0..10), Wrap=False)
python = PythonScript(path=flatten(concat_2), read=Toggle(True), GhMemory=0)  # -> out, a; inputs path: String, read: Boolean
# ---------- python: Python ----------
import cPickle as pickle

if path and read:
    try:
        f = open(path, 'rb')
        a = pickle.load(f)
        f.close()
    except:
        print 'problem loading %s\nfile may not exist' % path
        a = []
# ---------- end python ----------
viewer = ParamViewer(python.a)
bang = ExplodeTree(Tree=python.a)  # -> Branch1, Branch2, Branch3, Branch4, Branch5, Branch6, Branch7, Branch8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

# ---- group: canopies
mesh = Mesh(bang.Branch1)

# ---- group: billboards
brep = Brep(bang.Branch2)

# ---- group: drainpoint
pt = Point(bang.Branch3)

# ---- group: site bounds
crv = Curve(bang.Branch4)

# ---- group: view
azimuth = Slider(145, range=0..359)
str_2 = String(str)
altitude = Slider(45, range=0..90)
crv_2 = Curve(crv)
slider = Slider(0.5, range=0..1)
f_x = F1(Function="x*pi/180", X=azimuth)
preview = CustomPreview(Geometry=crv_2, Shader=ColourSwatch(SwatchColor=RGB(85, 0, 255)))
f_x_2 = F1(Function="x*pi/180", X=altitude)
panel_3 = Panel(f_x)
multiplication = Multiplication(A=f_x_2, B=-1)
cp = ControlPoints(Curve=crv_2)  # -> Points, Weights, Knots
pline = PolyLine(Vertices=cp.Points, Closed=False)
Y = UnitY(Factor=1)
Z = UnitZ(Factor=1)
rev = Reverse(Vector=Y)
pcen = PolygonCenter(Polyline=pline)
vrot = Rotate(Vector=rev, Axis=Z, Angle=f_x)
Z_2 = UnitZ(Factor=1)
pl = Plane(Origin=pcen, XAxis=vrot, YAxis=Z_2)
rotate = Rotate(Geometry=pl, Angle=multiplication, Plane=pl)  # -> Geometry, Transform
pcomp = PlaneComponents(Plane=rotate.Geometry)  # -> Origin, XAxis, YAxis, ZAxis
amp = Amplitude(Vector=pcomp.XAxis, Amplitude=Slider(61, range=0..100))
python_2 = PythonScript(geometry=crv_2, scaleFactor=Slider(0, range=-50..100), GhMemory=10)  # -> out, a; inputs geometry: GeometryBase, scaleFactor: Double
# ---------- python_2: Python ----------
import scriptcontext

vp = scriptcontext.doc.Views.ActiveView.ActiveViewport
bbox = geometry.GetBoundingBox(True)
bbox.Inflate(-scaleFactor)
vp.ZoomBoundingBox(bbox)
# ---------- end python_2 ----------
python_3 = PythonScript(geometry=crv_2, view_vector=pcomp.XAxis, center_point=pcomp.Origin, GhMemory=0)  # -> out, a; inputs view_vector: Vector3d, center_point: Point3d
# ---------- python_3: Python ----------
import Rhino
import scriptcontext

viewport = scriptcontext.doc.Views.ActiveView.ActiveViewport

viewport.SetCameraDirection(view_vector, True)
viewport.SetCameraTarget(center_point, True)
plane = viewport.GetCameraFrame()[1]

#plane = Rhino.Geometry.Plane(center_point, view_vector)

bbox = geometry.GetBoundingBox(plane)
a = [bbox, plane]
# ---------- end python_3 ----------
python_4 = PythonScript(siteID=str_2, GhMemory=0)  # -> out, a; inputs siteID: String
# ---------- python_4: Python ----------
from scriptcontext import doc

import shelve
db = shelve.open('/amigos/viewdb')


data = {}
vp = doc.Views.ActiveView.ActiveViewport
data['camera'] = vp.CameraLocation #point3d
data['target'] = vp.CameraTarget #point3d
data['lenslength'] = vp.Camera35mmLensLength #double
data['bounds'] = vp.ScreenPortBounds #Rectangle

print '\n'.join(['%s: %s' % (k, data[k]) for k in data])
db[str(siteID)] = data

db.close()
# ---------- end python_4 ----------
vdis = VectorDisplay(Anchor=pcen, Vector=amp)
dispatch = Dispatch(List=python_3.a, DispatchPattern=[True, False])  # -> ListA, ListB
xy = XYPlane(Origin=Point(0, 0, 0))
panel_4 = Panel(python_4.out)
pln = Plane(dispatch.ListB)
box = Box(dispatch.ListA)
orient = Orient(Geometry=box, Initial=xy, Final=pln)  # -> Geometry, Transform
panel_5 = Panel(python_3.a)
explode = BrepComponents(Brep=orient.Geometry)  # -> Faces, Edges, Vertices
join = BrepJoin(Breps=explode.Faces)  # -> Breps, Closed

# ---- group: path source points
pt_2 = Point(bang.Branch6)

# ---- group: drain areas mesh
mesh_2 = Mesh(bang.Branch5)

# ---- group: path dest points
pt_3 = Point(bang.Branch7)

# ---- group: paths
crv_3 = Curve(bang.Branch8)

# ---- group: benches
mesh_3 = Mesh(bang.Branch9)

# ---- group: hardscape
mesh_4 = Mesh(bang.Branch10)

# ----
slider_2 = Slider(0.25, range=0..1)
slider_3 = Slider(0.25, range=0..1)
wbedges = MeshEdges(Mesh=bang.Branch14)
crv_4 = Curve(bang.Branch11)
Z_3 = UnitZ(Factor=Slider(-0.5, range=-1..0))
material = CreateMaterial(
    Diffuse=ColourSwatch(SwatchColor=RGB(224, 224, 224)),
    Specular=RGB(255, 255, 255),
    Emission=RGB(0, 0, 0),
    Transparency=Slider(0.25, range=0..1),
    Shine=0)
cmyk = ColourCMYK(Cyan=Slider(1, range=0..1), Magenta=0, Yellow=0, Key=0)
preview_2 = CustomPreview(Geometry=wbedges, Shader=material)
wbedges_2 = MeshEdges(Mesh=mesh)
cmyk_2 = ColourCMYK(Cyan=0, Magenta=0, Yellow=Slider(1, range=0..1), Key=0)
wbedges_3 = MeshEdges(Mesh=mesh_4)
cmyk_3 = ColourCMYK(Cyan=0, Magenta=Slider(1, range=0..1), Yellow=0, Key=0)
swatch = ColourSwatch(SwatchColor=RGB(191, 191, 191))
preview_3 = CustomPreview(Geometry=crv_4, Shader=cmyk)
swatch_2 = ColourSwatch(SwatchColor=RGB(79, 79, 79))
crv_5 = Curve(bang.Branch13)
cmyk_4 = ColourCMYK(Cyan=Slider(1, range=0..1), Magenta=0, Yellow=0, Key=0)
preview_4 = CustomPreview(Geometry=mesh, Shader=cmyk_2)
move = Move(Geometry=mesh_2, Translation=Z_3)  # -> Geometry, Transform
dash = DashPattern(Curve=[crv, crv_5], Pattern=[Slider(3, range=0..10), Slider(3, range=0..10)])  # -> Dashes, Gaps
preview_5 = CustomPreview(Geometry=brep, Shader=cmyk_3)
crv_6 = Curve(bang.Branch12)
cir = Circle(Plane=pt, Radius=Slider(5, range=0..10))
preview_6 = CustomPreview(Geometry=wbedges_2, Shader=ColourSwatch(SwatchColor=RGB(158, 158, 158)))
preview_7 = CustomPreview(Geometry=flatten(wbedges_3), Shader=ColourSwatch(SwatchColor=RGB(166, 163, 144)))
cmyk_5 = ColourCMYK(Cyan=Slider(1, range=0..1), Magenta=0, Yellow=Slider(1, range=0..1), Key=0)
preview_8 = CustomPreview(Geometry=[cir, pt, crv_6], Shader=ColourSwatch(SwatchColor=RGB(0, 0, 255)))
preview_9 = CustomPreview(Geometry=dash.Dashes, Shader=ColourSwatch(SwatchColor=RGB(0, 0, 0)))
preview_10 = CustomPreview(Geometry=mesh_4, Shader=ColourSwatch(SwatchColor=RGB(194, 194, 194)))
swatch_3 = ColourSwatch(SwatchColor=RGB(125, 150, 95))
preview_11 = CustomPreview(Geometry=move.Geometry, Shader=cmyk_5)
mcomp = Decompose(Mesh=flatten(mesh_3))  # -> Vertices, Faces, Colours, Normals
str_3 = String(mcomp.Faces)
python_5 = PythonScript(x=str_3, GhMemory=0)  # -> out, a
# ---------- python_5: Python ----------
a = str(x)[2:-1]
# ---------- end python_5 ----------
split = StringSplit(String=python_5.a, Separators=";")
lng = ListLength(List=split)
slider_4 = Slider(0.5, range=0..1)
slider_5 = Slider(1, range=0..1)
path_mapper = PathMapper(split, source="{a;b;c}", target="{b}")
int_2 = Integer(flatten(lng))
ma = MassAddition(Input=int_2)  # -> Result, PartialResult
item_3 = ListItem(List=mcomp.Vertices, Index=path_mapper, Wrap=False)
shift = ShiftList(List=ma.PartialResult, Shift=-1, Wrap=False)
weave = Weave(Pattern=[0, 1], Stream0="0", Stream1=shift, NullGaps=False)
pt_4 = Point(flatten(item_3))
series = Series(Start=weave, Step=1, Count=int_2)
panel_6 = Panel(item_3)
item_4 = ListItem(List=pt_4, Index=series, Wrap=False)
flip = FlipMatrix(Data=item_4)
bang_2 = ExplodeTree(Tree=flip)  # -> Branch1, Branch2, Branch3, Branch4
viewer_2 = ParamViewer(flip)
srf4pt = _4PointSurface(CornerA=bang_2.Branch1, CornerB=bang_2.Branch2, CornerC=bang_2.Branch3, CornerD=bang_2.Branch4)
preview_12 = CustomPreview(Geometry=srf4pt, Shader=ColourSwatch(SwatchColor=RGB(143, 143, 143)))
