# Grasshopper definition simpledatatree.ghx (Grasshopper 0.8.10)

panel = Panel("""a
b
c""")
graft = GraftTree(Data=panel, Strip=False)
graft_2 = GraftTree(Data=panel, Strip=False)
panel_2 = Panel([graft, graft_2])
python = PythonScript(x=[graft, graft_2], GhMemory=0)  # -> out, a; inputs x: tree
# ---------- python: Python ----------
# (to access gh types - here not needed)
# import clr
# clr.AddReference("Grasshopper")
# from Grasshopper.Kernel.Data import GH_Path
# from Grasshopper import DataTree

a = []

for i in range(x.BranchCount):
    branchList = x.Branch(i)
    branchPath = x.Path(i)
    
    for j in range(branchList.Count):
        s = str(branchPath) + "[" + str(j) + "] = "
        s += branchList[j]
        
        a.append(s)
# ---------- end python ----------
panel_3 = Panel(python.a)
