# Grasshopper definition site_grid.ghx (Grasshopper 0.8.10)

path = FilePath("C:\Users\demonchaux\Dropbox\localcode\site_ids.txt")
file = ReadFile(Path=path, Lines=True)
item = ListItem(List=file, Index=Slider(11, range=0..48), Wrap=False)
panel = Panel("""-terrain
-borders""")
concat = Concatenate(Start="C:\amigos\dump\", End=item)
concat_2 = Concatenate(Start=concat, End=panel)
panel_2 = Panel(file)
concat_3 = Concatenate(Start=concat_2, End=".3dm")
panel_3 = Panel("""groundsurface
site-projected""")
panel_4 = Panel(concat_3)
python = PythonScript(FilePaths=concat_3, LayerNames=panel_3, DoImport=Toggle(True), GhMemory=0)  # -> out, layerTree; inputs FilePaths: list, LayerNames: list
# ---------- python: Python ----------
import Rhino


# for accesssing GH classes
import clr
clr.AddReference("Grasshopper")
from Grasshopper.Kernel.Data import GH_Path
from Grasshopper import DataTree


# read geometry out of 3dm files and filter by layernames
if DoImport and FilePaths and LayerNames:
    
    layerTree = DataTree[Rhino.Geometry.GeometryBase]() # make a DataTree
    
    for filepath in FilePaths:
        model = Rhino.FileIO.File3dm.Read(filepath)
        if not model: continue
        for i, layer in enumerate(LayerNames):
            path = GH_Path(i)
            geometry = []
            objs = model.Objects.FindByLayer(layer)
            for obj in objs:
                geom = obj.Geometry
                geom.EnsurePrivateCopy()
                geometry.append(geom)
            layerTree.AddRange(geometry, path)
        # models can take up a considerable amount of
        # memory that we don't need, so get rid of it
        # after copying the geometry we want out of it
        model.Dispose()
# ---------- end python ----------
bang = ExplodeTree(Tree=python.layerTree)  # -> Branch1, Branch2
panel_5 = Panel("""6
3
2""")
pi = Pi(Factor=1)
crv = Curve(bang.Branch2)
srf = Surface(bang.Branch1)
xy = XYPlane(Origin=Point(0, 0, 0))
division = Division(A=pi, B=panel_5)
project = Project(Geometry=crv, Plane=xy)  # -> Geometry, Transform
xy_2 = XYPlane(Origin=Point(0, 0, 0))
viewer = ParamViewer(python.layerTree)
planar = PlanarSrf(Edges=project.Geometry)
panel_6 = Panel(python.out)
rotate = Rotate(Geometry=xy_2, Angle=division, Plane=xy_2)  # -> Geometry, Transform
bbox = BoundingBox(Content=crv, Union=True, Plane=rotate.Geometry)  # -> Box, Box_2
pcomp = PlaneComponents(Plane=rotate.Geometry)  # -> Origin, XAxis, YAxis, ZAxis
box = BoxComponents(Box=bbox.Box)  # -> Plane, X, Y, Z
slider = Slider(3, range=0..10)
domcomp = DomainComponents(Domain=box.X)  # -> Start, End
domcomp_2 = DomainComponents(Domain=box.Y)  # -> Start, End
panel_7 = Panel(python.layerTree)
amp = Amplitude(Vector=pcomp.XAxis, Amplitude=domcomp.Start)
amp_2 = Amplitude(Vector=pcomp.YAxis, Amplitude=domcomp_2.Start)
division_2 = Division(A=domcomp.End, B=slider)
division_3 = Division(A=domcomp_2.End, B=slider)
addition = Addition(A=amp, B=amp_2)
f_x = F1(Function="ceiling(x)", X=division_2)
move = Move(Geometry=rotate.Geometry, Translation=addition)  # -> Geometry, Transform
f_x_2 = F1(Function="ceiling(x)", X=division_3)
f_x_3 = F1(Function="(x*2)+1", X=f_x)
f_x_4 = F1(Function="(x*2)+1", X=f_x_2)
bang_2 = ExplodeTree(Tree=graft(move.Geometry))  # -> Branch0, Branch1, Branch2
bang_3 = ExplodeTree(Tree=graft(f_x_4))  # -> Branch0, Branch1, Branch2
bang_4 = ExplodeTree(Tree=graft(f_x_3))  # -> Branch0, Branch1, Branch2
merge = Merge(StreamA=bang_2.Branch0, StreamB=bang_2.Branch1)
merge_2 = Merge(StreamA=bang_3.Branch0, StreamB=bang_3.Branch1)
merge_3 = Merge(StreamA=bang_4.Branch0, StreamB=bang_4.Branch1)
f_x_5 = F1(Function="x*1.2", X=bang_3.Branch2)
f_x_6 = F1(Function="ceiling(x*3^0.5) * 1.1", X=bang_4.Branch2)
sqgrid = Square(Plane=merge, Size=slider, ExtentX=merge_3, ExtentY=merge_2)  # -> Cells, Points
trigrid = Triangular(Plane=bang_2.Branch2, Size=slider, ExtentX=f_x_6, ExtentY=f_x_5)  # -> Cells, Points
path_mapper = PathMapper(sqgrid.Points, source="{A;B;C;D}(i)", target="{B}")
concat_4 = Concatenate(Start=concat, End="-grid")
viewer_2 = ParamViewer(path_mapper)
concat_5 = Concatenate(Start=concat_4, End=".3dm")
bang_5 = ExplodeTree(Tree=path_mapper)  # -> Branch0, Branch1
flatten = FlattenTree(Data=trigrid.Points, Path="2")
panel_8 = Panel(concat_5)
m3 = Merge03(StreamA=flatten, StreamB=bang_5.Branch0, StreamC=bang_5.Branch1)
con = Containment(Point=m3, Curve=project.Geometry)  # -> Relationship, Point
larger = LargerThan(FirstNumber="2", SecondNumber=con.Relationship)  # -> LargerThan, OrEqualTo
panel_9 = Panel("""green
wild
hard""")
panel_10 = Panel("""-z
-base
-axes""")
dispatch = Dispatch(List=m3, DispatchPattern=larger.LargerThan)  # -> ListA, ListB
Z = UnitZ(Factor=1)
line = LineSDL(Start=dispatch.ListA, Direction=Z, Length=1)
concat_6 = Concatenate(Start=panel_9, End=panel_10, DataComparison="cross_reference")
green = Slider(0.25, range=0..1)
wild = Slider(0.146, range=0..1)
scx = SurfaceLine(Surface=srf, Line=line, Limit=True)  # -> Curves, Points, UVPoints, Normal
hard = Slider(0.542, range=0..1)
z = Slider(0.325, range=0..1)
base = Slider(0.325, range=0..1)
axes = Slider(0.863, range=0..1)
panel_11 = Panel(concat_6)
ln = Line(PointA=dispatch.ListA, PointB=scx.Points)
num = Number([green, wild, hard])
num_2 = Number([z, base, axes])
path_mapper_2 = PathMapper(dispatch.ListA, source="{a;b}", target="{1;a;b}")
path_mapper_3 = PathMapper(scx.Points, source="{a;b}", target="{0;a;b}")
path_mapper_4 = PathMapper(ln, source="{a;b}", target="{2;a;b}")
hsl = ColourHSL(Alpha=1, Hue=num, Saturation=1, Luminance=num_2, DataComparison="cross_reference")
m3_2 = Merge03(StreamA=path_mapper_3, StreamB=path_mapper_2, StreamC=path_mapper_4)
preview = CustomPreview(Geometry=m3_2, Shader=graft(hsl))
viewer_3 = ParamViewer(m3_2)
python_2 = PythonScript(FilePath=panel_8, LayerNames=concat_6, LayerColors=hsl, GeometryTree=m3_2, DoExport=Toggle(False), GhMemory=10)  # -> out, a; inputs FilePath: String, LayerNames: list of String, LayerColors: list of Color, GeometryTree: tree of GeometryBase, DoExport: Boolean
# ---------- python_2: Python ----------
import System
import System.Collections.Generic as SCG
import Rhino
import scriptcontext

import rhinoscriptsyntax as rs
from Rhino.FileIO import FileWriteOptions, FileReadOptions

def addRhinoLayer(layerName, layerColor=System.Drawing.Color.Black):
    """Creates a Layer in Rhino using a name and optional color. Returns the
    index of the layer requested. If the layer
    already exists, the color is updated and no new layer is created."""
    docLyrs = scriptcontext.doc.Layers
    layerIndex = docLyrs.Find(layerName, True)
    if layerIndex == -1:
        layerIndex = docLyrs.Add(layerName,layerColor)
    else: # it exists
        layer = docLyrs[layerIndex] # so get it
        if layer.Color != layerColor: # if it has a different color
            layer.Color = layerColor # reset the color
    return layerIndex

def layerAttributes(layerName, layerColor=System.Drawing.Color.Black):
    """Returns a Rhino ObjectAttributes object for a rhino layer with an optional color."""
    att = Rhino.DocObjects.ObjectAttributes()
    att.LayerIndex = addRhinoLayer(layerName, layerColor)
    return att

def deleteLayer(layerName, quiet=True):
    """Deletes a layer by Name. returns nothing."""
    layer_index = scriptcontext.doc.Layers.Find(layerName, True)
    settings = Rhino.DocObjects.ObjectEnumeratorSettings()
    settings.LayerIndexFilter = layer_index
    objs = scriptcontext.doc.Objects.FindByFilter(settings)
    ids = [obj.Id for obj in objs]
    scriptcontext.doc.Objects.Delete(ids, quiet)
    scriptcontext.doc.Layers.Delete(layer_index, quiet)

def bakeMany(listOfThings, objectAttributes=None):
    if not objectAttributes:
        objectAttributes = Rhino.DocObjects.ObjectAttributes()
    for thing in listOfThings:
        # move from specific to broad
        if isinstance(thing, Rhino.Geometry.Point3d):
            scriptcontext.doc.Objects.AddPoint(thing, objectAttributes)
        elif isinstance(thing, Rhino.Geometry.Point):
            scriptcontext.doc.Objects.AddPoint(thing.Location, objectAttributes)
        elif isinstance(thing, Rhino.Geometry.Curve):
            scriptcontext.doc.Objects.AddCurve(thing, objectAttributes)
        elif isinstance(thing, Rhino.Geometry.Surface):
            scriptcontext.doc.Objects.AddSurface(thing, objectAttributes)
        elif isinstance(thing, Rhino.Geometry.Brep):
            scriptcontext.doc.Objects.AddBrep(thing, objectAttributes)
        elif isinstance(thing, Rhino.Geometry.Mesh):
            scriptcontext.doc.Objects.AddSurface(thing, objectAttributes)
        elif isinstance(thing, Rhino.Geometry.Hatch):
            scriptcontext.doc.Objects.AddHatch(thing, objectAttributes)
        elif isinstance(thing, Rhino.Display.Text3d):
            scriptcontext.doc.Objects.AddText(thing, objectAttributes)
        else:
            print '''Unrecognized object type: %s''' % type(thing)

def deleteAll():
    """Deletes everything in the current Rhino scriptcontext.doc. Returns nothing."""
    guidList = []
    objType = Rhino.DocObjects.ObjectType.AnyObject
    objTable = scriptcontext.doc.Objects
    objs = objTable.GetObjectList(objType)
    for obj in objs:
        guidList.append(obj.Id)
    for guid in guidList:
        objTable.Delete(guid, True)

def exportFile(filePath,
        version=4,
        geomOnly=False,
        selectedOnly=False,
        ):
    '''Export a file.'''
    opt = FileWriteOptions()
    opt.FileVersion = version
    opt.WriteGeometryOnly = geomOnly
    opt.WriteSelectedObjectsOnly = selectedOnly
    return scriptcontext.doc.WriteFile(filePath, opt)

def exportLayers(layerNames, filePath, version=4):
    '''Export only the items on designated layers to a file.'''
    # save selection
    oldSelection = rs.SelectedObjects()
    # clear selection
    rs.UnselectAllObjects()
    # add everything on the layers to selection
    for name in layerNames:
        objs = scriptcontext.doc.Objects.FindByLayer(name)
        guids = [obj.Id for obj in objs]
        scriptcontext.doc.Objects.Select.Overloads[SCG.IEnumerable[System.Guid]](guids)
    # export selected items
    exportFile(filePath, version, selectedOnly=True)
    #clear selection
    rs.UnselectAllObjects()
    # restore selection
    if oldSelection:
        scriptcontext.doc.Objects.Select.Overloads[SCG.IEnumerable[System.Guid]](oldSelection)
    print 'exported %s' % filePath

# main script

if FilePath and DoExport and GeometryTree and LayerNames:
    numBranches = GeometryTree.BranchCount
    if numBranches == len(LayerNames):
        for i in range(GeometryTree.BranchCount):
            layer = LayerNames[i]
            if LayerColors and i < len(LayerColors):
                color = LayerColors[i]
            else:
                color = System.Drawing.Color.Black
            att = layerAttributes(layer, color)
            branchData = GeometryTree.Branch(i)
            bakeMany( branchData, att )
        exportLayers( LayerNames, FilePath )
        for lay in LayerNames:
            deleteLayer(lay)
    else:
        print '''Please ensure that there is one data tree branch
per layer name.'''
else:
    if DoExport:
        print '''Something is missing. Please make sure you input
a valid file path, a data tree of geometry (one branch per
layer), a list of layer names (one per branch), and that
you have entered 'True' into the 'DoExport' input.'''
# ---------- end python_2 ----------
panel_12 = Panel(python_2.out)
