# Grasshopper definition terrainMaker.ghx (Grasshopper 0.8.10)

path = FilePath("C:\Users\demonchaux\Dropbox\localcode\site_ids.txt")
file = ReadFile(Path=path, Lines=True)
item = ListItem(List=file, Index=Slider(49, range=0..49), Wrap=False)
panel = Panel(item)
concat = Concatenate(Start="C:\amigos\dump\", End=panel)
doclyrs = RhinoLayers()  # -> Layers, LayerColours
concat_2 = Concatenate(Start=concat, End="-site")
concat_3 = Concatenate(Start=concat_2, End=".3dm")
split = SplitList(List=doclyrs.Layers, Index="6")  # -> ListA, ListB
panel_2 = Panel(concat_3)
panel_3 = Panel(split.ListB)
item_2 = ListItem(List=split.ListB, Index=[Slider(12, range=0..31), Slider(2, range=0..31)], Wrap=False)
localcodeimport = LocalCodeImport(FilePathsForImport=concat_3, LayersToImport="tin_pts", OnOffSwitch=Toggle(False), DeleteExistingGeometry=Toggle(True))
panel_4 = Panel(item_2)
bang = ExplodeTree(Tree=localcodeimport)  # -> Branch1, Branch2
multiplication = Multiplication(A="300", B="-1")
division = Division(A="300", B="4")
dom = Domain(DomainStart=multiplication, DomainEnd="300")
addition = Addition(A=division, B="1")
range = Range(Domain=dom, Steps=division)
pt = PointXYZ(XComponent=range, YComponent=range, ZComponent=0, DataComparison="cross_reference")
Z = UnitZ(Factor=1)
meshray = MeshRay(Mesh=bang.Branch1, Point=pt, Direction=Z)  # -> Point, Hit
srfgrid = SurfaceFromPoints(Points=meshray.Point, UCount=addition, Interpolate=False)
bbox = BoundingBox(Content=srfgrid, Union=False, Plane=PlaneXY(0, 0, 0))  # -> Box, Box_2
box = BoxComponents(Box=bbox.Box)  # -> Plane, X, Y, Z
domcomp = DomainComponents(Domain=box.Z)  # -> Start, End
slider = Slider(0.5, range=0..1)
int = Integer(domcomp.Start)
int_2 = Integer(domcomp.End)
subtraction = Subtraction(A=domcomp.End, B=domcomp.Start)
dom_2 = Domain(DomainStart=int, DomainEnd=int_2)
division_2 = Division(A=subtraction, B=slider)
repeat = RepeatData(Data="1", Length="9")
series = Series(Start=domcomp.Start, Step=slider, Count=division_2)
pt_2 = PointXYZ(XComponent=0, YComponent=0, ZComponent=series)
weave = Weave(Pattern=[0, 1], Stream0="0", Stream1=repeat, NullGaps=False)
xy = XYPlane(Origin=pt_2)
dispatch = Dispatch(List=xy, DispatchPattern=weave)  # -> ListA, ListB
series_2 = Series(Start=0, Step=1, Count=10)
sec = BrepPlane(Brep=srfgrid, Plane=dispatch.ListA)  # -> Curves, Points
sec_2 = BrepPlane(Brep=srfgrid, Plane=dispatch.ListB)  # -> Curves, Points
int_3 = Integer(series_2)
panel_5 = Panel("""{
}""")
split_2 = SplitList(List=int_3, Index="3")  # -> ListA, ListB
weave_2 = Weave(Pattern=[0, 1], Stream0=panel_5, Stream1=graft(split_2.ListA), NullGaps=False)
join = StringJoin(Strings=weave_2)
bang_2 = ExplodeTree(Tree=join)  # -> Branch0, Branch1, Branch2
flatten = FlattenTree(Data=sec_2.Curves, Path=bang_2.Branch2)
flatten_2 = FlattenTree(Data=sec.Curves, Path=bang_2.Branch1)
flatten_3 = FlattenTree(Data=srfgrid, Path=bang_2.Branch0)
panel_6 = Panel(join)
panel_7 = Panel(item)
panel_8 = Panel("""groundsurface
smallcontours
bigcontours""")
m3 = Merge03(StreamA=flatten_3, StreamB=flatten_2, StreamC=flatten)
concat_4 = Concatenate(Start="C:\amigos\dump\", End=panel_7)
concat_5 = Concatenate(Start=concat_4, End="-terrain")
concat_6 = Concatenate(Start=concat_5, End=".3dm")
localcodeexport = LocalCodeExport(
    DestinationFilePath=concat_6,
    Export=Toggle(False),
    LayerNames=panel_8,
    LayerColors=[ColourSwatch(SwatchColor=RGB(255, 255, 255)), ColourSwatch(SwatchColor=RGB(120, 120, 120)), ColourSwatch(SwatchColor=RGB(0, 0, 0))],
    GeometryTree=m3)
panel_9 = Panel(concat_6)
