# Grasshopper definition terraindrain.ghx (Grasshopper 0.8.11)

panel = Panel("150")
panel_2 = Panel("""-terrain
-borders
-billboardpoints
-billboards""")
path = FilePath("C:\Users\demonchaux\Dropbox\localcode\site_ids.txt")
file = ReadFile(Path=path, Lines=True)
item = ListItem(List=file, Index=Slider(48, range=0..48), Wrap=False)
panel_3 = Panel("""-site
-transportation
-drains
-water""")
concat = Concatenate(Start="C:\amigos\dump\", End=item)
panel_4 = Panel("""openchannels
gravitymains
lateraldrains
catchbasins
bikeways
drp_trails
hydrography""")
panel_5 = Panel(item)
concat_2 = Concatenate(Start=concat, End=panel_2)
panel_6 = Panel("""freeways
metrobusstops-projected""")
panel_7 = Panel("""foundbillboards-projected
geocodedbillboards-projected
billboards""")
concat_3 = Concatenate(Start=concat, End=panel_3)
panel_8 = Panel("""groundsurface
site-projected
parcel-projected""")
concat_4 = Concatenate(Start=concat_2, End=".3dm")
concat_5 = Concatenate(Start=concat_3, End=".3dm")
concat_6 = Concatenate(Start=panel_4, End="-projected")
merge = Merge(StreamA=panel_6, StreamB=concat_6)
python = PythonScript(FilePaths=concat_5, LayerNames=merge, DoImport=Toggle(True), GhMemory=0)  # -> out, layerTree, availableLayers; inputs FilePaths: list, LayerNames: list
# ---------- python: Python ----------
import Rhino


# for accesssing GH classes
import clr
clr.AddReference("Grasshopper")
from Grasshopper.Kernel.Data import GH_Path
from Grasshopper import DataTree


# read geometry out of 3dm files and filter by layernames
if DoImport and FilePaths and LayerNames:
    
    layerTree = DataTree[Rhino.Geometry.GeometryBase]() # make a DataTree
    availableLayers = []
    for filepath in FilePaths:
        model = Rhino.FileIO.File3dm.Read(filepath)
        for lay in model.Layers:
            availableLayers.append(lay.Name)
        if not model: continue
        for i, layer in enumerate(LayerNames):
            path = GH_Path(i)
            geometry = []
            objs = model.Objects.FindByLayer(layer)
            for obj in objs:
                geom = obj.Geometry
                geom.EnsurePrivateCopy()
                geometry.append(geom)
            layerTree.AddRange(geometry, path)
        
        # models can take up a considerable amount of
        # memory that we don't need, so get rid of it
        # after copying the geometry we want out of it
        model.Dispose()
# ---------- end python ----------
merge_2 = Merge(StreamA=panel_8, StreamB=panel_7)
python_2 = PythonScript(FilePaths=concat_4, LayerNames=merge_2, DoImport=Toggle(True), GhMemory=0)  # -> out, layerTree, availableLayers; inputs FilePaths: list, LayerNames: list; same code as python
bang = ExplodeTree(Tree=python.layerTree)  # -> Branch1, Branch2, Branch3, Branch4, Branch5, Branch6, Branch7, Branch8, Branch9, Branch10
bang_2 = ExplodeTree(Tree=python_2.layerTree)  # -> Branch0, Branch1, Branch2, Branch3, Branch4, Branch5, Branch6, Branch7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
panel_9 = Panel(merge_2)
xy = XYPlane(Origin=Point(0, 0, 0))
site_outline = Curve(bang_2.Branch1)
xy_2 = XYPlane(Origin=Point(0, 0, 0))
project = Project(Geometry=bang_2.Branch1, Plane=xy)  # -> Geometry, Transform
project_2 = Project(Geometry=bang_2.Branch1, Plane=xy_2)  # -> Geometry, Transform
fit = FitCrv(Curve=project.Geometry, Degree="1", Tolerance=Slider(0.462, range=0..1))
crv = Curve(fit)
srfsplit = SurfaceSplit(Surface=bang_2.Branch0, Curves=site_outline)
dispatch = Dispatch(List=srfsplit, DispatchPattern=[True, False])  # -> ListA, ListB
srf = Surface(dispatch.ListB)
azimuth = Slider(105, range=0..359)
altitude = Slider(45, range=0..90)
crv_2 = Curve(site_outline)
slider = Slider(0.5, range=0..1)
f_x = F1(Function="x*pi/180", X=azimuth)
preview = CustomPreview(Geometry=crv_2, Shader=ColourSwatch(SwatchColor=RGB(0, 242, 255)))
f_x_2 = F1(Function="x*pi/180", X=altitude)
panel_10 = Panel(f_x)
multiplication = Multiplication(A=f_x_2, B=-1)
cp = ControlPoints(Curve=crv_2)  # -> Points, Weights, Knots
pline = PolyLine(Vertices=cp.Points, Closed=False)
Y = UnitY(Factor=1)
Z = UnitZ(Factor=1)
rev = Reverse(Vector=Y)
pcen = PolygonCenter(Polyline=pline)
vrot = Rotate(Vector=rev, Axis=Z, Angle=f_x)
Z_2 = UnitZ(Factor=1)
pl = Plane(Origin=pcen, XAxis=vrot, YAxis=Z_2)
panel_11 = Panel("""6
3
2""")
pi = Pi(Factor=1)
rotate = Rotate(Geometry=pl, Angle=multiplication, Plane=pl)  # -> Geometry, Transform
division = Division(A=pi, B=panel_11)
pcomp = PlaneComponents(Plane=rotate.Geometry)  # -> Origin, XAxis, YAxis, ZAxis
xy_3 = XYPlane(Origin=Point(0, 0, 0))
amp = Amplitude(Vector=pcomp.XAxis, Amplitude=Slider(61, range=0..100))
rotate_2 = Rotate(Geometry=xy_3, Angle=division, Plane=xy_3)  # -> Geometry, Transform
python_3 = PythonScript(geometry=crv_2, scaleFactor=Slider(0, range=-50..100), GhMemory=10)  # -> out, a; inputs geometry: GeometryBase, scaleFactor: Double
# ---------- python_3: Python ----------
import scriptcontext

vp = scriptcontext.doc.Views.ActiveView.ActiveViewport
bbox = geometry.GetBoundingBox(True)
bbox.Inflate(-scaleFactor)
vp.ZoomBoundingBox(bbox)
# ---------- end python_3 ----------
python_4 = PythonScript(geometry=crv_2, view_vector=pcomp.XAxis, center_point=pcomp.Origin, GhMemory=0)  # -> out, a; inputs view_vector: Vector3d, center_point: Point3d
# ---------- python_4: Python ----------
import Rhino
import scriptcontext

viewport = scriptcontext.doc.Views.ActiveView.ActiveViewport

viewport.SetCameraDirection(view_vector, True)
viewport.SetCameraTarget(center_point, True)
plane = viewport.GetCameraFrame()[1]

#plane = Rhino.Geometry.Plane(center_point, view_vector)

bbox = geometry.GetBoundingBox(plane)
a = [bbox, plane]
# ---------- end python_4 ----------
bbox = BoundingBox(Content=site_outline, Union=True, Plane=rotate_2.Geometry)  # -> Box, Box_2
pcomp_2 = PlaneComponents(Plane=rotate_2.Geometry)  # -> Origin, XAxis, YAxis, ZAxis
distance_between_grid_points = Slider(9, range=0..10)
box = BoxComponents(Box=bbox.Box)  # -> Plane, X, Y, Z
vdis = VectorDisplay(Anchor=pcen, Vector=amp)
dispatch_2 = Dispatch(List=python_4.a, DispatchPattern=[True, False])  # -> ListA, ListB
domcomp = DomainComponents(Domain=box.X)  # -> Start, End
domcomp_2 = DomainComponents(Domain=box.Y)  # -> Start, End
amp_2 = Amplitude(Vector=pcomp_2.XAxis, Amplitude=domcomp.Start)
amp_3 = Amplitude(Vector=pcomp_2.YAxis, Amplitude=domcomp_2.Start)
xy_4 = XYPlane(Origin=Point(0, 0, 0))
pln = Plane(dispatch_2.ListB)
box_2 = Box(dispatch_2.ListA)
addition = Addition(A=amp_2, B=amp_3)
division_2 = Division(A=domcomp.End, B=distance_between_grid_points)
division_3 = Division(A=domcomp_2.End, B=distance_between_grid_points)
orient = Orient(Geometry=box_2, Initial=xy_4, Final=pln)  # -> Geometry, Transform
move = Move(Geometry=rotate_2.Geometry, Translation=addition)  # -> Geometry, Transform
panel_12 = Panel(python_4.a)
f_x_3 = F1(Function="ceiling(x)", X=division_2)
f_x_4 = F1(Function="ceiling(x)", X=division_3)
explode = BrepComponents(Brep=orient.Geometry)  # -> Faces, Edges, Vertices
f_x_5 = F1(Function="(x*2)+1", X=f_x_4)
join = BrepJoin(Breps=explode.Faces)  # -> Breps, Closed
bang_3 = ExplodeTree(Tree=graft(move.Geometry))  # -> Branch0, Branch1, Branch2
f_x_6 = F1(Function="(x*2)+1", X=f_x_3)
bang_4 = ExplodeTree(Tree=graft(f_x_6))  # -> Branch0, Branch1, Branch2
bang_5 = ExplodeTree(Tree=graft(f_x_5))  # -> Branch0, Branch1, Branch2
f_x_7 = F1(Function="ceiling(x*3^0.5) * 1.1", X=f_x_6)
f_x_8 = F1(Function="x*1.2", X=f_x_5)
sqgrid = Square(Plane=bang_3.Branch0, Size=distance_between_grid_points, ExtentX=bang_4.Branch0, ExtentY=bang_5.Branch0)  # -> Cells, Points
sqgrid_2 = Square(Plane=bang_3.Branch1, Size=distance_between_grid_points, ExtentX=bang_4.Branch1, ExtentY=bang_5.Branch1)  # -> Cells, Points
trigrid = Triangular(Plane=bang_3.Branch2, Size=distance_between_grid_points, ExtentX=f_x_7, ExtentY=f_x_8)  # -> Cells, Points
panel_13 = Panel("""0
1
2""")
explode_2 = Explode(Curve=trigrid.Cells, Recursive=True)  # -> Segments, Vertices
cset = CreateSet(List=flatten(sqgrid.Points))
cset_2 = CreateSet(List=flatten(sqgrid_2.Points))
cset_3 = CreateSet(List=flatten(explode_2.Vertices))
bang_6 = ExplodeTree(Tree=graft(panel_13))  # -> Branch1, Branch2, Branch3
flat_site_outline = Curve(project_2.Geometry)
flatten = FlattenTree(Data=cset, Path=bang_6.Branch3)
flatten_2 = FlattenTree(Data=cset_2, Path=bang_6.Branch2)
flatten_3 = FlattenTree(Data=cset_3, Path=bang_6.Branch1)
m3 = Merge03(StreamA=flatten_3, StreamB=flatten_2, StreamC=flatten)
con = Containment(Point=m3, Curve=flat_site_outline)  # -> Relationship, Point
f_x_9 = F1(Function="x<2", X=con.Relationship)
dispatch_3 = Dispatch(List=m3, DispatchPattern=f_x_9)  # -> ListA, ListB
mesh = MeshBrep(
    Brep=dispatch.ListB,
    Settings={Refine=True, JaggedSeams=False, SimplePlanes=True, GridMinCount=16, GridMaxCount=0, Tolerance=0, RefineAngle=0, MinTolerance=0, RelativeTolerance=0.65, MinEdgeLength=0.0001, MaxEdgeLength=0})
Z_3 = UnitZ(Factor=1)
meshray = MeshRay(Mesh=flatten(mesh), Point=dispatch_3.ListA, Direction=Z_3)  # -> Point, Hit
grids_at_elevation = Point(meshray.Point)
clean = CleanTree(Data=grids_at_elevation, CleanInvalid=True, CleanEmpty=False)
bang_7 = ExplodeTree(Tree=clean)  # -> Branch1, Branch2, Branch3
circle = Circle(bang.Branch6)
plant_grid = Point(bang_7.Branch2)
pt = Point(circle)
xy_5 = XYPlane(Origin=Point(0, 0, 0))
project_3 = Project(Geometry=pt, Plane=xy_5)  # -> Geometry, Transform
con_2 = Containment(Point=project_3.Geometry, Curve=project.Geometry)  # -> Relationship, Point
pcomp_3 = Decompose(Point=plant_grid)  # -> XComponent, YComponent, ZComponent
f_x_10 = F1(Function="x<2", X=con_2.Relationship)
area = BrepArea(Brep=crv)  # -> Area, Centroid
pcomp_4 = Decompose(Point=plant_grid)  # -> XComponent, YComponent, ZComponent
crv_3 = Curve(bang_2.Branch1)
dispatch_4 = Dispatch(List=pt, DispatchPattern=f_x_10)  # -> ListA, ListB
sort = SortList(Keys=pcomp_4.ZComponent, ValuesA=plant_grid)  # -> List, ValuesA
approximate_site_area = Number(area.Area)
null = NullItem(Items=dispatch_4.ListA)  # -> NullFlags, InvalidFlags
lng = ListLength(List=dispatch_4.ListA)
len = Length(Curve=crv_3)
not = GateNot(A=null.NullFlags)
item_2 = ListItem(List=sort.ValuesA, Index=0, Wrap=False)
and = GateAnd(A=lng, B=not)
division_4 = Division(A=approximate_site_area, B=len)
weave = Weave(Pattern=and, Stream0=item_2, Stream1=dispatch_4.ListA, NullGaps=False)
division_5 = Division(A=division_4, B=Slider(10.3, range=0..20))
int = Integer(division_5)
python_5 = PythonScript(curve=crv_3, point=weave, GhMemory=0)  # -> out, a
# ---------- python_5: Python ----------
import Rhino

if curve and point:
    bbox = curve.GetBoundingBox(True)
    farpoint = bbox.FurthestPoint(point)
    t = curve.ClosestPoint(farpoint)[1]
    newpoint = curve.PointAt(t)
    a = newpoint
# ---------- end python_5 ----------
div = DivideDomain(Domain=crv_3, Count=division_5)
f_x_11 = F1(Function="x<=1", X=int)
panel_14 = Panel(f_x_11)
subcrv = SubCurve(BaseCurve=crv_3, Domain=div)
curvepoint = PointOnCurve(subcrv, parameter=0.5)
pt_2 = Point(flatten([curvepoint, python_5.a]))
dist = Distance(PointA=weave, PointB=pt_2)
sort_2 = SortList(Keys=dist, ValuesA=pt_2)  # -> List, ValuesA
rev_2 = ReverseList(List=sort_2.ValuesA)
item_3 = ListItem(List=rev_2, Index=0, Wrap=False)
bnd = Bounds(Numbers=pcomp_3.ZComponent)
drain_drop = Slider(0.5, range=0..1)
weave_2 = Weave(Pattern=f_x_11, Stream0=curvepoint, Stream1=item_3, NullGaps=False)
minimum_branch_length = Slider(26.6, range=0..50)
domcomp_3 = DomainComponents(Domain=bnd)  # -> Start, End
ln = Line(PointA=weave, PointB=weave_2)
subtraction = Subtraction(A=domcomp_3.Start, B=drain_drop)
len_2 = Length(Curve=ln)
sqrt = SquareRoot(Input=approximate_site_area)
f_x_y = F2(Function="x>y", X=len_2, Y=minimum_branch_length)
multiplication_2 = Multiplication(A=sqrt, B=Slider(0.12, range=0..1))
dispatch_5 = Dispatch(List=ln, DispatchPattern=f_x_y)  # -> ListA, ListB
multiplication_3 = Multiplication(A=multiplication_2, B=-1)
srf_2 = Surface(srf)
ext = Extend(Curve=dispatch_5.ListA, Type=0, Start=0, End=multiplication_3)
crv_4 = Curve(ext)
end = EndPoints(Curve=crv_4)  # -> Start, End
srf_cp = SurfaceCP(Point=end.End, Surface=srf)  # -> Point, UVPoint, Distance
pt_3 = Point(srf_cp.Point)
python_6 = PythonScript(
    startPoint=pt_3,
    terrainSurface=srf_2,
    stepSize=Slider(1, range=0..10),
    maxSteps=Slider(556, range=0..1000),
    tol=Slider(0.1, range=0..1),
    alternate=crv_4,
    GhMemory=0)  # -> out, a, b; inputs startPoint: Point3d, terrainSurface: Surface, stepSize: Double, maxSteps: Int32, tol: Double, alternate: Curve
# ---------- python_6: Python ----------
import Rhino



class DrainBoid(object):
    def __init__(self, point3d, surface, stepsize=0.5, maxsteps=None, tolerance=0.001):
        self.start = point3d
        self.pos = self.start
        result, self.u, self.v = surface.ClosestPoint(self.pos)
        self.surface = surface
        self.stepsize = stepsize
        self.points = [self.start]
        self.state = 'on'
        self.step=0
        self.tolerance = tolerance
        self.maxsteps = maxsteps

    def makeDrainCurve(self):
        while self.state == 'on':
            self.step += 1
            if self.maxsteps:
                if self.step >= self.maxsteps:
                    self.state = 'finished'
            self.nextStep()
        return Rhino.Geometry.Curve.CreateControlPointCurve(self.points, 1)

    def nextStep(self):
        result, newFrame = self.surface.FrameAt(self.u, self.v)
        # create a vector from newFrame XAxis
        downVect = newFrame.XAxis
        # figure out hw far to rotate it.
        deltaAngle = Rhino.Geometry.Vector3d.VectorAngle( downVect, Rhino.Geometry.Vector3d(0.0, 0.0, -1.0), newFrame )
        # rotate it in the plane
        downVect.Rotate( deltaAngle, newFrame.ZAxis)
        # set the length
        downVect = downVect.Multiply( self.stepsize, downVect )
        spacePoint = Rhino.Geometry.Point3d.Add(self.pos, downVect)
        result, self.u, self.v = self.surface.ClosestPoint(spacePoint)
        out, newPoint, vects = self.surface.Evaluate(self.u, self.v, 0)
        if newPoint.Z >= self.pos.Z: # if higher
            self.state = 'finished'
        elif not self.checkTolerance(newPoint): # if too close
            self.state = 'finished'
        else:
            self.updatePos( newPoint )

    def updatePos(self, newPoint):
        self.points.append(newPoint)
        self.pos = newPoint

    def checkTolerance(self, other):
        # checks against another point
        # if it is outside of tolerance, returns True
        return self.pos.DistanceTo( other ) > self.tolerance


b = DrainBoid(startPoint, terrainSurface, stepSize, maxSteps, tol)
a = b.makeDrainCurve() or alternate
# ---------- end python_6 ----------
panel_15 = Panel(python_6.a)
crv_5 = Curve(python_6.a)
lng_2 = ListLength(List=crv_5)
series = Series(Start=0, Step=1, Count=lng_2)
crv_cp = CurveCP(Point=graft(plant_grid), Curve=flatten(crv_5))  # -> Point, Parameter, Distance
sort_3 = SortList(Keys=crv_cp.Distance, ValuesA=flatten(series))  # -> List, ValuesA
sort_4 = SortList(Keys=crv_cp.Distance, ValuesA=crv_cp.Parameter)  # -> List, ValuesA
item_4 = ListItem(List=sort_3.ValuesA, Index=0, Wrap=False)
item_5 = ListItem(List=sort_4.ValuesA, Index=0, Wrap=False)
item_6 = ListItem(List=sort_4.List, Index=0, Wrap=False)
graft = GraftTree(Data=flatten(plant_grid), Strip=False)
panel_16 = Panel("""0
1
2""")
weave_3 = Weave(Pattern=panel_16, Stream0=item_6, Stream1=item_4, Stream2=item_5, NullGaps=False)
flip = FlipMatrix(Data=weave_3)
bang_8 = ExplodeTree(Tree=flip)  # -> Branch1, Branch2, Branch3
preview_2 = CustomPreview(Geometry=crv_5, Shader=ColourSwatch(SwatchColor=RGB(0, 0, 255)))
viewer = ParamViewer(graft)
curve_number = Integer(bang_8.Branch2)
graft_2 = GraftTree(Data=flatten(bang_8.Branch1), Strip=False)
viewer_2 = ParamViewer(graft_2)
replace = ReplaceBranches(Data=graft_2, Search=viewer_2, Replace=curve_number)
replace_2 = ReplaceBranches(Data=graft, Search=viewer, Replace=curve_number)
drain_point = Point(weave)
distance = Number(replace)
drain_point_distance = Slider(12, range=0..50)
graft_3 = GraftTree(Data=flatten(bang_8.Branch3), Strip=False)
viewer_3 = ParamViewer(graft_3)
replace_3 = ReplaceBranches(Data=graft_3, Search=viewer_3, Replace=curve_number)
f_x_y_2 = F2(Function="x<y", X=distance, Y=drain_point_distance)
dispatch_6 = Dispatch(List=replace_2, DispatchPattern=f_x_y_2)  # -> ListA, ListB
dispatch_7 = Dispatch(List=replace_3, DispatchPattern=f_x_y_2)  # -> ListA, ListB
points = Point(dispatch_6.ListA)
parameter_value = Number(dispatch_7.ListA)
sort_5 = SortList(Keys=parameter_value, ValuesA=points)  # -> List, ValuesA

# ----
# Drainage Area Blobs
drain_point_distance_2 = Slider(28.6, range=0..50)  # disabled
slider_2 = Slider(0, range=0..1)  # disabled
dom = Domain(DomainStart=slider_2, DomainEnd=drain_point_distance_2)  # disabled
remap = RemapNumbers(Values=distance, Source=dom, Target=Domain(0, 1))  # disabled
drain_point_distance_3 = Slider(18.9, range=0..50)  # disabled
xy_6 = XYPlane(Origin=Point(0, 0, 0))  # disabled
graph = GraphMapper(
    remap,
    x0=0,
    x1=1,
    y0=0,
    y1=1,
    container_name="Bezier",
    cpx=[0, 0.3299224377, 0.02149499021, 1],
    cpy=[1, 0.03795244917, 0, 0])  # disabled
project_4 = Project(Geometry=replace_2, Plane=xy_6)  # -> Geometry, Transform; disabled
division_6 = Division(A=drain_point_distance_2, B=drain_point_distance_3)  # disabled
slider_3 = Slider(0.482, range=0..1)  # disabled
remap_2 = RemapNumbers(Values=graph, Source=Domain(0, 1), Target=dom)  # disabled
pcomp_5 = Decompose(Point=drain_point)  # -> XComponent, YComponent, ZComponent; disabled
panel_17 = Panel(remap_2)  # disabled
metaball_t = MetaBallTCustom(
    Points=flatten(project_4.Geometry),
    Charge=flatten(remap_2),
    Plane=PlaneXY(0, 0, 0),
    Threshold=division_6,
    Accuracy=slider_3)  # disabled
Z_4 = UnitZ(Factor=pcomp_5.ZComponent)  # disabled
move_2 = Move(Geometry=metaball_t, Translation=Z_4)  # -> Geometry, Transform; disabled

# ----
# Graded Terrain Mesh
distances_from_each_grid_point_to_closes = Number(distance)  # "Distances From each Grid Point to Closest Drainage Path"
grid_points_organized_by_closest_drain_p = Point(replace_2)  # "grid points organized by closest drain path"
drain_line_points = Point(sort_5.ValuesA)
drain_drop_2 = Number(drain_drop)
lowest_grid_z_minus_drain_drop = Number(subtraction)
cp_2 = ClosestPoint(Point=grid_points_organized_by_closest_drain_p, Set=drain_line_points)  # -> ClosestPoint, CPIndex, Distance
pcomp_6 = Decompose(Point=drain_line_points)  # -> XComponent, YComponent, ZComponent
pcomp_7 = Decompose(Point=grid_points_organized_by_closest_drain_p)  # -> XComponent, YComponent, ZComponent
bnd_2 = Bounds(Numbers=cp_2.Distance)
subtraction_2 = Subtraction(A=pcomp_6.ZComponent, B=drain_drop_2)
remap_3 = RemapNumbers(Values=cp_2.Distance, Source=bnd_2, Target=Domain(0, 1))
item_7 = ListItem(List=subtraction_2, Index=cp_2.CPIndex, Wrap=False)
panel_18 = Panel(bnd_2)
graph_2 = GraphMapper(
    remap_3,
    x0=0,
    x1=1,
    y0=0,
    y1=1,
    container_name="Bezier",
    cpx=[0, 0.2115956247, 0.04927394539, 1],
    cpy=[0, 0, 0.9927536249, 1])
pt_4 = PointXYZ(XComponent=pcomp_6.XComponent, YComponent=pcomp_6.YComponent, ZComponent=subtraction_2)
dropped_z_of_closest_drain_path_point = Number(item_7)
bnd_3 = Bounds(Numbers=graph_2)
dom_2 = Domain(DomainStart=dropped_z_of_closest_drain_path_point, DomainEnd=pcomp_7.ZComponent)
remap_4 = RemapNumbers(Values=graph_2, Source=Domain(0, 1), Target=dom_2)
pt_5 = PointXYZ(XComponent=pcomp_7.XComponent, YComponent=pcomp_7.YComponent, ZComponent=remap_4)
cyl = Cylinder(Base=flatten(pt_5), Radius=Slider(1, range=0..1), Length=1)
del = DelaunayMesh(Points=flatten(pt_5), Plane=PlaneXY(0, 0, 0))
cap = CapHoles(Brep=cyl)
bnd_4 = Bounds(Numbers=flatten(remap_4))
dom_3 = Domain(DomainStart=Slider(0.666, range=0..1), DomainEnd=Slider(0, range=0..1))
wbedges = MeshEdges(Mesh=del)
preview_3 = CustomPreview(Geometry=del, Shader=ColourSwatch(SwatchColor=RGB(209, 209, 209)))
explode_3 = BrepComponents(Brep=cap)  # -> Faces, Edges, Vertices
dom_4 = Domain(DomainStart=Slider(0.34, range=0..1), DomainEnd=Slider(0, range=0..1))
remap_5 = RemapNumbers(Values=flatten(remap_4), Source=bnd_4, Target=dom_3)
dom_5 = Domain(DomainStart=Slider(0.238, range=0..1), DomainEnd=Slider(1, range=0..1))
preview_4 = CustomPreview(Geometry=wbedges, Shader=ColourSwatch(SwatchColor=RGB(217, 217, 217)))
remap_6 = RemapNumbers(Values=flatten(remap_4), Source=bnd_4, Target=dom_4)
item_8 = ListItem(List=explode_3.Faces, Index=Slider(0, range=0..10), Wrap=False)
remap_7 = RemapNumbers(Values=flatten(remap_4), Source=bnd_4, Target=dom_5)
cmyk = ColourCMYK(Cyan=remap_5, Magenta=remap_6, Yellow=remap_7, Key=0)

pcomp_8 = Decompose(Point=flatten(pt_5))  # -> XComponent, YComponent, ZComponent
sort_6 = SortList(Keys=pcomp_8.ZComponent, ValuesA=flatten(pt_5))  # -> List, ValuesA
Z_5 = UnitZ(Factor=1)  # disabled
item_9 = ListItem(List=sort_6.ValuesA, Index=0, Wrap=False)
project_5 = Project(Curve=metaball_t, Brep=srf, Direction=Z_5)  # disabled
swatch = ColourSwatch(SwatchColor=RGB(0, 175, 0))  # disabled
preview_5 = CustomPreview(Geometry=project_5, Shader=swatch)  # disabled
preview_6 = CustomPreview(Geometry=flatten(item_8), Shader=cmyk)
flatten_4 = FlattenTree(Data=pt_5, Path="{0}")
series_2 = Series(Start=0, Step=1, Count=Slider(5, range=0..10))
bang_9 = ExplodeTree(Tree=graft(series_2))  # -> Branch1, Branch2, Branch3, Branch4, Branch5
drainpointdistnaces = Number(distance)
drainpointgroups = Point(replace_2)
terrainmeshpoints = Point(flatten_4)
terrainmeshlines = Curve(wbedges)
new_drain_point = Point(item_9)
terrainmesh = Mesh(del)
draincurves = Curve(crv_5)
site_id = String(item)
panel_19 = Panel("""drainpoint
draincurves
terrainmesh
terrainmeshlines
terrainmeshpoints""")
concat_7 = Concatenate(Start="/amigos/db/", End=site_id)
concat_8 = Concatenate(Start=concat_7, End=panel_19)
bang_10 = ExplodeTree(Tree=graft(concat_8))  # -> Branch1, Branch2, Branch3, Branch4, Branch5, Branch6, Branch7
toggle = BooleanToggle(False)
python_7 = PythonScript(data=new_drain_point, path=bang_10.Branch1, write=toggle, GhMemory=0)  # -> out, a; inputs data: list
# ---------- python_7: Python ----------
import cPickle as pickle

if path and data and write:
    f = open(path, 'wb')
    pickle.dump(data, f)
    f.close()
# ---------- end python_7 ----------
python_8 = PythonScript(data=draincurves, path=bang_10.Branch2, write=toggle, GhMemory=0)  # -> out, a; inputs data: list; same code as python_7
python_9 = PythonScript(data=terrainmesh, path=bang_10.Branch3, write=toggle, GhMemory=0)  # -> out, a; inputs data: list; same code as python_7
python_10 = PythonScript(data=terrainmeshlines, path=bang_10.Branch4, write=toggle, GhMemory=0)  # -> out, a; inputs data: list; same code as python_7
python_11 = PythonScript(data=terrainmeshpoints, path=bang_10.Branch5, write=toggle, GhMemory=0)  # -> out, a; inputs data: list; same code as python_7

cset_4 = CreateSet(List=drain_point)
item_10 = ListItem(List=sort_5.ValuesA, Index=0, Wrap=False)
cset_5 = CreateSet(List=flatten(item_10))
pline_2 = PolyLine(Vertices=sort_5.ValuesA, Closed=False)
fsim = FindSimilarMember(Data=cset_4, Set=flatten(cset_5))  # -> Hit, Index
item_11 = ListItem(List=flatten(pline_2), Index=fsim.Index, Wrap=False)
cull_i = CullIndex(List=cset_5, Indices=fsim.Index, Wrap=False)
crv_cp_2 = CurveCP(Point=graft(cull_i), Curve=item_11)  # -> Point, Parameter, Distance
lng_3 = ListLength(List=flatten(pline_2))
ln_2 = Line(PointA=crv_cp_2.Point, PointB=graft(cull_i))
cull_i_2 = CullIndex(List=flatten(pline_2), Indices=fsim.Index, Wrap=False)
f_x_12 = F1(Function="x>1", X=lng_3)
weave_4 = Weave(Pattern=[0, 1], Stream0=ln_2, Stream1=graft(cull_i_2), NullGaps=False)
lng_4 = ListLength(List=cull_i_2)
join_2 = JoinCurves(Curves=weave_4, Preserve=False)
weave_5 = Weave(Pattern=[0, 1], Stream0=item_11, Stream1=flatten(join_2), NullGaps=False)
python_12 = PythonScript(x=flatten(weave_5), y=pline_2, GhMemory=0)  # -> out, a
# ---------- python_12: Python ----------
if x:
    a = x
else:
    a = y
# ---------- end python_12 ----------
weave_6 = Weave(Pattern=f_x_12, Stream0=flatten(pline_2), Stream1=python_12.a, NullGaps=False)
drain_network_curves = Curve(weave_6)

crv_6 = Curve(weave_6)

preview_7 = CustomPreview(Geometry=crv_6, Shader=ColourSwatch(SwatchColor=RGB(0, 0, 255)))
