# Grasshopper definition unpickle geometry.ghx (Grasshopper 0.8.11)

path = FilePath("C:\Users\demonchaux\Dropbox\localcode\site_ids.txt")
file = ReadFile(Path=path, Lines=True)
item = ListItem(List=file, Index=Slider(13, range=0..48), Wrap=False)
str = String(item)
panel = Panel("""canopymeshes
canopylines
canopybreps
billboards""")
concat = Concatenate(Start="/amigos/db/", End=str)
concat_2 = Concatenate(Start=concat, End=panel)
item_2 = ListItem(List=concat_2, Index=Slider(0, range=0..10), Wrap=False)
panel_2 = Panel(item_2)
python = PythonScript(path=concat_2, read=Toggle(True), GhMemory=0)  # -> out, a; inputs path: String, read: Boolean
# ---------- python: Python ----------
import cPickle as pickle

if path and read:
    try:
        f = open(path, 'rb')
        a = pickle.load(f)
        f.close()
    except:
        print 'problem loading %s\nfile may not exist' % path
# ---------- end python ----------
geo = Geometry(python.a)
panel_3 = Panel(python.out)
panel_4 = Panel(geo)
