# Grasshopper definition view.ghx (Grasshopper 0.8.13)

path = FilePath("C:\Users\demonchaux\Dropbox\localcode\site_ids.txt")
file = ReadFile(Path=path, Lines=True)
sort = SortList(Keys=file)  # -> List, ValuesA
int = Integer(sort.List)
item = ListItem(List=int, Index=Slider(48, range=0..48), Wrap=False)
str = String(item)
concat = Concatenate(Start="/amigos/db/", End=str)
panel = Panel(concat)
concat_2 = Concatenate(Start=concat, End="siteoutline")
python = PythonScript(path=flatten(concat_2), read=Toggle(True), GhMemory=0)  # -> out, a; inputs path: String, read: Boolean
# ---------- python: Python ----------
import cPickle as pickle

if path and read:
    try:
        f = open(path, 'rb')
        a = pickle.load(f)
        f.close()
    except:
        print 'problem loading %s\nfile may not exist' % path
        a = []
# ---------- end python ----------
bang = ExplodeTree(Tree=python.a)  # -> Branch1, Branch2, Branch3, Branch4, Branch5, Branch6, Branch7, Branch8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
crv = Curve(bang.Branch1)
concat_3 = Concatenate(Start=panel, End="view")
panel_2 = Panel(concat_3)
str_2 = String(concat_3)

# ---- group: view
azimuth = Slider(145, range=0..359)
str_3 = String(str)
altitude = Slider(45, range=0..90)
crv_2 = Curve(crv)
slider = Slider(0.5, range=0..1)
f_x = F1(Function="x*pi/180", X=azimuth)
preview = CustomPreview(Geometry=crv_2, Shader=ColourSwatch(SwatchColor=RGB(85, 0, 255)))
f_x_2 = F1(Function="x*pi/180", X=altitude)
panel_3 = Panel(f_x)
multiplication = Multiplication(A=f_x_2, B=-1)
cp = ControlPoints(Curve=crv_2)  # -> Points, Weights, Knots
pline = PolyLine(Vertices=cp.Points, Closed=False)
Y = UnitY(Factor=1)
Z = UnitZ(Factor=1)
rev = Reverse(Vector=Y)
pcen = PolygonCenter(Polyline=pline)
vrot = Rotate(Vector=rev, Axis=Z, Angle=f_x)
Z_2 = UnitZ(Factor=1)
pl = Plane(Origin=pcen, XAxis=vrot, YAxis=Z_2)
rotate = Rotate(Geometry=pl, Angle=multiplication, Plane=pl)  # -> Geometry, Transform
pcomp = PlaneComponents(Plane=rotate.Geometry)  # -> Origin, XAxis, YAxis, ZAxis
amp = Amplitude(Vector=pcomp.XAxis, Amplitude=Slider(61, range=0..100))
python_2 = PythonScript(geometry=crv_2, scaleFactor=Slider(0, range=-50..100), GhMemory=10)  # -> out, a; inputs geometry: GeometryBase, scaleFactor: Double
# ---------- python_2: Python ----------
import scriptcontext

vp = scriptcontext.doc.Views.ActiveView.ActiveViewport
bbox = geometry.GetBoundingBox(True)
bbox.Inflate(-scaleFactor)
vp.ZoomBoundingBox(bbox)
# ---------- end python_2 ----------
python_3 = PythonScript(geometry=crv_2, view_vector=pcomp.XAxis, center_point=pcomp.Origin, GhMemory=0)  # -> out, a; inputs view_vector: Vector3d, center_point: Point3d
# ---------- python_3: Python ----------
import Rhino
import scriptcontext

viewport = scriptcontext.doc.Views.ActiveView.ActiveViewport

viewport.SetCameraDirection(view_vector, True)
viewport.SetCameraTarget(center_point, True)
plane = viewport.GetCameraFrame()[1]

#plane = Rhino.Geometry.Plane(center_point, view_vector)

bbox = geometry.GetBoundingBox(plane)
a = [bbox, plane]
# ---------- end python_3 ----------
python_4 = PythonScript(siteID=str_3, GhMemory=0)  # -> out, a; inputs siteID: String
# ---------- python_4: Python ----------
import Rhino
from scriptcontext import doc

v = []

vp = doc.Views.ActiveView.ActiveViewport
a = Rhino.DocObjects.ViewportInfo(vp)
# ---------- end python_4 ----------
vdis = VectorDisplay(Anchor=pcen, Vector=amp)
dispatch = Dispatch(List=python_3.a, DispatchPattern=[True, False])  # -> ListA, ListB
xy = XYPlane(Origin=Point(0, 0, 0))
pln = Plane(dispatch.ListB)
box = Box(dispatch.ListA)
orient = Orient(Geometry=box, Initial=xy, Final=pln)  # -> Geometry, Transform
panel_4 = Panel(python_3.a)
explode = BrepComponents(Brep=orient.Geometry)  # -> Faces, Edges, Vertices
join = BrepJoin(Breps=explode.Faces)  # -> Breps, Closed

# ----
geo = Geometry(flatten([crv, pcomp.XAxis, pcomp.Origin]))
pickler = PythonScript(data=geo, path=str_2, write=Toggle(False), GhMemory=0)  # -> out, a; inputs data: list, path: String
# ---------- pickler: Python ----------
import cPickle as pickle


if path and data and write:
    f = open(path, 'wb')
    pickle.dump(data, f)
    f.close()
# ---------- end pickler ----------

# ---- group: view (continued)
panel_5 = Panel(geo)

# ----
panel_6 = Panel(pickler.a)
panel_7 = Panel(pickler.out)
