# Grasshopper definition watersheds.ghx (Grasshopper 0.8.13)

panel = Panel("""78
112""")
item = ListItem(List=panel, Index=Slider(0, range=0..1), Wrap=False)
concat = Concatenate(Start="C:\amigos\dump\", End=item)
panel_2 = Panel("""site
localwaterbasin
mediumwaterbasin
largewaterbasin
groundwaterbasin""")
concat_2 = Concatenate(Start=concat, End="-watersheds")
concat_3 = Concatenate(Start=concat_2, End=".3dm")
panel_3 = Panel(concat_3)
python = PythonScript(FilePaths=concat_3, LayerNames=panel_2, DoImport=Toggle(True), GhMemory=0)  # -> out, layerTree; inputs FilePaths: list, LayerNames: list
# ---------- python: Python ----------
import Rhino


# for accesssing GH classes
import clr
clr.AddReference("Grasshopper")
from Grasshopper.Kernel.Data import GH_Path
from Grasshopper import DataTree


# read geometry out of 3dm files and filter by layernames
if DoImport and FilePaths and LayerNames:
    
    layerTree = DataTree[Rhino.Geometry.GeometryBase]() # make a DataTree
    
    for filepath in FilePaths:
        model = Rhino.FileIO.File3dm.Read(filepath)
        if not model: continue
        for i, layer in enumerate(LayerNames):
            path = GH_Path(i)
            geometry = []
            objs = model.Objects.FindByLayer(layer)
            for obj in objs:
                geom = obj.Geometry
                geom.EnsurePrivateCopy()
                geometry.append(geom)
            layerTree.AddRange(geometry, path)
        # models can take up a considerable amount of
        # memory that we don't need, so get rid of it
        # after copying the geometry we want out of it
        model.Dispose()
# ---------- end python ----------
bang = ExplodeTree(Tree=python.layerTree)  # -> Branch0, Branch1, Branch2, Branch3, Branch4
viewer = ParamViewer(python.layerTree)
panel_4 = Panel(python.out)
crv = Curve(bang.Branch1)
crv_2 = Curve(bang.Branch2)
crv_3 = Curve(bang.Branch3)
crv_4 = Curve(bang.Branch4)
crv_5 = Curve(bang.Branch0)
panel_5 = Panel(python.layerTree)
